# Dynamo graph Example 1 - Creating a simple beam.dyn (Dynamo 2.11.0.4533)
# packages: FemDesign 21.0.1

# group: Example 1: Modelling a simple beam
# note: This example will show you how to model a simple
# supported beam, and how to save it for export to
# FEM-Design. Before running, make sure you have a window with FEM-Design open.
# note: This example was last edited on 2022-05-05.

# group: 0. Open databases for materials and sections
# note: FEM-Design uses the standardized database for materials and sections. Using the associated components will allow you to call predefined materials and sections for your model.
# If you want to get an overview of all available items in the database, the ListMaterialNames / ListSectionNames components lets you display the entire list in a separate panel.
code_block = CodeBlock { "S"; }
default = FemDesign.Materials.MaterialDatabase.Default(countryCode=code_block)
default_2 = FemDesign.Sections.SectionDatabase.Default()

# group: 1. Constructing the beam
# note: The minimum requirements for the beam component is a curve for the beam to follow, a crossection to complete the geometry, and a constituting material.
code_block_2 = CodeBlock { Point.ByCoordinates(0,0); Point.ByCoordinates(10,10); }
byStartPointEndPoint = Line.ByStartPointEndPoint(startPoint=code_block_2.out0, endPoint=code_block_2.out1)
code_block_3 = CodeBlock { "C20/25"; }
getMaterialByName = FemDesign.Materials.Material.GetMaterialByName(materialDatabase=default, materialName=code_block_3)
code_block_4 = CodeBlock { "Concrete sections, Rectangle, 400x500"; }
getSectionByName = FemDesign.Sections.Section.GetSectionByName(sectionDatabase=default_2, sectionName=code_block_4)
code_block_5 = CodeBlock { "Example_Beam"; }
beam = FemDesign.Bars.Bar.Beam(curve=byStartPointEndPoint, material=getMaterialByName, section=getSectionByName, identifier=code_block_5)

# group: 3. Defining load cases
code_block_6 = CodeBlock { "Liveload"; "static"; "permanent"; }
createLoadCase = FemDesign.Loads.LoadCase.CreateLoadCase(name=code_block_6.out0, type=code_block_6.out1, durationClass=code_block_6.out2)
# note: The load cases are used both in the final model, but also as variables when creating the loads and the load combinations.
code_block_7 = CodeBlock { "Deadload"; "dead_load"; "permanent"; }
createLoadCase_2 = FemDesign.Loads.LoadCase.CreateLoadCase(name=code_block_7.out0, type=code_block_7.out1, durationClass=code_block_7.out2)

# group: 4. Applying loads
code_block_8 = CodeBlock { 0.5; }
pointAtParameter = Curve.PointAtParameter(curve=byStartPointEndPoint, param=code_block_8)
code_block_9 = CodeBlock { 0; 0; -5; }
byCoordinates = Vector.ByCoordinates(x=code_block_9.out0, y=code_block_9.out1, z=code_block_9.out2)
force = FemDesign.Loads.PointLoad.Force(point=pointAtParameter, force=byCoordinates, loadCase=createLoadCase)
# note: In this example, two forces are applied: one vertically at the middle of the beam, and one horizontally at the end of the beam. You can find components for point loads, line loads, and more in the Loads tab.
code_block_10 = CodeBlock { 0.75; }
pointAtParameter_2 = Curve.PointAtParameter(curve=byStartPointEndPoint, param=code_block_10)
tangentAtParameter = Curve.TangentAtParameter(curve=byStartPointEndPoint, param=code_block_10)
ZAxis = Vector.ZAxis()
cross = Vector.Cross(vector=tangentAtParameter, cross=ZAxis)
code_block_11 = CodeBlock { 10.0; }
scale = Vector.Scale(vector=cross, scale_factor=code_block_11)
force_2 = FemDesign.Loads.PointLoad.Force(point=pointAtParameter_2, force=scale, loadCase=createLoadCase)

forces = List.Create(item0=force, item1=force_2)
load_cases = List.Create(item0=createLoadCase_2, item1=createLoadCase)

# group: 5. Creating load combinations
code_block_12 = CodeBlock { "SLS"; }
# note: The load combinations have to be created from tabular values.
code_block_13 = CodeBlock { "ServiceabilityCharacteristic"; }
code_block_14 = CodeBlock()
# ---------- code_block_14.designscript (2 lines) ----------
[1.0,
1.0];
# ----------------------------------------
createLoadCombination = FemDesign.Loads.LoadCombination.CreateLoadCombination(name=code_block_12, type=code_block_13, loadCases=load_cases, gammas=code_block_14)
code_block_15 = CodeBlock { "ULS"; }
code_block_16 = CodeBlock { "UltimateOrdinary"; }
code_block_17 = CodeBlock()
# ---------- code_block_17.designscript (2 lines) ----------
[1.35,
1.5];
# ----------------------------------------
createLoadCombination_2 = FemDesign.Loads.LoadCombination.CreateLoadCombination(name=code_block_15, type=code_block_16, loadCases=load_cases, gammas=code_block_17)

load_combinations = List.Create(item0=createLoadCombination, item1=createLoadCombination_2)

# group: 2. Defining the supports
rigidPoint = FemDesign.Releases.Motions.RigidPoint()
rigidPoint_2 = FemDesign.Releases.Rotations.RigidPoint()
define = FemDesign.Supports.PointSupport.Define(point=code_block_2.out0, motions=rigidPoint, rotations=rigidPoint_2)
# note: The PointSupport component allows you to specify the support conditions yourself, using a define component for motion and/or rotation.
# For completely free or rigid settings, there are pre-set components you can use. Please note that the rigidpoint and rigidline components differ in default stiffness; this is consistent with the FEM-Design implementation.
number = DoubleInput(100000000)
define_2 = FemDesign.Releases.Motions.Define(xNeg=number, xPos=number, yNeg=number, yPos=number, zNeg=number, zPos=number)
free = FemDesign.Releases.Rotations.Free()
define_3 = FemDesign.Supports.PointSupport.Define(point=code_block_2.out1, motions=define_2, rotations=free)

supports = List.Create(item0=define, item1=define_3)

# group: 6. Creating the model
# note: Loads, Load cases and Load combinations all have their own input, while the Beam and the Supports both count as elements. Remember to use the same country code as before!
country_code = CodeBlock { "S"; }
createNewModel = FemDesign.Model.CreateNewModel(countryCode=country_code, bars=beam, loads=forces, loadCases=load_cases, loadCombinations=load_combinations, supports=supports)

# group: 7. Create a directory for your file
# note: You can either choose to save your file in your current directory, or select your own separate folder. If you'd choose the latter, simply rightclick the directory component and choose "select a directory". Finally, edit the file name panel to give your file a name. Remember to end it with .struxml .
select_your_directory = Directory("C:\Users\SamuelNyberg\OneDrive - StruSoft AB\Samuels arbetshörna\2. API-exempel")
code_block_18 = CodeBlock { "Example 1 - A simple beam.struxml"; }
concat = String.Concat(string0=select_your_directory, string1=code_block_18)

# group: 8b. ...or open it in FEM-Design
# note: If you want, you can call FEM-Design from the script, to immediately open your new model.
close_all_open_fem_design = BoolSelector(true)  # "Close all open FEM-Design windows?"
set_to_true_to_run_script_open = BoolSelector(false)  # "Set to True to run script & open model in FEM-Design"
openModel = FemDesign.Model.OpenModel(fdModel=createNewModel, struxmlPath=concat, closeOpenWindows=close_all_open_fem_design, runNode=set_to_true_to_run_script_open)

# group: 8a. Save the model...
# note: Once you have set a proper file path,
# this script is set up to save your model
# as soon as it finished running.
saveModel = FemDesign.Model.SaveModel(fdModel=createNewModel, struxmlPath=concat)
