# Dynamo graph 1_helloWorld_createSupports.dyn (Dynamo 2.11.0.4533)
# packages: FemDesign 20.0.0

# group: scale
integer_slider = IntegerSlider(3, range=0..10 step 1)

# group: geometry
helloWorld = Custom[helloWorld](factor=integer_slider)

# group: material
default = FemDesign.Materials.MaterialDatabase.Default()
code_block = CodeBlock { "C45/55"; }
getMaterialByName = FemDesign.Materials.Material.GetMaterialByName(materialDatabase=default, materialName=code_block)

# group: plates
code_block_2 = CodeBlock { 0.2; }
plate = FemDesign.Shells.Slab.Plate(surface=helloWorld, thickness=code_block_2, material=getMaterialByName)

# group: supports
perimeterCurves = Surface.PerimeterCurves(surface=helloWorld)
hinged = FemDesign.Supports.LineSupport.Hinged(curve=perimeterCurves)
flatten = List.Flatten(list=hinged)

# group: model
createNewModel = FemDesign.Model.CreateNewModel(shells=plate, supports=flatten)

# group: directory
select_your_directory = Directory("C:\Users\SamuelNyberg\OneDrive - StruSoft AB\Samuels arbetshörna\2. API-exempel")
code_block_3 = CodeBlock { "\\"; "HelloWorldSupports.struxml"; }
concat = String.Concat(string0=select_your_directory, string1=code_block_3.out0, string2=code_block_3.out1)

# group: open
code_block_4 = CodeBlock { true; }
openModel = FemDesign.Model.OpenModel(fdModel=createNewModel, struxmlPath=concat, runNode=code_block_4)
