# Dynamo graph 2_helloWorld_createLoads.dyn (Dynamo 2.11.0.4533)
# packages: FemDesign 20.0.0

# group: scale
integer_slider = IntegerSlider(3, range=0..10 step 1)

# group: geometry
helloWorld = Custom[helloWorld](factor=integer_slider)

# group: material
default = FemDesign.Materials.MaterialDatabase.Default()
code_block = CodeBlock { "C45/55"; }
getMaterialByName = FemDesign.Materials.Material.GetMaterialByName(materialDatabase=default, materialName=code_block)

# group: plates
code_block_2 = CodeBlock { 0.2; }
plate = FemDesign.Shells.Slab.Plate(surface=helloWorld, thickness=code_block_2, material=getMaterialByName)

# group: load, loadcase, loadcombination
code_block_3 = CodeBlock { -1; }
byCoordinates = Vector.ByCoordinates(z=code_block_3)
code_block_4 = CodeBlock { "enhetsLast"; }
createLoadCase = FemDesign.Loads.LoadCase.CreateLoadCase(name=code_block_4)
uniform = FemDesign.Loads.SurfaceLoad.Uniform(surface=helloWorld, force=byCoordinates, loadCase=createLoadCase)
code_block_5 = CodeBlock { "LC1"; "ultimate_ordinary"; 100; }
createLoadCombination = FemDesign.Loads.LoadCombination.CreateLoadCombination(name=code_block_5.out0, type=code_block_5.out1, loadCases=createLoadCase, gammas=code_block_5.out2)

# group: supports
perimeterCurves = Surface.PerimeterCurves(surface=helloWorld)
hinged = FemDesign.Supports.LineSupport.Hinged(curve=perimeterCurves)
flatten = List.Flatten(list=hinged)

# group: model
createNewModel = FemDesign.Model.CreateNewModel(shells=plate, loads=uniform, loadCases=createLoadCase, loadCombinations=createLoadCombination, supports=flatten)

# group: directory
select_your_directory = Directory("C:\Users\SamuelNyberg\OneDrive - StruSoft AB\Samuels arbetshörna\2. API-exempel")
code_block_6 = CodeBlock { "\\"; "HelloWorldLoads.struxml"; }
concat = String.Concat(string0=select_your_directory, string1=code_block_6.out0, string2=code_block_6.out1)

# group: open
code_block_7 = CodeBlock { true; }
openModel = FemDesign.Model.OpenModel(fdModel=createNewModel, struxmlPath=concat, runNode=code_block_7)
