# Dynamo graph 4_helloWorld_designCheck.dyn (Dynamo 2.11.0.4533)
# packages: FemDesign 20.0.0, FemDesign 21.0.1

# group: scale
integer_slider = IntegerSlider(3, range=0..10 step 1)

# group: geometry
helloWorld = Custom[helloWorld](factor=integer_slider)

# group: material
default = FemDesign.Materials.MaterialDatabase.Default()
code_block = CodeBlock { "C45/55"; }
getMaterialByName = FemDesign.Materials.Material.GetMaterialByName(materialDatabase=default, materialName=code_block)

# group: plates
code_block_2 = CodeBlock { 0.2; }
plate = FemDesign.Shells.Slab.Plate(surface=helloWorld, thickness=code_block_2, material=getMaterialByName)

# group: reinforcement
code_block_3 = CodeBlock { ["y", "x"]; 0.2; "bottom"; 0.02; }
reinforcementLayout = FemDesign.Reinforcement.Straight.ReinforcementLayout(direction=code_block_3.out0, space=code_block_3.out1, face=code_block_3.out2, cover=code_block_3.out3)
code_block_4 = CodeBlock { 0.016; }
default_2 = FemDesign.Materials.MaterialDatabase.Default()
code_block_5 = CodeBlock { "K500C"; }
getMaterialByName_2 = FemDesign.Materials.Material.GetMaterialByName(materialDatabase=default_2, materialName=code_block_5)
ribbed = FemDesign.Reinforcement.WireProfileType.Ribbed()
define = FemDesign.Reinforcement.Wire.Define(diameter=code_block_4, reinforcingMaterial=getMaterialByName_2, profile=ribbed)
bySurface = FemDesign.Reinforcement.SurfaceReinforcement.BySurface(surface=helloWorld, straight=reinforcementLayout, wire=define, lacing=CrossProduct)
addToSlab = FemDesign.Reinforcement.SurfaceReinforcement.AddToSlab(slab=plate, surfaceReinforcement=bySurface)

# group: load, loadcase, loadcombination
code_block_6 = CodeBlock { -1; }
byCoordinates = Vector.ByCoordinates(z=code_block_6)
code_block_7 = CodeBlock { "enhetsLast"; }
createLoadCase = FemDesign.Loads.LoadCase.CreateLoadCase(name=code_block_7)
uniform = FemDesign.Loads.SurfaceLoad.Uniform(surface=helloWorld, force=byCoordinates, loadCase=createLoadCase)
code_block_8 = CodeBlock { "LC1"; "ultimate_ordinary"; 100; }
createLoadCombination = FemDesign.Loads.LoadCombination.CreateLoadCombination(name=code_block_8.out0, type=code_block_8.out1, loadCases=createLoadCase, gammas=code_block_8.out2)

# group: supports
perimeterCurves = Surface.PerimeterCurves(surface=helloWorld)
hinged = FemDesign.Supports.LineSupport.Hinged(curve=perimeterCurves)
flatten = List.Flatten(list=hinged)

# group: model
createNewModel = FemDesign.Model.CreateNewModel(shells=addToSlab, loads=uniform, loadCases=createLoadCase, loadCombinations=createLoadCombination, supports=flatten)

# group: directory
select_your_directory = Directory("C:\Users\SamuelNyberg\OneDrive - StruSoft AB\Samuels arbetshörna\2. API-exempel")
code_block_9 = CodeBlock { "\\"; "HelloWorldDesignCheck.struxml"; }
concat = String.Concat(string0=select_your_directory, string1=code_block_9.out0, string2=code_block_9.out1)

# group: rc module
code_block_10 = CodeBlock { "rc"; }
code_block_11 = CodeBlock { true; }
define_2 = FemDesign.Calculate.Analysis.Define(calcDesign=code_block_11)
code_block_12 = CodeBlock { false; true; }
define_3 = FemDesign.Calculate.Design.Define(autoDesign=code_block_12.out0, check=code_block_12.out1)
code_block_13 = CodeBlock { true; true; }
runDesign = FemDesign.Calculate.Application.RunDesign(mode=code_block_10, fdModel=createNewModel, struxmlPath=concat, analysis=define_2, design=define_3, closeOpenWindows=code_block_13.out0, runNode=code_block_13.out1)
