# Dynamo custom node helloWorld.dyf (Dynamo 2.2.1.5175)
# category: userGeometry

factor = Input(factor: var[]..[])

# group: hello world!
H = CodeBlock { x = [0, 0.4, 0.4, 0.8, 0.8, 1.2, 1.2, 0.8, 0.8, 0.4, 0.4, 0]; y = [0, 0, -0.8, -0.8, 0, 0, -2, -2, -1.2, -1.2, -2, -2]; }
E = CodeBlock()
# ---------- E.designscript (2 lines) ----------
x = [0, 1.2, 1.2, 0.4, 0.4, 0.8, 0.8, 0.4, 0.4, 1.2, 1.2, 0];
y = [0, 0, -0.4, -0.4, -0.8, -0.8, -1.2, -1.2, -1.6, -1.6, -2, -2];
# ----------------------------------------
L = CodeBlock { x = [0, 0.4, 0.4, 1.2, 1.2, 0]; y = [0, 0, -1.6, -1.6, -2, -2]; }
O = CodeBlock { x = [0, 1.2, 1.2, 0]; y = [0, 0, -2, -2]; }
code_block = CodeBlock(x1=E.x, x2=L.x, x3=L.x, x4=O.x) { x1 + 2; x2 + 4; x3 + 6; x4 + 8; }
W = CodeBlock()
# ---------- W.designscript (2 lines) ----------
x = [0, 0.4, 0.4, 0.8, 0.8, 1.2, 1.2, 1.6, 1.6, 2.0, 2.0, 0];
y = [0, 0, -1.6, -1.6, -0.8, -0.8, -1.6, -1.6, 0, 0, -2, -2];
# ----------------------------------------
R = CodeBlock { x = [0, 1.2, 1.2, 0.8, 1.2, 0.8, 0.4, 0.4, 0]; y = [0, 0, -1.2, -1.2, -2, -2, -1.2, -2, -2]; }
D = CodeBlock { x = [0, 0.8, 1.2, 1.2, 0.8, 0]; y = [0, 0, -0.4, -1.6, -2, -2]; }
code_block_2 = CodeBlock(x1=O.x, x2=R.x, x3=L.x, x4=D.x) { x1 + 2.4; x2 + 4.4; x3 + 6.4; x4 + 8.4; }
list_create = List.Create(item0=H.x, item1=code_block.out0, item2=code_block.out1, item3=code_block.out2, item4=code_block.out3, item5=W.x, item6=code_block_2.out0, item7=code_block_2.out1, item8=code_block_2.out2, item9=code_block_2.out3)
code_block_3 = CodeBlock(y0=W.y, y1=O.y, y2=R.y, y3=L.y, y4=D.y) { y0 - 2.4; y1 - 2.4; y2 - 2.4; y3 - 2.4; y4 - 2.4; }
list_create_2 = List.Create(item0=H.y, item1=E.y, item2=L.y, item3=L.y, item4=O.y, item5=code_block_3.out0, item6=code_block_3.out1, item7=code_block_3.out2, item8=code_block_3.out3, item9=code_block_3.out4)
code_block_4 = CodeBlock(x=list_create, factor=factor, y=list_create_2) { x * factor; y * factor; }
byCoordinates = Point.ByCoordinates(x=code_block_4.out0, y=code_block_4.out1)
byPerimeterPoints = Surface.ByPerimeterPoints(points=byCoordinates)

Surface = Output(byPerimeterPoints)
helloWorld = Custom[helloWorld]()  # unwired: factor
