# Dynamo graph hyperbolicShell.dyn (Dynamo 2.2.1.5175)

# group: geometry
number_slider = DoubleSlider(24.7, range=0..100 step 0.1)
number_slider_2 = DoubleSlider(17.5, range=0..100 step 0.1)
number_slider_3 = DoubleSlider(18.5, range=0..20 step 0.5)
integer_slider = IntegerSlider(9, range=0..15 step 1)
integer_slider_2 = IntegerSlider(8, range=0..15 step 1)
hyperbolicShellGeometry = Custom[hyperbolicShellGeometry](x=number_slider, y=number_slider_2, z=number_slider_3, u=integer_slider, v=integer_slider_2)

# group: material
default = FemDesign.Materials.MaterialDatabase.Default()
code_block = CodeBlock { "C25/30"; }
getMaterialByName = FemDesign.Materials.Material.GetMaterialByName(materialDatabase=default, materialName=code_block)

# group: section
default_2 = FemDesign.Sections.SectionDatabase.Default()
code_block_2 = CodeBlock { "Concrete sections, Rectangle, 200x250"; }
getSectionByName = FemDesign.Sections.Section.GetSectionByName(sectionDatabase=default_2, sectionName=code_block_2)

# group: structure elements
columnDefault = FemDesign.Bars.Bar.ColumnDefault(line=hyperbolicShellGeometry.LinesAtPerimeter, material=getMaterialByName, section=getSectionByName)
code_block_3 = CodeBlock { 0.2; }
plateDefault = FemDesign.Shells.Slab.PlateDefault(surface=hyperbolicShellGeometry.Panels, thickness=code_block_3, material=getMaterialByName)
rigid = FemDesign.Supports.PointSupport.Rigid(point=hyperbolicShellGeometry.SupportPoints)

# group: loads
code_block_4 = CodeBlock { 0; 0; -10; "LC1"; }
define = FemDesign.Loads.Force.Define(fx=code_block_4.out0, fy=code_block_4.out1, fz=code_block_4.out2)
createLoadCase = FemDesign.Loads.LoadCase.CreateLoadCase(name=code_block_4.out3)
uniform = FemDesign.Loads.SurfaceLoad.Uniform(surface=hyperbolicShellGeometry.Panels, force=define, loadCase=createLoadCase)

# group: model
code_block_5 = CodeBlock { "S"; }
createNewModel = FemDesign.Model.Model.CreateNewModel(countryCode=code_block_5, bars=columnDefault, shells=plateDefault, loads=uniform, loadCases=createLoadCase, supports=rigid)
file_path = Filename("..\..\..\..\..\..\..\temp\hyperbolicPlate.struxml")

# group: open model
code_block_6 = CodeBlock { true; }
openModel = FemDesign.Model.Model.OpenModel(model=createNewModel, struxmlPath=file_path, closeOpenWindows=code_block_6)

# group: analysis
code_block_7 = CodeBlock { true; }
default_3 = FemDesign.Model.CalculationParameters.Analysis.Default(calcCase=code_block_7)
code_block_8 = CodeBlock { false; true; }
runAnalysis = FemDesign.Model.Model.RunAnalysis(model=createNewModel, struxmlPath=file_path, analysis=default_3, endSession=code_block_8.out0, closeOpenWindows=code_block_8.out1)  # frozen
