# Dynamo custom node hyperbolicShellGeometry.dyf "hyperbolicPlateGeometry" (Dynamo 2.1.0.7500)
# category: userGeometry

x = Input(x: double)
y = Input(y: double)
z = Input(z: double)
code_block = CodeBlock(x=x, y=y, z=z) { [20, 20+2*x/3]; [20, 20+y]; [0, z]; [20, 20-2*x/3]; [20+2*y, 20+y]; [0, z]; }
byCoordinates = Point.ByCoordinates(x=code_block.out0, y=code_block.out1, z=code_block.out2)
code_block_2 = CodeBlock(l=byCoordinates) { l[0]; l[1]; }
byStartPointEndPoint = Line.ByStartPointEndPoint(startPoint=code_block_2.out0, endPoint=code_block_2.out1)
byCoordinates_2 = Point.ByCoordinates(x=code_block.out3, y=code_block.out4, z=code_block.out5)
code_block_3 = CodeBlock(l=byCoordinates_2) { l[0]; l[1]; }
byStartPointEndPoint_2 = Line.ByStartPointEndPoint(startPoint=code_block_3.out0, endPoint=code_block_3.out1)
list_create = List.Create(item0=byStartPointEndPoint, item1=byStartPointEndPoint_2)
byLoft = Surface.ByLoft(crossSections=list_create)
u = Input(u: int)
v = Input(v: int)
panelTriangleA = Geometry.Panel.PanelTriangleA(srf=byLoft, u=u, v=v)
Panels = Output(panelTriangleA.Panels)
Points = Output(panelTriangleA.Points)
code_block_4 = CodeBlock(u=u, v=v) { 0..1..#u+1; 0..1..#v+1; }
pointAtParameter = Curve.PointAtParameter(curve=byStartPointEndPoint_2, param=code_block_4.out0)
byStartPointEndPoint_3 = Line.ByStartPointEndPoint(startPoint=code_block_3.out1, endPoint=code_block_2.out0)
pointAtParameter_2 = Curve.PointAtParameter(curve=byStartPointEndPoint_3, param=code_block_4.out1)
restOfItems = List.RestOfItems(list=pointAtParameter_2)
list_create_2 = List.Create(item0=pointAtParameter, item1=restOfItems)
flatten = List.Flatten(list=list_create_2)
X = Point.X(point=flatten)
Y = Point.Y(point=flatten)
byCoordinates_3 = Point.ByCoordinates(x=X, y=Y)
byStartPointEndPoint_4 = Line.ByStartPointEndPoint(startPoint=flatten, endPoint=byCoordinates_3)
python_script = Python(IN[0]=byStartPointEndPoint_4)
# ---------- python_script.python (13 lines) ----------
# Load the Python Standard and DesignScript Libraries
import sys
import clr
clr.AddReference('ProtoGeometry')
from Autodesk.DesignScript.Geometry import *

# The inputs to this node will be stored as a list in the IN variables.
dataEnteringNode = IN

# Place your code below this line
lst = IN[0]
# Assign your output to the OUT variable.
OUT = lst[1:-1]
# ----------------------------------------
LinesAtPerimeter = Output(python_script)
SupportPoints = Output(byCoordinates_3)
