# Grasshopper definition Example 1 - Creating a simple beam.gh (Grasshopper 1.0.7)
# plug-ins: FEM-Design

span_m = Slider(5.44, range=1..10)
X = UnitX(Factor=span_m)
pt = Point("0,0,0")
move = Move(Geometry=pt, Motion=X)  # -> Geometry, Transform
pt_2 = Point(move.Geometry)
ln = Line(StartPoint=pt, EndPoint=pt_2)
beam_line = Curve(ln)

default = MaterialDatabaseDefault(CountryCode="S")  # -> SteelMaterial, ConcreteMaterial, TimberMaterial, ReinforcementMaterial, StratumMaterial, CustomMaterial
panel = Panel(default.SteelMaterial)
getmaterialbyname_index = MaterialGetMaterialByNameIndex(Materials=default.SteelMaterial, MaterialNameIndex="S 355")
material = Data(getmaterialbyname_index)

default_2 = SectionDatabaseDefault()  # -> SteelSection, ConcreteSection, TimberSection, HollowCoreSection, CustomSection
panel_2 = Panel(default_2.SteelSection)
getsectionbyname_index = SectionGetSectionByNameIndex(Sections=default_2.SteelSection, SectionNameIndex="Steel sections, IPE, 220")
section = Data(getsectionbyname_index)

list = ValueList({"ordinary", "dead_load", "soil_dead_load", "shrinkage", "prestressing", "fire", "seis_sxp", "seis_sxm", "seis_syp", "seis_sym"}, selected="dead_load")
list_2 = ValueList({"ordinary", "dead_load", "soil_dead_load", "shrinkage", "prestressing", "fire", "seis_sxp", "seis_sxm", "seis_syp", "seis_sym"}, selected="ordinary")
list_3 = ValueList({"permanent", "long-term", "medium-term", "short-term", "instantaneous"}, selected="permanent")
list_4 = ValueList({"permanent", "long-term", "medium-term", "short-term", "instantaneous"}, selected="permanent")
construct = LoadCaseConstruct(Name="DeadLoad", Type=list, DurationClass=list_3)
construct_2 = LoadCaseConstruct(Name="LiveLoad", Type=list_2, DurationClass=list_4)

beam_line_2 = Curve(beam_line)
end = EndPoints(Curve=beam_line_2)  # -> Start, End
construct_3 = MotionsConstruct(X_neg="1e10", X_pos="1e10", Y_neg="1e10", Y_pos="1e10", Z_neg="1e10", Z_pos="1e10")
free = RotationsFree()
pt_3 = Point([end.Start, end.End])
construct_4 = PointSupportConstruct(Position=pt_3, Motions=construct_3, Rotations=free, Identifier="S")
support = Data(construct_4)

loadcase = Data(construct)
loadcase_2 = Data(construct_2)
list_5 = ValueList({"ultimate_ordinary", "ultimate_accidental", "ultimate_seismic", "serviceability_quasi_permanent", "serviceability_frequent", "serviceability_characteristic"}, selected="ultimate_ordinary")
panel_3 = Panel("""1.35
1.50""")
merge = Merge(Data1=loadcase, Data2=loadcase_2)
construct_5 = LoadCombinationConstruct(Name="ULS", Type=list_5, LoadCase=merge, Gamma=panel_3)
loadcombination = Data(construct_5)

Z = UnitZ(Factor="-6.00")
beam_line_3 = Curve(beam_line)
loadcase_3 = Data(construct_2)
force = LineLoadForce(Curve=beam_line_3, StartForce=Z, LoadCase=loadcase_3, ConstLoadDir=True, LoadProjection=False)
load = Data(force)

beam_line_4 = Curve(beam_line)
material_2 = Data(material)
section_2 = Data(section)
beam = BarsBeam(Curve=beam_line_4, Material=material_2, Section=section_2, OrientLCS=True, Identifier="B")
bar = Data(beam)

loadcase_4 = Data([construct, construct_2])

loadcombinations = Data(flatten(loadcombination))
loadcases = Data(flatten(loadcase_4))
elements = Data(flatten([bar, support]))
loads = Data(flatten(load))
construct_6 = ModelConstruct(CountryCode="S", StructureElements=elements, Loads=loads, LoadCases=loadcases, LoadCombinations=loadcombinations)
fdmodel = Data(construct_6)

define = CombDefine(
    NLEmaxiter=30,
    PLdefloadstep=20,
    PLminloadstep=2,
    Plmaxeqiter=30,
    NLSMohr=True,
    NLSinitloadstep=10,
    NLSminloadstep=10,
    NLSactiveelemratio=5,
    NLSplasticelemratio=5,
    CRloadstep=20,
    CRmaxiter=30,
    CRstifferror=2)
fdmodel_2 = Data(fdmodel)
toggle = BooleanToggle(True)
resultstype = ResultsType({"NodalDisplacement", "PointSupportReaction", "PointSupportReactionMinMax", "BarDisplacement", "BarInternalForce", "BarStress", "LineSupportReaction", "ShellDisplacement", "ShellInternalForce", "ShellStress", "LabelledSectionInternalForce", "LabelledSectionResultant", "NodalVibrationShape", "EigenFrequencies", "QuantityEstimationConcrete", "QuantityEstimationSteel", "QuantityEstimationTimber", "QuantityEstimationTimberPanel", "QuantityEstimationGeneral", "QuantityEstimationReinforcement"}, selected="PointSupportReaction")
define_2 = AnalysisDefine(
    Comb=define,
    CalcCase=toggle,
    CalcCstage=False,
    CalcImpf=False,
    CalcComb=toggle,
    CalcGmax=False,
    CalcStab=False,
    CalcFreq=False,
    CalcSeis=False,
    CalcDesign=False,
    CalcFootfall=False,
    Elemfine=False,
    Diaphragm=False,
    PeakSmoothing=False)
runanalysis = ApplicationRunAnalysis(
    FdModel=fdmodel_2,
    Analysis=define_2,
    ResultTypes=resultstype,
    EndSession=False,
    CloseOpenWindows=False,
    RunNode=Toggle(True))  # -> FdModel, FdFeaModel, Results, HasExited
results = Data(runanalysis.Results)

results_2 = Data(results)
pointsupportreaction = PointSupportReaction(Result=results_2, CaseCombinationName="LiveLoad")  # -> CaseIdentifier, Identifier, NodeId, SupportPosition, ReactionForce, ReactionMoment, ForceResultant, MomentResultant
panel_4 = Panel(pointsupportreaction.SupportPosition)
panel_5 = Panel(pointsupportreaction.ReactionForce)
