# Grasshopper definition Example 11 - Stability analysis.gh (Grasshopper 1.0.7)
# plug-ins: FEM-Design

# ----
# Example 11: Stability analysis
# This example will show you how to automatically run a stability analysis
# in FEM-Design from within the Grasshopper script.
# USER ADVICE:
# 
# •  If you hover over any input or output node with your cursor, you can see what sort of data
#    is expected to go in or out of said node, as well as what the node currently contains. Some
#    nodes are never really empty, but contain a default value instead.
# 
# •  You can also hover over the middle of the component to see what it is called and read a
#    short description of its function.
# 
# • By pressing CTRL+ALT+Left mouse buttons on a component, Grasshopper will show you
#    where the component is located in the menus.
# 
# Use these tips to familiarize yourself with the components in these examples!
info = Info(versionWhenCreated="23.2.0")

materialdatabase = MaterialDatabase(CountryCode="S")  # -> SteelMaterial, ConcreteMaterial, TimberMaterial, ReinforcementMaterial, StratumMaterial, CustomMaterial
panel = Panel(materialdatabase.SteelMaterial)
getmaterialbyname_index = MaterialGetMaterialByNameIndex(Materials=materialdatabase.SteelMaterial, MaterialNameIndex="S 355")
material = Data(getmaterialbyname_index)

sectiondatabase = SectionDatabase()  # -> SteelSection, ConcreteSection, TimberSection, HollowCoreSection, CustomSection
panel_2 = Panel(sectiondatabase.SteelSection)
getsectionbyname_index = SectionGetSectionByNameIndex(Sections=sectiondatabase.SteelSection, SectionNameIndex="Steel sections, IPE, 220")
section = Data(getsectionbyname_index)

list = ValueList({"ordinary", "dead_load", "soil_dead_load", "shrinkage", "prestressing", "fire", "seis_sxp", "seis_sxm", "seis_syp", "seis_sym"}, selected="dead_load")
list_2 = ValueList({"permanent", "long-term", "medium-term", "short-term", "instantaneous"}, selected="permanent")
construct = LoadCaseConstruct(Name="dead load", Type=list, DurationClass=list_2)

list_3 = ValueList({"ordinary", "dead_load", "soil_dead_load", "shrinkage", "prestressing", "fire", "seis_sxp", "seis_sxm", "seis_syp", "seis_sym"}, selected="ordinary")
list_4 = ValueList({"permanent", "long-term", "medium-term", "short-term", "instantaneous"}, selected="short-term")
construct_2 = LoadCaseConstruct(Name="live load", Type=list_3, DurationClass=list_4)

loadcases = Data([construct, construct_2])

crv = Curve(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)
material_2 = Data(material)
section_2 = Data(section)
column = BarsColumn(Line=crv, Material=material_2, Section=section_2, OrientLCS=True, Identifier="C")

toggle = BooleanToggle(False)
end = EndPoints(Curve=crv)  # -> Start, End
hinged = PointSupportHinged(PointPlane=end.Start, Identifier="S")
simple = PointSupportSimple(PointPlane=end.End, Tx=True, Ty=True, Tz=toggle, Rx=toggle, Ry=toggle, Rz=toggle, Identifier="S")
supports = Data([hinged, simple])

list_5 = ValueList({"ultimate_ordinary", "ultimate_accidental", "ultimate_seismic", "serviceability_quasi_permanent", "serviceability_frequent", "serviceability_characteristic"}, selected="ultimate_ordinary")
list_6 = ValueList({"ultimate_ordinary", "ultimate_accidental", "ultimate_seismic", "serviceability_quasi_permanent", "serviceability_frequent", "serviceability_characteristic"}, selected="ultimate_ordinary")
panel_3 = Panel("""1.35
1.50""")
panel_4 = Panel("""1.0
1.0""")
construct_3 = LoadCombinationConstruct(Name="ULS1", Type=list_5, LoadCase=loadcases, Gamma=panel_4)
construct_4 = LoadCombinationConstruct(Name="ULS2", Type=list_6, LoadCase=loadcases, Gamma=panel_3)
merge = Merge(Data1=construct_3, Data2=construct_4)  # -> flatten(Result)

Z = UnitZ(Factor="-300")
pointload_define = PointLoadDefine(Point=end.End, Force=Z, LoadCase=construct_2, Type="Force")
loads = Data(pointload_define)

loadcombinations = Data(merge)
loadcases_2 = Data(loadcases)
elements = Data([supports, column])
loads_2 = Data(loads)
model_construct = ModelConstruct(
    CountryCode="S",
    StructureElements=flatten(elements),
    Loads=loads_2,
    LoadCases=loadcases_2,
    LoadCombinations=loadcombinations)
fem_design_connection = FEMDesignConnection(Verbosity="ScriptLogLinesOnly", DeleteOutputFolder=False)
load_combination = Data(merge)
openmodel = FEMDesignOpenModel(Connection=fem_design_connection, Model=model_construct, RunNode=True)  # -> Connection, Model, Success
panel_5 = Panel("""4
4""")
stability = StabilityDefine(LoadCombination=load_combination, NumShapes=panel_5, PositiveOnly=False, NumIterations=20)
analysis_define = AnalysisDefine(
    Stability=stability,
    CalcCase=True,
    CalcComb=True,
    CalcCstage=False,
    CalcImpf=False,
    CalcGmax=False,
    CalcStab=Toggle(True),
    CalcFreq=False,
    CalcSeis=False,
    CalcDesign=False,
    CalcFootfall=False,
    Elemfine=True,
    Diaphragm=0,
    PeakSmoothing=False)
runanalysis = FEMDesignRunAnalysis(Connection=openmodel.Connection, Analysis=analysis_define, RunNode=True)  # -> Connection, Log, Success
list_7 = ValueList({"OnlyNodes", "ByStep", "ResultPoints"}, selected="OnlyNodes")
list_8 = ValueList({"Center", "Vertices", "ResultPoints"}, selected="Center")
option = ResultOption(Bar=list_7, Surface=list_8, Step=0.5)
merge_2 = Merge(Data1=Slider(3, range=0..10), Data2=Slider(2, range=0..10))
panel_6 = Panel("""ULS1
ULS2""")

# ---- group: FEM-Design.GetStabilityResults
stabilityresults = FEMDesignGetStabilityResults(Connection=runanalysis.Connection, CombinationName=panel_6, ShapeId=merge_2, Options=option, RunNode=True)  # -> Connection, BucklingShapes, CriticalParameter, Success

# ----
bang = ExplodeTree(Data=stabilityresults.BucklingShapes)  # -> Branch0, Branch1, Branch2, Branch3
bang_2 = ExplodeTree(Data=stabilityresults.CriticalParameter)  # -> Branch0, Branch1
panel_7 = Panel(bang.Branch1)
panel_8 = Panel(bang.Branch2)
panel_9 = Panel(bang_2.Branch0)
panel_10 = Panel(bang_2.Branch1)
panel_11 = Panel(bang.Branch0)
panel_12 = Panel(bang.Branch3)
