# Grasshopper definition Example 2 - Analysing a model.gh (Grasshopper 1.0.7)
# plug-ins: FEM-Design

# ----
# 1. Constructing the model
# The model for this example is a continous beam with three supports
# (two roll supports, one hinged support) and two line loads applied
# over one and both bays respectively.
# 1.1. Beam element
countrycode_d_dk_est_fin_gb_h_n_pl_ro_s = Panel("S")  # "Countrycode (D/DK/EST/FIN/GB/H/N/PL/RO/S/TR)"
identifier = Panel("Analyse_example_beam")
beam_center_line = Curve(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)

default = SectionDatabaseDefault()  # -> SteelSection, ConcreteSection, TimberSection, HollowCoreSection, CustomSection
default_2 = MaterialDatabaseDefault(CountryCode=countrycode_d_dk_est_fin_gb_h_n_pl_ro_s)  # -> SteelMaterial, ConcreteMaterial, TimberMaterial, ReinforcementMaterial, StratumMaterial, CustomMaterial
getsectionbyname_index = SectionGetSectionByNameIndex(Sections=default.ConcreteSection, SectionNameIndex="Concrete sections, Rectangle, 400x500")
getmaterialbyname_index = MaterialGetMaterialByNameIndex(Materials=default_2.ConcreteMaterial, MaterialNameIndex="C20/25")
beam = BarsBeam(
    Curve=beam_center_line,
    Material=getmaterialbyname_index,
    Section=getsectionbyname_index,
    OrientLCS=True,
    Identifier=identifier)

# ----
# 1.3. Load cases
panel = Panel("Deadload")
list = ValueList({"ordinary", "dead_load", "soil_dead_load", "shrinkage", "prestressing", "fire", "seis_sxp", "seis_sxm", "seis_syp", "seis_sym"}, selected="dead_load")
list_2 = ValueList({"ordinary", "dead_load", "soil_dead_load", "shrinkage", "prestressing", "fire", "seis_sxp", "seis_sxm", "seis_syp", "seis_sym"}, selected="ordinary")
list_3 = ValueList({"permanent", "long-term", "medium-term", "short-term", "instantaneous"}, selected="permanent")
list_4 = ValueList({"permanent", "long-term", "medium-term", "short-term", "instantaneous"}, selected="permanent")
construct = LoadCaseConstruct(Name=panel, Type=list, DurationClass=list_3)
construct_2 = LoadCaseConstruct(Name="Liveload", Type=list_2, DurationClass=list_4)
merge = Merge(Data1=construct, Data2=construct_2)

# ----
# Example 2: Analysing a model
# This example will show you how to automatically run an analysis
# in FEM-Design from within the Grasshopper script. Before running,
# make sure you have a window with FEM-Design open.
info = Info(versionWhenCreated="22.2.0")

# ----
# 1.2. Supports
beam_center_line_2 = Curve(beam_center_line)
curve_middle = CurveMiddle(Curve=beam_center_line_2)
end_points = EndPoints(Curve=beam_center_line_2)  # -> Start, End
rotations_define = RotationsDefine(X_neg="10^7", X_pos="10^7", Y_neg="0", Y_pos="0", Z_neg="0", Z_pos="0")
rotations_define_2 = RotationsDefine(X_neg="10^7", X_pos="10^7", Y_neg="0", Y_pos="0", Z_neg="0", Z_pos="0")
rotations_define_3 = RotationsDefine(X_neg="10^7", X_pos="10^7", Y_neg="0", Y_pos="0", Z_neg="0", Z_pos="0")
motions_define = MotionsDefine(X_neg="0", X_pos="0", Y_neg="0", Y_pos="0", Z_neg="10^7", Z_pos="10^7")
motions_define_2 = MotionsDefine(X_neg="0", X_pos="0", Y_neg="0", Y_pos="0", Z_neg="10^7", Z_pos="10^7")
start_point = Point(end_points.Start)
middle_point = Point(curve_middle)
motions_rigidpoint = MotionsRigidPoint()
end_point = Point(end_points.End)
pointsupport_define = PointSupportDefine(Point=start_point, Motions=motions_define, Rotations=rotations_define, Identifier="S")
pointsupport_define_2 = PointSupportDefine(Point=middle_point, Motions=motions_rigidpoint, Rotations=rotations_define_2, Identifier="S")
pointsupport_define_3 = PointSupportDefine(Point=end_point, Motions=motions_define_2, Rotations=rotations_define_3, Identifier="S")
merge_2 = Merge(Data1=pointsupport_define, Data2=pointsupport_define_2, Data3=pointsupport_define_3)

# ----
# 1.4. Loads
load_case_deadload = Data(construct)
beam_center_line_3 = Curve(beam_center_line)
load_case_liveload = Data(construct_2)
point_on_curve = PointOnCurve(beam_center_line_3, parameter=0)
point_on_curve_2 = PointOnCurve(beam_center_line_3, parameter=1)
point_on_curve_3 = PointOnCurve(beam_center_line_3, parameter=0)
point_on_curve_4 = PointOnCurve(beam_center_line_3, parameter=0.5)
unit_z = UnitZ(Factor=expr("-x", Slider(10, range=0..20)))
unit_z_2 = UnitZ(Factor=expr("-x", Slider(20, range=0..20)))
line = Line(StartPoint=point_on_curve, EndPoint=point_on_curve_2)
line_2 = Line(StartPoint=point_on_curve_3, EndPoint=point_on_curve_4)
force = LineLoadForce(Curve=line, StartForce=unit_z, LoadCase=load_case_deadload, ConstLoadDir=True, LoadProjection=False)
force_2 = LineLoadForce(Curve=line_2, StartForce=unit_z_2, LoadCase=load_case_liveload, ConstLoadDir=True, LoadProjection=False)
merge_3 = Merge(Data1=force, Data2=force_2)

# ----
# 1.5. Load combinations
list_5 = ValueList({"ultimate_ordinary", "ultimate_accidental", "ultimate_seismic", "serviceability_quasi_permanent", "serviceability_frequent", "serviceability_characteristic"}, selected="serviceability_characteristic")
list_6 = ValueList({"ultimate_ordinary", "ultimate_accidental", "ultimate_seismic", "serviceability_quasi_permanent", "serviceability_frequent", "serviceability_characteristic"}, selected="ultimate_ordinary")
panel_2 = Panel("""1.0
1.0""")
panel_3 = Panel("""1.35
1.5""")
construct_3 = LoadCombinationConstruct(Name="SLS", Type=list_5, LoadCase=merge, Gamma=panel_2)
construct_4 = LoadCombinationConstruct(Name="ULS", Type=list_6, LoadCase=merge, Gamma=panel_3)
merge_4 = Merge(Data1=construct_3, Data2=construct_4)

# ----
# 2. Creating the model
# Loads, Load cases and Load combinations all have their own
# input, while the Beam and the Supports both count as elements.
# Remember to use the same country code as before!
countrycode_d_dk_est_fin_gb_h_n_pl_ro_s_2 = Panel("S")  # "Countrycode (D/DK/EST/FIN/GB/H/N/PL/RO/S/TR)"
elements = Data(flatten([merge_2, beam]))
loads = Data(flatten(merge_3))
loadcases = Data(flatten(merge))
loadcombinations = Data(flatten(merge_4))
construct_5 = ModelConstruct(
    CountryCode=countrycode_d_dk_est_fin_gb_h_n_pl_ro_s_2,
    StructureElements=elements,
    Loads=loads,
    LoadCases=loadcases,
    LoadCombinations=loadcombinations)
model = Data(construct_5)

# ----
# 3. Create a directory for your file
# You can either choose to save your file in your current directory,
# or select your own separate folder. If you'd choose the latter,
# simply rightclick the directory component and choose "select a
# directory". Finally, edit the file name panel to give your file a name.
# Remember to end it with .struxml .
use_file_path_from = ValueList({"current directory": 0, "user defined folder": 1}, selected="current directory")
current_directory = GhPythonScript()  # -> folder
# ---------- current_directory: Python ----------
import rhinoscriptsyntax as rs

folder = rs.DocumentPath()
# ---------- end current_directory ----------
user_defined_folder = FilePath("C:\Users\SamuelNyberg\OneDrive - StruSoft AB\Samuels arbetshörna\2. API-exempel\")
file_name_end_with_struxml = Panel("Example 2 - Beam to analyse.struxml")
stream_filter = StreamFilter(Gate=use_file_path_from, Stream0=current_directory, Stream1=user_defined_folder)
concatenate = Concatenate(FragmentA=stream_filter, FragmentB=file_name_end_with_struxml)

# ----
# 4. Analysis settings
# Select the analyses you want to run using
# a simple "true" statement. These settings
# are the same as the ones you'd see if you
# ran the analysis in the FEM-Design interface.
panel_4 = Panel("true")
analysis_define = AnalysisDefine(
    CalcCase=panel_4,
    CalcCstage=False,
    CalcImpf=False,
    CalcComb=panel_4,
    CalcGmax=False,
    CalcStab=False,
    CalcFreq=False,
    CalcSeis=False,
    CalcDesign=False,
    CalcFootfall=False,
    Elemfine=False,
    Diaphragm=False,
    PeakSmoothing=False)

resulting_file_path = Panel(concatenate)

# ----
# 5. Run the analysis
# Before you run the analysis, remember to give a proper file path. Rightclick
# the directory component and choose "select a directory", then edit the file name
# panel to give your file a name. Remember to end it with .struxml !
press_to_open_model_in_fem_design_and_ru = Button()  # "Press to open model in FEM-Design and run analysis:"
close_all_open_fem_design_windows_when_r = BooleanToggle(True)  # "Close all open FEM-Design windows when running?"
close_fem_design_window_after_analysis_i = BooleanToggle(False)  # "Close FEM-Design window after analysis is done?"
analysis_settings = Data(analysis_define)
filepath = Data(concatenate)
model_2 = Data(model)
runanalysis = ApplicationRunAnalysis(
    Model=model_2,
    FilePathStruxml=filepath,
    Analysis=analysis_settings,
    EndSession=close_fem_design_window_after_analysis_i,
    CloseOpenWindows=close_all_open_fem_design_windows_when_r,
    RunNode=press_to_open_model_in_fem_design_and_ru)  # -> Model, FiniteElement, Results, HasExited
