# Grasshopper definition Example 2a - Analysing a model.gh (Grasshopper 1.0.7)
# plug-ins: FEM-Design

struxml_or_str_file = FilePath()

# ----
# Example 2: Analysing a model
# This example will show you how to automatically run an analysis
# in FEM-Design from within the Grasshopper script. Before running,
# make sure you have a window with FEM-Design open.
info = Info(versionWhenCreated="22.2.0")

# ----
# 3. Open FEM-Design connection
# The connection establish a live link comunication with the main software.
# A FEM-Design instance will open for every connection that you create
fem_design_connection = FEMDesignConnection(Verbosity="ScriptLogLinesOnly", DeleteOutputFolder=False)
openmodel = FEMDesignOpenModel(Connection=fem_design_connection, Model=struxml_or_str_file, RunNode=True)  # -> Connection, Model, Success

# ----
# 4. Analysis settings
# Select the analyses you want to run using
# a simple "true" statement. These settings
# are the same as the ones you'd see if you
# ran the analysis in the FEM-Design interface.
comb_define = CombDefine(
    NLEmaxiter=30,
    PLdefloadstep=20,
    PLminloadstep=2,
    Plmaxeqiter=30,
    NLSMohr=True,
    NLSinitloadstep=10,
    NLSminloadstep=10,
    NLSactiveelemratio=5,
    NLSplasticelemratio=5,
    CRloadstep=20,
    CRmaxiter=30,
    CRstifferror=2)
toggle = BooleanToggle(True)
analysis_define = AnalysisDefine(
    Comb=comb_define,
    CalcCase=toggle,
    CalcComb=toggle,
    CalcCstage=False,
    CalcImpf=False,
    CalcGmax=False,
    CalcStab=False,
    CalcFreq=False,
    CalcSeis=False,
    CalcDesign=False,
    CalcFootfall=False,
    Elemfine=True,
    Diaphragm=False,
    PeakSmoothing=False)

# ----
# 5. Run the analysis
runanalysis = FEMDesignRunAnalysis(Connection=openmodel.Connection, Analysis=analysis_define, RunNode=True)  # -> Connection, Log, Success
