# Grasshopper definition Example 2b - Designing a model.gh (Grasshopper 1.0.7)
# plug-ins: FEM-Design, Kangaroo2 Components

curve = Curve([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])
curve_2 = Curve([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])
curve_3 = Curve([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])
curve_4 = Curve([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])
curve_5 = Curve(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)
curve_6 = Curve(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)

# ----
# Example 2: Designing a model
# This example will show you how to automatically run design
# calculations in FEM-Design from within the Grasshopper script.
info = Info(versionWhenCreated="23.2.0")

join_curves = JoinCurves(Curves=curve, Preserve=False)
end_points = EndPoints(Curve=[curve_5, curve_6])  # -> Start, End
explode = Explode(Curve=join_curves, Recursive=True)  # -> Segments, Vertices
materialdatabase = MaterialDatabase(CountryCode="S")  # -> SteelMaterial, ConcreteMaterial, TimberMaterial, ReinforcementMaterial, StratumMaterial, CustomMaterial
sectiondatabase = SectionDatabase()  # -> SteelSection, ConcreteSection, TimberSection, HollowCoreSection, CustomSection
removeduplicatepts = RemoveDuplicatePts(Points=explode.Vertices, Tolerance=0.01)
value_list = ValueList({"ordinary", "dead_load", "soil_dead_load", "shrinkage", "prestressing", "fire", "seis_sxp", "seis_sxm", "seis_syp", "seis_sym"}, selected="ordinary")
value_list_2 = ValueList({"permanent", "long-term", "medium-term", "short-term", "instantaneous"}, selected="permanent")
value_list_3 = ValueList({"ordinary", "dead_load", "soil_dead_load", "shrinkage", "prestressing", "fire", "seis_sxp", "seis_sxm", "seis_syp", "seis_sym"}, selected="dead_load")
value_list_4 = ValueList({"permanent", "long-term", "medium-term", "short-term", "instantaneous"}, selected="permanent")
removeduplicatepts_2 = RemoveDuplicatePts(Points=[end_points.Start, end_points.End], Tolerance=0.01)
boolean_toggle = BooleanToggle(True)
unit_z = UnitZ(Factor="-50")
loadcase_construct = LoadCaseConstruct(Name="LL", Type=value_list, DurationClass=value_list_2)
list_item = ListItem(List=sectiondatabase.SteelSection, Index=0, Wrap=True)
loadcase_construct_2 = LoadCaseConstruct(Name="DL", Type=value_list_3, DurationClass=value_list_4)
list_item_2 = ListItem(List=materialdatabase.SteelMaterial, Index=0, Wrap=True)
pointsupport_simple = PointSupportSimple(
    Position=removeduplicatepts_2,
    Tx=True,
    Ty=True,
    Tz=True,
    Rx=boolean_toggle,
    Ry=boolean_toggle,
    Rz=boolean_toggle,
    Identifier="S")
value_list_5 = ValueList({"ultimate_ordinary", "ultimate_accidental", "ultimate_seismic", "serviceability_quasi_permanent", "serviceability_frequent", "serviceability_characteristic"}, selected="ultimate_ordinary")
merge = Merge(Data1=loadcase_construct_2, Data2=loadcase_construct)
panel = Panel("""1.35
1.5""")
bars_beam = BarsBeam(Curve=curve, Material=list_item_2, Section=list_item, OrientLCS=True, Identifier="B")
bars_beam_2 = BarsBeam(Curve=curve_2, Material=list_item_2, Section=list_item, OrientLCS=True, Identifier="B")
bars_beam_3 = BarsBeam(Curve=curve_3, Material=list_item_2, Section=list_item, OrientLCS=True, Identifier="B")
bars_beam_4 = BarsBeam(Curve=curve_4, Material=list_item_2, Section=list_item, OrientLCS=True, Identifier="B")
pointload_define = PointLoadDefine(Point=removeduplicatepts, Force=unit_z, LoadCase=loadcase_construct, Type="Force")
loadcombination_construct = LoadCombinationConstruct(Name="ULS_DL", Type=value_list_5, LoadCase=merge, Gamma=panel)  # -> flatten(LoadCombination)
model_construct = ModelConstruct(
    CountryCode="S",
    StructureElements=[bars_beam, bars_beam_2, bars_beam_3, bars_beam_4, pointsupport_simple],
    Loads=pointload_define,
    LoadCases=merge,
    LoadCombinations=loadcombination_construct)

fem_design_connection = FEMDesignConnection(Verbosity="ScriptLogLinesOnly", DeleteOutputFolder=False)
fem_design_openmodel = FEMDesignOpenModel(Connection=fem_design_connection, Model=model_construct, RunNode=True)  # -> Connection, Model, Success

partition_list = PartitionList(List=bars_beam_3, Size="2")
entwine = Entwine(Branch0X=bars_beam, Branch1X=bars_beam_2, Branch2X=partition_list, Branch3X=bars_beam_4, FlattenInputs=False)  # -> simplify(Result)
data = Data(entwine)
tree_statistics = TreeStatistics(Tree=data)  # -> Paths, Length, Count
panel_3 = Panel("""a
b
c
d
e
f
g
h
j
k
l
p
o
i
u
y""")
series = Series(Start=0, Step=1, Count=tree_statistics.Count)
list_item_3 = ListItem(List=panel_3, Index=series, Wrap=True)
graft_tree = GraftTree(Tree=list_item_3, IncludeEmptyLists=True, IncludeNullItems=True)
designgroup = DesignGroup(GroupName=graft_tree, StructuralElements=data)  # -> flatten(DesignGroup)

toggle = BooleanToggle(True)
analysis_define = AnalysisDefine(
    CalcCase=toggle,
    CalcComb=toggle,
    CalcCstage=False,
    CalcImpf=False,
    CalcGmax=False,
    CalcStab=False,
    CalcFreq=False,
    CalcSeis=False,
    CalcDesign=False,
    CalcFootfall=False,
    Elemfine=True,
    Diaphragm=0,
    PeakSmoothing=False)
runanalysis = FEMDesignRunAnalysis(Connection=fem_design_openmodel.Connection, Analysis=analysis_define, RunNode=True)  # -> Connection, Log, Success

design = DesignDefine(Mode="steel", AutoDesign=Toggle(True), Check=True, BasedOn=True, ApplyChanges=Toggle(True))
fem_design_rundesign = FEMDesignRunDesign(Connection=runanalysis.Connection, Design=design, DesignGroup=designgroup, RunNode=True)  # -> Connection, Log, Success

design_2 = DesignDefine(Mode="steel", AutoDesign=Toggle(False), Check=Toggle(True), BasedOn=True, ApplyChanges=False)
resultstype = ResultsType({"NodalDisplacement", "PointSupportReaction", "PointSupportReactionMinMax", "PointConnectionForce", "BarDisplacement", "BarInternalForce", "BarStress", "LineSupportReaction", "LineConnectionResultant", "LineConnectionForce"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}, selected="BarSteelUtilization")
fem_design_rundesign_2 = FEMDesignRunDesign(Connection=fem_design_rundesign.Connection, Design=design_2, RunNode=True)  # -> Connection, Log, Success
fem_design_getcasecombresults = FEMDesignGetCaseCombResults(Connection=fem_design_rundesign_2.Connection, ResultType=resultstype, RunNode=True)  # -> Connection, Results, Success

resultstype_2 = ResultsType({"NodalDisplacement", "PointSupportReaction", "PointSupportReactionMinMax", "PointConnectionForce", "BarDisplacement", "BarInternalForce", "BarStress", "LineSupportReaction", "LineConnectionResultant", "LineConnectionForce"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}, selected="QuantityEstimationSteel")
fem_design_getquantities = FEMDesignGetQuantities(Connection=fem_design_rundesign.Connection, QuantityType=resultstype_2, RunNode=True)  # -> Connection, Quantities, Success
steelquantityestimation = SteelQuantityEstimation(Result=fem_design_getquantities.Quantities)  # -> Storey, Structure, Id, Quality, Section, UnitWeight, Subtotal, TotalWeight, PaintedArea, CO2Footprint
panel_4 = Panel(steelquantityestimation.TotalWeight)

panel_5 = Panel(fem_design_getcasecombresults.Results)
