# Grasshopper definition Example 3 - Setup for advanced calculations.gh (Grasshopper 1.0.7)
# plug-ins: FEM-Design

side_wall_base_1 = Curve(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)
side_wall_base_2 = Curve(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)
back_wall_base = Curve(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)
# Base geometry
pillar_base_2 = Point(Point(7, 0, 0))
pillar_base_3 = Point(Point(14, 0, 0))

side_wall_1 = Surface(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)

side_wall_2 = Surface(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)
back_wall = Surface(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)
pillar_1 = Curve(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)
pillar_2 = Curve(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)
roof = Surface(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)

# ----
# 1. Constructing the model
# The elements, supports, loads and load cases are all constructed as usual.
# For this example, we constructed a simple structure with walls on the short
# sides and on one long side, and supporting pillars on the opposite side.
merge = Merge(Data1=pillar_base_2, Data2=pillar_base_3)
merge_2 = Merge(Data1=side_wall_base_1, Data2=side_wall_base_2)

# ----
# 1.1. Building elements
merge_3 = Merge(Data1=pillar_1, Data2=pillar_2)
countrycode_d_dk_est_fin_gb_h_n_pl_ro_s = Panel("S")  # "Countrycode (D/DK/EST/FIN/GB/H/N/PL/RO/S/TR)"
default = MaterialDatabaseDefault(CountryCode=countrycode_d_dk_est_fin_gb_h_n_pl_ro_s)  # -> SteelMaterial, ConcreteMaterial, TimberMaterial, ReinforcementMaterial, StratumMaterial, CustomMaterial
default_2 = SectionDatabaseDefault()  # -> SteelSection, ConcreteSection, TimberSection, HollowCoreSection, CustomSection
merge_4 = Merge(Data1=side_wall_1, Data2=side_wall_2)
getmaterialbyname_index = MaterialGetMaterialByNameIndex(Materials=default.ConcreteMaterial, MaterialNameIndex="C40/50")
getsectionbyname_index = SectionGetSectionByNameIndex(Sections=default_2.ConcreteSection, SectionNameIndex="Concrete sections, Circle, D 300")
unit_z = UnitZ(Factor=1)
unit_y = UnitY(Factor=1)
unit_z_2 = UnitZ(Factor=1)
unit_x = UnitX(Factor=1)
unit_x_2 = UnitX(Factor=1)
unit_z_3 = UnitZ(Factor=1)
unit_y_2 = UnitY(Factor=1)
column = BarsColumn(
    Line=merge_3,
    Material=getmaterialbyname_index,
    Section=getsectionbyname_index,
    LocalY=unit_y_2,
    OrientLCS=True,
    Identifier="C")
construct = Plate(
    Surface=roof,
    Thickness=Slider(0.2, range=0..1),
    Material=getmaterialbyname_index,
    LocalX=unit_x_2,
    LocalZ=unit_z_3,
    Identifier="Roof")
construct_2 = Plate(
    Surface=back_wall,
    Thickness=Slider(0.2, range=0..1),
    Material=getmaterialbyname_index,
    LocalX=unit_x,
    LocalZ=unit_z_2,
    Identifier="Back wall")
construct_3 = Plate(
    Surface=merge_4,
    Thickness=Slider(0.2, range=0..1),
    Material=getmaterialbyname_index,
    LocalX=unit_y,
    LocalZ=unit_z,
    Identifier="Side wall")

# ----
# 1.3. Load cases
panel = Panel("Liveload")
list = ValueList({"ordinary", "dead_load", "soil_dead_load", "shrinkage", "prestressing", "fire", "seis_sxp", "seis_sxm", "seis_syp", "seis_sym"}, selected="dead_load")
list_2 = ValueList({"ordinary", "dead_load", "soil_dead_load", "shrinkage", "prestressing", "fire", "seis_sxp", "seis_sxm", "seis_syp", "seis_sym"}, selected="ordinary")
list_3 = ValueList({"permanent", "long-term", "medium-term", "short-term", "instantaneous"}, selected="permanent")
list_4 = ValueList({"permanent", "long-term", "medium-term", "short-term", "instantaneous"}, selected="permanent")
construct_4 = LoadCaseConstruct(Name="Deadload", Type=list, DurationClass=list_3)
construct_5 = LoadCaseConstruct(Name=panel, Type=list_2, DurationClass=list_4)
merge_5 = Merge(Data1=construct_4, Data2=construct_5)

# ----
# Example 3: Setup for advanced calculations
# This example will showcase how you can access some more advanced
# analysis settings, such as specific calculation models for load combinations,
# and eigenfrequency calculations for load cases.
info = Info(versionWhenCreated="22.2.0")

# ----
# 1.2. Supports
unit_x_3 = UnitX(Factor=1)
unit_y_3 = UnitY(Factor=1)
linesupport_hinged = LineSupportHinged(Curve=back_wall_base, MovingLocal=False, LocalY=unit_y_3, OrientLCS=True, Identifier="S")
linesupport_hinged_2 = LineSupportHinged(Curve=merge_2, MovingLocal=False, LocalY=unit_x_3, OrientLCS=True, Identifier="S")
pointsupport_hinged = PointSupportHinged(Point=merge, Identifier="S")
merge_6 = Merge(Data1=pointsupport_hinged, Data2=linesupport_hinged, Data3=linesupport_hinged_2)

merge_7 = Merge(Data1=column, Data2=construct, Data3=construct_2, Data4=construct_3)

# ----
# 3. Settings for the load combinations
# Using the LoadCombination.SetupCalculation component, you gain access to
# more specialised settings to prepare for the analysis later on. In this example
# we will calculate stability for ULS, so we'll set the requirements to active.
# 1.5. Load combinations
list_5 = ValueList({"ultimate_ordinary", "ultimate_accidental", "ultimate_seismic", "serviceability_quasi_permanent", "serviceability_frequent", "serviceability_characteristic"}, selected="serviceability_characteristic")
list_6 = ValueList({"ultimate_ordinary", "ultimate_accidental", "ultimate_seismic", "serviceability_quasi_permanent", "serviceability_frequent", "serviceability_characteristic"}, selected="ultimate_ordinary")
panel_2 = Panel("""1.0
1.0""")
panel_3 = Panel("""1.35
1.5""")
construct_6 = LoadCombinationConstruct(Name="SLS", Type=list_5, LoadCase=merge_5, Gamma=panel_2)
construct_7 = LoadCombinationConstruct(Name="ULS", Type=list_6, LoadCase=merge_5, Gamma=panel_3)

# ----
# 1.4. Loads
number_slider = Slider(2.5, range=0..20)
unit_z_4 = UnitZ(Factor=expr("-x", Slider(0.7, range=0..20)))
unit_z_5 = UnitZ(Factor=expr("-x", number_slider))
load_case_deadload = Data(construct_4)
load_case_liveload = Data(construct_5)
roof_2 = Surface(roof)
roof_3 = Surface(roof)
uniform = SurfaceLoadUniform(Surface=roof_3, Force=unit_z_5, LoadCase=load_case_liveload)
uniform_2 = SurfaceLoadUniform(Surface=roof_2, Force=unit_z_4, LoadCase=load_case_deadload)

# ----
# 2. Mass conversion
# For the eigenfrequencies to be calculated, we have
# to define the mass conversion for a load case. This
# is applied using the MassConversionTable.Define
# component, and then added to the model as a load.
panel_4 = Panel("1")
massconversiontable_define = MassConversionTableDefine(LoadCase=construct_5, Factor=panel_4)

# ----
# 3.2. Advanced settings
panel_5 = Panel("true")
setupcalculation = LoadCombinationSetupCalculation(
    LoadCombination=construct_7,
    ImpfRqd=0,
    StabRqd=panel_5,
    NLE=False,
    PL=False,
    NLS=False,
    Cr=False,
    F2nd=False,
    Im=0,
    Amplitude=0,
    Waterlevel=0)
merge_8 = Merge(Data1=construct_6, Data2=setupcalculation)

merge_9 = Merge(Data1=uniform, Data2=uniform_2, Data3=massconversiontable_define)

# ----
# 4. Creating the model
# Loads, Load cases and Load combinations all have their own
# input, while the Beam and the Supports both count as elements.
# Remember to use the same country code as before!
elements = Data(flatten([merge_6, merge_7]))
loads = Data(flatten(merge_9))
loadcases = Data(flatten(merge_5))
loadcombinations = Data(flatten(merge_8))
countrycode_d_dk_est_fin_gb_h_n_pl_ro_s_2 = Panel("S")  # "Countrycode (D/DK/EST/FIN/GB/H/N/PL/RO/S/TR)"
construct_8 = ModelConstruct(
    CountryCode=countrycode_d_dk_est_fin_gb_h_n_pl_ro_s_2,
    StructureElements=elements,
    Loads=loads,
    LoadCases=loadcases,
    LoadCombinations=loadcombinations)
model = Data(construct_8)

# ----
# 5. Create a directory for your file
# You can either choose to save your file in your current directory,
# or select your own separate folder. If you'd choose the latter,
# simply rightclick the directory component and choose "select a
# directory". Finally, edit the file name panel to give your file a name.
# Remember to end it with .struxml .
use_file_path_from = ValueList({"current directory": 0, "user defined folder": 1}, selected="current directory")
current_directory = GhPythonScript()  # -> folder
# ---------- current_directory: Python ----------
import rhinoscriptsyntax as rs

folder = rs.DocumentPath()
# ---------- end current_directory ----------
user_defined_folder = FilePath("C:\Users\SamuelNyberg\OneDrive - StruSoft AB\Samuels arbetshörna\2. API-exempel\")
file_name_end_with_struxml = Panel("Example 3 - Advanced calculation model.struxml")
stream_filter = StreamFilter(Gate=use_file_path_from, Stream0=current_directory, Stream1=user_defined_folder)
concatenate = Concatenate(FragmentA=stream_filter, FragmentB=file_name_end_with_struxml)

# ----
# 6. Analysis settings
# For this example, we'll select the basic Load Case and Load Combination calculcations,
# as well as Stability and Eigenfrequency calculations. The Freq.Define component allows
# the user to define certain settings for the Eigenfrequency calculation.
number_slider_2 = Slider(5, range=0..10)
freq_define = FreqDefine(NumShapes=number_slider_2, MaxSturm=0, X="false", Y="false", Z="true", Top=-0.01)
analysis_define = AnalysisDefine(
    Freq=freq_define,
    CalcCase="true",
    CalcCstage=False,
    CalcImpf=False,
    CalcComb="true",
    CalcGmax=False,
    CalcStab="true",
    CalcFreq="true",
    CalcSeis=False,
    CalcDesign=False,
    CalcFootfall=False,
    Elemfine=False,
    Diaphragm=False,
    PeakSmoothing=False)

resulting_file_path = Panel(concatenate)

# ----
# 6. Run the analysis
press_to_open_model_in_fem_design_and_ru = Button()  # "Press to open model in FEM-Design and run analysis:"
close_all_open_fem_design_windows_when_r = BooleanToggle(True)  # "Close all open FEM-Design windows when running?"
close_fem_design_window_after_analysis_i = BooleanToggle(False)  # "Close FEM-Design window after analysis is done?"
analysis_settings = Data(analysis_define)
file_path = Data(concatenate)
model_2 = Data(model)
runanalysis = ApplicationRunAnalysis(
    Model=model_2,
    FilePathStruxml=file_path,
    Analysis=analysis_settings,
    EndSession=close_fem_design_window_after_analysis_i,
    CloseOpenWindows=close_all_open_fem_design_windows_when_r,
    RunNode=press_to_open_model_in_fem_design_and_ru)  # -> Model, FiniteElement, Results, HasExited
