# Grasshopper definition Example 7 - Wall with supports, loads, loadcases.gh (Grasshopper 1.0.7)
# plug-ins: FEM-Design

# ---- group: Geometry
width_m = Slider(4.56, range=3..6)
height_m = Slider(4.37, range=3..6)
xz_plane = XZPlane(Origin=Point(0, 0, 0))
rectangle = Rectangle(Plane=xz_plane, XSize=width_m, YSize=height_m, Radius=0)  # -> Rectangle, Length
boundary_surfaces = BoundarySurfaces(Edges=rectangle.Rectangle)
deconstruct_brep = DeconstructBrep(Brep=boundary_surfaces)  # -> Faces, Edges, Vertices
curve_middle = CurveMiddle(Curve=deconstruct_brep.Edges)
deconstruct = Deconstruct(Point=curve_middle)  # -> XComponent, YComponent, ZComponent
sort_list = SortList(Keys=deconstruct.ZComponent, ValuesValuesA=deconstruct_brep.Edges)  # -> Keys, ValuesValuesA
edges = Curve(sort_list.ValuesValuesA)

# ----
# 1. Creating the Geometry
# The first part of the script is focus on the Geometry generation. You can vary
# the width and the height of the Wall.
# 
# Surface and Edges have been extracted and used as input later.
surface = Surface(boundary_surfaces)

# ----
# Example 7: Modelling a Wall
# This example show how you can create a simple parametric model of a Wall.
# The main idea is being able to customize the Load and Boundary Condition
# with simple inputs, and having the resulting model built automatically.
info = Info(versionWhenCreated="22.2.0")

# ---- group: load case
list = ValueList({"ordinary", "dead_load", "soil_dead_load", "shrinkage", "prestressing", "fire", "seis_sxp", "seis_sxm", "seis_syp", "seis_sym"}, selected="dead_load")
list_2 = ValueList({"ordinary", "dead_load", "soil_dead_load", "shrinkage", "prestressing", "fire", "seis_sxp", "seis_sxm", "seis_syp", "seis_sym"}, selected="ordinary")
list_3 = ValueList({"ordinary", "dead_load", "soil_dead_load", "shrinkage", "prestressing", "fire", "seis_sxp", "seis_sxm", "seis_syp", "seis_sym"}, selected="ordinary")
construct = LoadCaseConstruct(Name="Vertical Load", Type=list, DurationClass="permanent")
construct_2 = LoadCaseConstruct(Name="Horizontal Load", Type=list_2, DurationClass="permanent")
construct_3 = LoadCaseConstruct(Name="Wind Load", Type=list_3, DurationClass="permanent")
merge = Merge(Data1=construct, Data2=construct_2, Data3=construct_3)

# ---- group: element
# 4. Creating loads
# The loads in this example are simple surface loads, but applying more
# complicated loads and load combinations is also possible.
# All loads are applied to the top flange.
panel = Panel("S")
# 3. Constructing the Wall FEA element
# Before sending the elements off to the final model, you can add a component to define the size
# of the mesh in FEM-design.
surface_2 = Surface(surface)
default = MaterialDatabaseDefault(CountryCode=panel)  # -> SteelMaterial, ConcreteMaterial, TimberMaterial, ReinforcementMaterial, StratumMaterial, CustomMaterial
getmaterialbyname_index = MaterialGetMaterialByNameIndex(Materials=default.ConcreteMaterial, MaterialNameIndex="C30/37")
thickness_m = Panel("0.30")
construct_4 = Wall(Surface=surface_2, Thickness=thickness_m, Material=getmaterialbyname_index, Identifier="P")

# ----
# 2. Creating Supports
# This example showcases a possible approach to create some rigid supports along a line.
# The supports are properly connected to the mesh when the FEM-Design model is generated.
curve = Curve(edges)

# ---- group: line support
list_item = ListItem(List=curve, Index="0", Wrap=True)
curve_2 = Curve(list_item)
end_points = EndPoints(Curve=curve_2)  # -> Start, End
line = Line(StartPoint=end_points.Start, EndPoint=end_points.End)
linesupport_hinged = LineSupportHinged(Curve=line, MovingLocal=False, OrientLCS=True, Identifier="S")

# ---- group: point support
list_item_2 = ListItem(List=curve, Index="3", Wrap=True)
curve_3 = Curve(list_item_2)
end_points_2 = EndPoints(Curve=curve_3)  # -> Start, End
pointsupport_hinged = PointSupportHinged(Point=[end_points_2.Start, end_points_2.End], Identifier="S")

# ---- group: line load
curve_4 = Curve(edges)
list_item_3 = ListItem(List=curve_4, Index="3", Wrap=True)
curve_5 = Curve(list_item_3)
end_points_3 = EndPoints(Curve=curve_5)  # -> Start, End
panel_2 = Panel("-10.00")
unit_z = UnitZ(Factor=panel_2)
line_2 = Line(StartPoint=end_points_3.Start, EndPoint=end_points_3.End)
force = LineLoadForce(Curve=line_2, StartForce=unit_z, LoadCase=construct, ConstLoadDir=True, LoadProjection=False)

# ---- group: point load
point = Point(deconstruct_brep.Vertices)
list_item_4 = ListItem(List=point, Index="2", Wrap=True)
kn = Panel("-5.00")
unit_x = UnitX(Factor=kn)
pointload_force = PointLoadForce(Point=list_item_4, Force=unit_x, LoadCase=construct_2)

# ---- group: surface load
surface_3 = Surface(surface)
panel_3 = Panel("2.00")  # "kN/m2"
unit_y = UnitY(Factor=panel_3)
uniform = SurfaceLoadUniform(Surface=surface_3, Force=unit_y, LoadCase=construct_3)

# ---- group: load combination
panel_4 = Panel("""1.35
1.50
1.50""")
panel_5 = Panel("""1.00
1.00
1.00""")
list_4 = ValueList({"ultimate_ordinary", "ultimate_accidental", "ultimate_seismic", "serviceability_quasi_permanent", "serviceability_frequent", "serviceability_characteristic"}, selected="serviceability_characteristic")
list_5 = ValueList({"ultimate_ordinary", "ultimate_accidental", "ultimate_seismic", "serviceability_quasi_permanent", "serviceability_frequent", "serviceability_characteristic"}, selected="serviceability_characteristic")
construct_5 = LoadCombinationConstruct(Name="ULS", Type=list_4, LoadCase=merge, Gamma=panel_4)
construct_6 = LoadCombinationConstruct(Name="SLS", Type=list_5, LoadCase=merge, Gamma=panel_5)
merge_2 = Merge(Data1=construct_6, Data2=construct_5)

# ---- group: element
fem_design_mesh_size = Panel("0.50")
slab_averagesurfaceelementsize = SlabAverageSurfaceElementSize(Slab=construct_4, AverageSurfaceElementSize=fem_design_mesh_size)

# ----
merge_3 = Merge(Data1=force, Data2=pointload_force, Data3=uniform)

# ---- group: assemble
# 5. Assemble the Model
structure_elements = Data(flatten([linesupport_hinged, slab_averagesurfaceelementsize, pointsupport_hinged]))
load_combination = Data(flatten(merge_2))
load_cases = Data(flatten(merge))
loads = Data(flatten(merge_3))
construct_7 = ModelConstruct(
    CountryCode="S",
    StructureElements=structure_elements,
    Loads=loads,
    LoadCases=load_cases,
    LoadCombinations=load_combination)

# ----
# Create a Directory for your Analyses Model
value_list = ValueList({"current directory": 0, "user define folder": 1}, selected="current directory")
current_directory = GhPythonScript()  # -> folder
# ---------- current_directory: Python ----------
import rhinoscriptsyntax as rs

folder = rs.DocumentPath()
# ---------- end current_directory ----------
file_name_end_with_struxml = Panel("analyse_example_model_7.struxml")
directory = FilePath()
stream_filter = StreamFilter(Gate=value_list, Stream0=current_directory, Stream1=directory)
concatenate = Concatenate(FragmentA=stream_filter, FragmentB=file_name_end_with_struxml)
file_path = Data(concatenate)

# ----
# 6. Analysis settings
# Select the analyses you want to run using
# a simple "true" statement. These settings
# are the same as the ones you'd see if you
# ran the analysis in the FEM-Design interface.
analysis_define = AnalysisDefine(
    CalcCase="True",
    CalcCstage=False,
    CalcImpf=False,
    CalcComb="True",
    CalcGmax=False,
    CalcStab=False,
    CalcFreq=False,
    CalcSeis=False,
    CalcDesign=False,
    CalcFootfall=False,
    Elemfine=False,
    Diaphragm=False,
    PeakSmoothing=False)

# ---- group: Calculation
# 6a. Save the model...
# This script is set up to save your model as soon as it finished running.
# However, it needs a file path to work properly. Rightclick the directory
# component and choose "select a directory", then edit the file name
# panel to give your file a name. Remember to end it with .struxml !
fdmodel = Data(construct_7)
file_path_2 = Data(file_path)
resulting_file_path = Panel(file_path_2)
model_save = ModelSave(FdModel=fdmodel, FilePathStruxml=file_path_2)

# ----
# 6b. ...or open it in FEM-Design
# If you want, you can call FEM-Design from the script,
# to immediately open your new model.
fdmodel_2 = Data(construct_7)
file_path_3 = Data(file_path)
press_to_run_open_model_in_fem_design = Button()
close_all_open_fem_design_windows = BooleanToggle(True)
model_open = ModelOpen(
    FdModel=fdmodel_2,
    FilePathStruxml=file_path_3,
    CloseOpenWindows=close_all_open_fem_design_windows,
    RunNode=press_to_run_open_model_in_fem_design)

# ---- group: calculation
# 6c. Open model and run analysis
# This section will open the model just the same as above, but immediately
# run the analysis with the settings linked in the Analysis settings component.
fdmodel_3 = Data(construct_7)
file_path_4 = Data(file_path)
analysis_settings = Data(analysis_define)
press_to_open_model_in_fem_design_and_ru = Button()  # "Press to open model in FEM-Design and run analysis:"
close_all_open_fem_design_windows_when_r = BooleanToggle(True)  # "Close all open FEM-Design windows when running?"
close_fem_design_window_after_analysis_i = BooleanToggle(False)  # "Close FEM-Design window after analysis is done?"
runanalysis = ApplicationRunAnalysis(
    Model=fdmodel_3,
    FilePathStruxml=file_path_4,
    Analysis=analysis_settings,
    EndSession=close_fem_design_window_after_analysis_i,
    CloseOpenWindows=close_all_open_fem_design_windows_when_r,
    RunNode=press_to_open_model_in_fem_design_and_ru)  # -> Model, FiniteElement, Results, HasExited
