# Grasshopper definition Example 8 - Create cases and combos from table.gh (Grasshopper 1.0.7)
# plug-ins: FEM-Design

# ----
# USER ADVICE:
# 
# •  If you hover over any input or output node with your cursor, you can see what sort of data
#    is expected to go in or out of said node, as well as what the node currently contains. Some
#    nodes are never really empty, but contain a default value instead.
# 
# •  You can also hover over the middle of the component to see what it is called and read a
#    short description of its function.
# 
# • By pressing CTRL+ALT+Left mouse buttons on a component, Grasshopper will show you
#    where the component is located in the menus.
# 
# Use these tips to familiarize yourself with the components in these examples!
# 0. Table data
# Data in tab separated value format similar
# to the format that can be exported from
# FEM-Design. Note that the tabs don't show
# in the Grasshopper panel, but they still
# exist.
# comma separated values (.csv): DeadLoad,Ordinary,Permanent
# LiveLoad,Ordinary,Medium-term
# Accidental,Ordinary,Permanent
# comma separated values (.csv): 6.10a,U,1.35,DeadLoad
# 6.10b,U,1.20,DeadLoad
# 		,,1.50,LiveLoad
# Karakteristisk,Sc,1.00,DeadLoad
# 		,,0.70,LiveLoad
# 		,,0.30,Accidental
# Frekvent,Sf,1.00,DeadLoad
# 		,,0.70,LiveLoad
# Kvasipermanent,Sq,1.00,DeadLoad
# 		,,0.60,LiveLoad
tab_separated_values = Panel("""DeadLoad	Ordinary	Permanent
LiveLoad	Ordinary	Medium-term
Accidental	Ordinary	Permanent""")
tab_separated_values_2 = Panel("""6.10a	U	1.35	DeadLoad
6.10b	U	1.20	DeadLoad
		1.50	LiveLoad
Karakteristisk	Sc	1.00	DeadLoad
		0.70	LiveLoad
		0.30	Accidental
Frekvent	Sf	1.00	DeadLoad
		0.70	LiveLoad
Kvasipermanent	Sq	1.00	DeadLoad
		0.60	LiveLoad""")

# ----
# Splitting text with "tab" as a separator
tab = Panel("\t")
split = TextSplit(Text=tab_separated_values, Separators=tab)
split_2 = TextSplit(Text=tab_separated_values_2, Separators=tab)  # -> simplify(Result)
item = ListItem(List=split, Index=0, Wrap=True)  # -> Item, Item1, Item2
item_2 = ListItem(List=split_2, Index=0, Wrap=True)  # -> Item, Item1, Item2, Item3

comma = Panel(",")

# ----
# Custom C# node to handle data structure
c_script = CSharpScript(combo=item_2.Item, combotype=item_2.Item1, factor=item_2.Item2, loadcase=item_2.Item3)  # -> combo2, combotype2, factor2, loadcase2; inputs combo: tree of String, combotype: tree of String, factor: tree of Double, loadcase: tree of String
# ---------- c_script: C# ----------
    string lc = "0";
    int previousLC = 0;
    double f;
    string lcase;

    List<int> indices = new List<int>();
    for (int i = 0; i < combo.Branches.Count; i++)
    {
      lc = combo.Branch(i)[0];

      if (lc == "")
      {
        f = factor.Branch(i)[0];
        lcase = loadcase.Branch(i)[0];
        factor.Branch(previousLC).Add(f);
        loadcase.Branch(previousLC).Add(lcase);

        indices.Add(i);
      }
      else
      {
        previousLC = i;
      }
    }

    for (int i = 0; i < indices.Count; i++)
    {
      factor.RemovePath(indices[i]);
      loadcase.RemovePath(indices[i]);
      combo.RemovePath(indices[i]);
      combotype.RemovePath(indices[i]);
    }

    factor2 = factor;
    loadcase2 = loadcase;
    combo2 = combo;
    combotype2 = combotype;
# ---------- end c_script ----------

panel = Panel(c_script.combo2)
panel_2 = Panel(c_script.combotype2)
panel_3 = Panel(c_script.factor2)

# ----
# Example 8: Creating loadcases and load combinations from a table, using a custom C# component
# This example will show you how to create load cases and load combinations from a tabular format (in this case, tab separated value file). Before running,
# make sure you have a window with FEM-Design open.
info = Info(versionWhenCreated="22.2.0")

# ----
# Match load case names to loadcases
construct = LoadCaseConstruct(Name=item.Item, Type="Ordinary", DurationClass=item.Item2)  # -> flatten(LoadCase)
fsim = FindSimilarMember(Data=c_script.loadcase2, Set=flatten(item.Item))  # -> Hit, Index
item_3 = ListItem(List=construct, Index=fsim.Index, Wrap=True)

panel_4 = Panel(c_script.loadcase2)

# ----
# 1. Data conversion to FEM-Design API format and creation of
# loadcases and load combinations
construct_2 = LoadCombinationConstruct(Name=c_script.combo2, Type=c_script.combotype2, LoadCase=item_3, Gamma=c_script.factor2)  # -> flatten(LoadCombination)

panel_5 = Panel(item_3)

# ----
# 2. Create a directory for your file
# You can either choose to save your file in your current directory,
# or select your own separate folder. If you'd choose the latter,
# simply rightclick the directory component and choose "select a
# directory". Finally, edit the file name panel to give your file a name.
# Remember to end it with .struxml .
use_file_path_from = ValueList({"current directory": 0, "user defined folder": 1}, selected="current directory")
current_directory = GhPythonScript()  # -> folder
# ---------- current_directory: Python ----------
import rhinoscriptsyntax as rs

folder = rs.DocumentPath()
# ---------- end current_directory ----------
user_defined_folder = FilePath("C:\temp")
file_name_end_with_struxml = Panel("Example 8.struxml")
stream_filter = StreamFilter(Gate=use_file_path_from, Stream0=current_directory, Stream1=user_defined_folder)
concatenate = Concatenate(FragmentA=stream_filter, FragmentB=file_name_end_with_struxml)

# ----
# 3. Create and open model
construct_3 = ModelConstruct(CountryCode="S", LoadCases=construct, LoadCombinations=construct_2)
open = ModelOpen(FdModel=construct_3, FilePathStruxml=concatenate, CloseOpenWindows=Toggle(True), RunNode=Button())
