# Grasshopper definition intSurface_OnSection.gh (Grasshopper 1.0.7)
# plug-ins: eleFront, FEM-Design

info = Info(versionWhenCreated="23.2.0")
select_the_geometry_with_the_slider = Slider(1, range=0..2)
format = Format(Format="Section_{0}::*", Culture=127, Data0=select_the_geometry_with_the_slider)
reference_by_layer = ReferenceByLayer(LayerName=format, lightweight=False, DisableAutoUpdate=False)
value_list = ValueList({"Point", "Curve", "Arc", "Circle", "Ellipse", "Line", "Polyline", "Brep", "Surface", "Polysurface", "Extrusion", "Block", "Text", "TextDot", "Dimension", "LinearDimension", "AngularDimension", "RadialDimension", "Hatch", "Leader"}, selected="Point")
value_list_2 = ValueList({"Point", "Curve", "Arc", "Circle", "Ellipse", "Line", "Polyline", "Brep", "Surface", "Polysurface", "Extrusion", "Block", "Text", "TextDot", "Dimension", "LinearDimension", "AngularDimension", "RadialDimension", "Hatch", "Leader"}, selected="Curve")
value_list_3 = ValueList({"Point", "Curve", "Arc", "Circle", "Ellipse", "Line", "Polyline", "Brep", "Surface", "Polysurface", "Extrusion", "Block", "Text", "TextDot", "Dimension", "LinearDimension", "AngularDimension", "RadialDimension", "Hatch", "Leader"}, selected="Surface")
filter_by_type = FilterByType(ObjectType=value_list_3, Geometry=reference_by_layer, invertFilter=False, returnNulls=False)  # -> ExcludedGeometry, IncludedGeometry
filter_by_type_2 = FilterByType(ObjectType=value_list, Geometry=reference_by_layer, invertFilter=False, returnNulls=False)  # -> ExcludedGeometry, IncludedGeometry
filter_by_type_3 = FilterByType(ObjectType=value_list_2, Geometry=reference_by_layer, invertFilter=False, returnNulls=False)  # -> ExcludedGeometry, IncludedGeometry
path = FilePath()
materialdatabase = MaterialDatabase(CountryCode="S", FilePath=path)  # -> SteelMaterial, ConcreteMaterial, TimberMaterial, ReinforcementMaterial, StratumMaterial, CustomMaterial
item = ListItem(List=materialdatabase.ReinforcementMaterial, Index=0, Wrap=True)
item_2 = ListItem(List=materialdatabase.ConcreteMaterial, Index="6", Wrap=True)
reinf_material = Data(item)
reinf_material_2 = Data(item)
concrete_material = Data(item_2)
wire_define = WireDefine(Diameter="0.025", Material=reinf_material, Profile="ribbed")
surface = Surface(filter_by_type.IncludedGeometry)
point = Point(filter_by_type_2.IncludedGeometry)
curve = Curve(filter_by_type_3.IncludedGeometry)
wire_define_2 = WireDefine(Diameter="0.02", Material=reinf_material_2, Profile="ribbed")
patch = Patch(Surface=surface, Material=concrete_material)
layer = Layer(Curve=curve, NumberOfRebar="5", Wire=wire_define)
rebar = Rebar(Point=point, Wire=wire_define_2)
panel = Panel(layer)
interactionsurface_onsection = InteractionSurfaceOnSection(Patch=patch, Rebars=rebar, Layers=layer, FUlt=True)  # -> InteractionSurface, N, My, Mz, Bar
panel_2 = Panel(interactionsurface_onsection.N)
panel_3 = Panel(interactionsurface_onsection.My)
panel_4 = Panel(interactionsurface_onsection.Mz)
mesh = Mesh(interactionsurface_onsection.InteractionSurface)
bar = Data(interactionsurface_onsection.Bar)
model_construct = ModelConstruct(CountryCode="S", StructureElements=bar)
fem_design_connection = FEMDesignConnection(Verbosity="ScriptLogLinesOnly", DeleteOutputFolder=False)
boolean_toggle = BooleanToggle(False)  # disabled
fem_design_openmodel = FEMDesignOpenModel(Connection=fem_design_connection, Model=model_construct, RunNode=boolean_toggle)  # -> Connection, Model, Success
