# Grasshopper definition Practical example - Post processin.gh (Grasshopper 1.0.7)
# plug-ins: FEM-Design

connection = FEMDesignConnection(DeleteOutputFolder=False)
path = FilePath("C:\GitHub\femdesign-api\FemDesign.Examples\Grasshopper\Practical example - Post processing.str")
openmodel = FEMDesignOpenModel(Connection=connection, Model=path, RunNode=True)  # -> Connection, Model, Success

amplification_factor = Slider(58.24, range=0..200)
# Nodal vibration results
resultstype = ResultsType({"NodalDisplacement", "NodalDisplacement", "PointSupportReaction", "PointSupportReactionMinMax", "PointConnectionForce", "BarDisplacement", "BarInternalForce", "BarStress", "LineSupportReaction", "LineConnectionResultant"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}, selected="NodalVibration")
getcasecombresults = FEMDesignGetCaseCombResults(Connection=openmodel.Connection, ResultType=resultstype, RunNode=True)  # -> Connection, Results, Success
getfemodel = FEMDesignGetFeModel(Connection=getcasecombresults.Connection, RunNode=True)  # -> Connection, FiniteElement, Success
nodalvibration = NodalVibration(Result=getcasecombresults.Results, VibrationMode=Slider(3, range=1..5))  # -> ShapeId, Identifier, NodeId, Translation, Rotation
femshell = FiniteElementFemShell(FiniteElement=getfemodel.FiniteElement)  # -> Identifier, ElementId, FaceIndex, MeshGeometry
fembar = FiniteElementFemBar(FiniteElement=getfemodel.FiniteElement)  # -> Identifier, ElementId, NodeI, NodeJ, LineGeometry
femnode = FiniteElementFemNode(FiniteElement=getfemodel.FiniteElement)  # -> NodeId, Point
deface = DeconstructFace(Face=femshell.FaceIndex)  # -> CornerA, CornerB, CornerC, CornerD
python = GhPythonScript(keys=femnode.NodeId, values=femnode.Point, search=fembar.NodeI)  # -> out, result; inputs keys: list, values: list, search: list
# ---------- python: Python ----------
__author__ = "Marco"
__version__ = "2023.07.12"

import rhinoscriptsyntax as rs

dict = {}

for k, v in zip(keys, values):
    dict[k] = v

result = []

for item in search:
    found = dict[item]
    result.append(found)
# ---------- end python ----------
python_2 = GhPythonScript(keys=femnode.NodeId, values=femnode.Point, search=fembar.NodeJ)  # -> out, result; inputs keys: list, values: list, search: list; same code as python
python_3 = GhPythonScript(keys=nodalvibration.NodeId, values=nodalvibration.Translation, search=fembar.NodeI)  # -> out, result; inputs keys: list, values: list, search: list; same code as python
python_4 = GhPythonScript(keys=nodalvibration.NodeId, values=nodalvibration.Translation, search=fembar.NodeJ)  # -> out, result; inputs keys: list, values: list, search: list; same code as python
python_5 = GhPythonScript(keys=nodalvibration.NodeId, values=nodalvibration.Translation, search=deface.CornerA)  # -> out, result; inputs keys: list, values: list, search: list; same code as python
python_6 = GhPythonScript(keys=nodalvibration.NodeId, values=nodalvibration.Translation, search=deface.CornerB)  # -> out, result; inputs keys: list, values: list, search: list; same code as python
python_7 = GhPythonScript(keys=nodalvibration.NodeId, values=nodalvibration.Translation, search=deface.CornerC)  # -> out, result; inputs keys: list, values: list, search: list; same code as python
python_8 = GhPythonScript(keys=nodalvibration.NodeId, values=nodalvibration.Translation, search=deface.CornerD)  # -> out, result; inputs keys: list, values: list, search: list; same code as python
python_9 = GhPythonScript(keys=femnode.NodeId, values=femnode.Point, search=deface.CornerB)  # -> out, result; inputs keys: list, values: list, search: list; same code as python
python_10 = GhPythonScript(keys=femnode.NodeId, values=femnode.Point, search=deface.CornerA)  # -> out, result; inputs keys: list, values: list, search: list; same code as python
python_11 = GhPythonScript(keys=femnode.NodeId, values=femnode.Point, search=deface.CornerC)  # -> out, result; inputs keys: list, values: list, search: list; same code as python
python_12 = GhPythonScript(keys=femnode.NodeId, values=femnode.Point, search=deface.CornerD)  # -> out, result; inputs keys: list, values: list, search: list; same code as python
multiplication = Multiplication(A=python_4.result, B=amplification_factor)
multiplication_2 = Multiplication(A=python_3.result, B=amplification_factor)
multiplication_3 = Multiplication(A=python_5.result, B=amplification_factor)
multiplication_4 = Multiplication(A=python_6.result, B=amplification_factor)
multiplication_5 = Multiplication(A=python_7.result, B=amplification_factor)
multiplication_6 = Multiplication(A=python_8.result, B=amplification_factor)
move = Move(Geometry=python.result, Motion=multiplication_2)  # -> Geometry, Transform
move_2 = Move(Geometry=python_2.result, Motion=multiplication)  # -> Geometry, Transform
move_3 = Move(Geometry=python_10.result, Motion=multiplication_3)  # -> Geometry, Transform
move_4 = Move(Geometry=python_9.result, Motion=multiplication_4)  # -> Geometry, Transform
move_5 = Move(Geometry=python_11.result, Motion=multiplication_5)  # -> Geometry, Transform
move_6 = Move(Geometry=python_12.result, Motion=multiplication_6)  # -> Geometry, Transform
graft = GraftTree(Tree=move_3.Geometry, IncludeEmptyLists=True, IncludeNullItems=True)
graft_2 = GraftTree(Tree=move_5.Geometry, IncludeEmptyLists=True, IncludeNullItems=True)
graft_3 = GraftTree(Tree=move_6.Geometry, IncludeEmptyLists=True, IncludeNullItems=True)
graft_4 = GraftTree(Tree=move_4.Geometry, IncludeEmptyLists=True, IncludeNullItems=True)
ln = Line(StartPoint=move.Geometry, EndPoint=move_2.Geometry)
merge = Merge(Data1=graft, Data2=graft_4, Data3=graft_2, Data4=graft_3)
conmesh = ConstructMesh(Vertices=merge, Faces={A=0, B=1, C=2, D=3})
merge_2 = Merge(Data1=ln, Data2=conmesh)
geo = Geometry(merge_2)

# ----
# Load Case/Comb Shell stress
resultstype_2 = ResultsType({"NodalDisplacement", "NodalDisplacement", "PointSupportReaction", "PointSupportReactionMinMax", "PointConnectionForce", "BarDisplacement", "BarInternalForce", "BarStress", "LineSupportReaction", "LineConnectionResultant"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}, selected="ShellStress")
getcasecombresults_2 = FEMDesignGetCaseCombResults(Connection=openmodel.Connection, ResultType=resultstype_2, RunNode=True)  # -> Connection, Results, Success
shellstress = ShellStress(Result=getcasecombresults_2.Results, CaseCombinationName="ULS", Side="membrane")  # -> CaseIdentifier, ElementId, flatten(NodeId), SigmaX, SigmaY, TauXY, TauXZ, TauYZ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
getfemodel_2 = FEMDesignGetFeModel(Connection=getcasecombresults_2.Connection, RunNode=True)  # -> Connection, FiniteElement, Success
femshell_2 = FiniteElementFemShell(FiniteElement=getfemodel_2.FiniteElement)  # -> Identifier, ElementId, FaceIndex, MeshGeometry
femnode_2 = FiniteElementFemNode(FiniteElement=getfemodel_2.FiniteElement)  # -> NodeId, Point
deface_2 = DeconstructFace(Face=femshell_2.FaceIndex)  # -> CornerA, CornerB, CornerC, CornerD
python_13 = GhPythonScript(keys=shellstress.NodeId, values=shellstress.SigmaVM, search=deface_2.CornerA)  # -> out, result; inputs keys: list, values: list, search: list; same code as python
python_14 = GhPythonScript(keys=shellstress.NodeId, values=shellstress.SigmaVM, search=deface_2.CornerB)  # -> out, result; inputs keys: list, values: list, search: list; same code as python
python_15 = GhPythonScript(keys=shellstress.NodeId, values=shellstress.SigmaVM, search=deface_2.CornerC)  # -> out, result; inputs keys: list, values: list, search: list; same code as python
python_16 = GhPythonScript(keys=shellstress.NodeId, values=shellstress.SigmaVM, search=deface_2.CornerD)  # -> out, result; inputs keys: list, values: list, search: list; same code as python
python_17 = GhPythonScript(keys=femnode_2.NodeId, values=femnode_2.Point, search=deface_2.CornerB)  # -> out, result; inputs keys: list, values: list, search: list; same code as python
python_18 = GhPythonScript(keys=femnode_2.NodeId, values=femnode_2.Point, search=deface_2.CornerA)  # -> out, result; inputs keys: list, values: list, search: list; same code as python
python_19 = GhPythonScript(keys=femnode_2.NodeId, values=femnode_2.Point, search=deface_2.CornerC)  # -> out, result; inputs keys: list, values: list, search: list; same code as python
python_20 = GhPythonScript(keys=femnode_2.NodeId, values=femnode_2.Point, search=deface_2.CornerD)  # -> out, result; inputs keys: list, values: list, search: list; same code as python
graft_5 = GraftTree(Tree=python_18.result, IncludeEmptyLists=True, IncludeNullItems=True)
graft_6 = GraftTree(Tree=python_19.result, IncludeEmptyLists=True, IncludeNullItems=True)
graft_7 = GraftTree(Tree=python_20.result, IncludeEmptyLists=True, IncludeNullItems=True)
graft_8 = GraftTree(Tree=python_17.result, IncludeEmptyLists=True, IncludeNullItems=True)
graft_9 = GraftTree(Tree=python_13.result, IncludeEmptyLists=True, IncludeNullItems=True)
graft_10 = GraftTree(Tree=python_14.result, IncludeEmptyLists=True, IncludeNullItems=True)
graft_11 = GraftTree(Tree=python_15.result, IncludeEmptyLists=True, IncludeNullItems=True)
graft_12 = GraftTree(Tree=python_16.result, IncludeEmptyLists=True, IncludeNullItems=True)
merge_3 = Merge(Data1=graft_5, Data2=graft_8, Data3=graft_6, Data4=graft_7)
merge_4 = Merge(Data1=graft_9, Data2=graft_10, Data3=graft_11, Data4=graft_12)
bnd = Bounds(Numbers=flatten(merge_4))
remap = RemapNumbers(Value=merge_4, Source=bnd, Target=Slider(1, range=0..1))  # -> Mapped, Clipped
gradient = Gradient(LowerLimit=0, UpperLimit=1, Parameter=remap.Mapped, stops=[0: RGB(0, 128, 0), 0.5: RGB(255, 255, 0), 1: RGB(255, 0, 0)])
conmesh_2 = ConstructMesh(Vertices=merge_3, Faces={A=0, B=1, C=2, D=3}, Colours=gradient)
mjoin = MeshJoin(Meshes=flatten(conmesh_2))
geo_2 = Geometry(mjoin)

# ----
# Stability results
panel = Panel("ULS")
number_slider = Slider(2, range=1..5)
amplification_factor_2 = Slider(100, range=0..200)
stabilityresults = FEMDesignGetStabilityResults(Connection=openmodel.Connection, CombinationName=panel, RunNode=True)  # -> Connection, BucklingShapes, CriticalParameter, Success
getfemodel_3 = FEMDesignGetFeModel(Connection=stabilityresults.Connection, RunNode=True)  # -> Connection, FiniteElement, Success
femshell_3 = FiniteElementFemShell(FiniteElement=getfemodel_3.FiniteElement)  # -> Identifier, ElementId, FaceIndex, MeshGeometry
fembar_2 = FiniteElementFemBar(FiniteElement=getfemodel_3.FiniteElement)  # -> Identifier, ElementId, NodeI, NodeJ, LineGeometry
femnode_3 = FiniteElementFemNode(FiniteElement=getfemodel_3.FiniteElement)  # -> NodeId, Point
nodalbucklingshape = NodalBucklingShape(Result=stabilityresults.BucklingShapes, BucklingShape=number_slider)  # -> Identifier, CaseIdentifier, ShapeId, NodeId, Translation, Rotation
nodalbucklingshape_2 = NodalBucklingShape(Result=stabilityresults.BucklingShapes, BucklingShape=number_slider)  # -> Identifier, CaseIdentifier, ShapeId, NodeId, Translation, Rotation
deface_3 = DeconstructFace(Face=femshell_3.FaceIndex)  # -> CornerA, CornerB, CornerC, CornerD
python_21 = GhPythonScript(keys=femnode_3.NodeId, values=femnode_3.Point, search=fembar_2.NodeI)  # -> out, result; inputs keys: list, values: list, search: list; same code as python
python_22 = GhPythonScript(keys=femnode_3.NodeId, values=femnode_3.Point, search=fembar_2.NodeJ)  # -> out, result; inputs keys: list, values: list, search: list; same code as python
python_23 = GhPythonScript(keys=nodalbucklingshape_2.NodeId, values=nodalbucklingshape_2.Translation, search=fembar_2.NodeI)  # -> out, result; inputs keys: list, values: list, search: list; same code as python
python_24 = GhPythonScript(keys=nodalbucklingshape_2.NodeId, values=nodalbucklingshape_2.Translation, search=fembar_2.NodeJ)  # -> out, result; inputs keys: list, values: list, search: list; same code as python
python_25 = GhPythonScript(keys=nodalbucklingshape.NodeId, values=nodalbucklingshape.Translation, search=deface_3.CornerA)  # -> out, result; inputs keys: list, values: list, search: list; same code as python
python_26 = GhPythonScript(keys=nodalbucklingshape.NodeId, values=nodalbucklingshape.Translation, search=deface_3.CornerB)  # -> out, result; inputs keys: list, values: list, search: list; same code as python
python_27 = GhPythonScript(keys=nodalbucklingshape.NodeId, values=nodalbucklingshape.Translation, search=deface_3.CornerC)  # -> out, result; inputs keys: list, values: list, search: list; same code as python
python_28 = GhPythonScript(keys=nodalbucklingshape.NodeId, values=nodalbucklingshape.Translation, search=deface_3.CornerD)  # -> out, result; inputs keys: list, values: list, search: list; same code as python
python_29 = GhPythonScript(keys=femnode_3.NodeId, values=femnode_3.Point, search=deface_3.CornerB)  # -> out, result; inputs keys: list, values: list, search: list; same code as python
python_30 = GhPythonScript(keys=femnode_3.NodeId, values=femnode_3.Point, search=deface_3.CornerA)  # -> out, result; inputs keys: list, values: list, search: list; same code as python
python_31 = GhPythonScript(keys=femnode_3.NodeId, values=femnode_3.Point, search=deface_3.CornerC)  # -> out, result; inputs keys: list, values: list, search: list; same code as python
python_32 = GhPythonScript(keys=femnode_3.NodeId, values=femnode_3.Point, search=deface_3.CornerD)  # -> out, result; inputs keys: list, values: list, search: list; same code as python
multiplication_7 = Multiplication(A=python_24.result, B=amplification_factor_2)
multiplication_8 = Multiplication(A=python_23.result, B=amplification_factor_2)
multiplication_9 = Multiplication(A=python_25.result, B=amplification_factor_2)
multiplication_10 = Multiplication(A=python_26.result, B=amplification_factor_2)
multiplication_11 = Multiplication(A=python_27.result, B=amplification_factor_2)
multiplication_12 = Multiplication(A=python_28.result, B=amplification_factor_2)
move_7 = Move(Geometry=python_21.result, Motion=multiplication_8)  # -> Geometry, Transform
move_8 = Move(Geometry=python_22.result, Motion=multiplication_7)  # -> Geometry, Transform
move_9 = Move(Geometry=python_30.result, Motion=multiplication_9)  # -> Geometry, Transform
move_10 = Move(Geometry=python_29.result, Motion=multiplication_10)  # -> Geometry, Transform
move_11 = Move(Geometry=python_31.result, Motion=multiplication_11)  # -> Geometry, Transform
move_12 = Move(Geometry=python_32.result, Motion=multiplication_12)  # -> Geometry, Transform
graft_13 = GraftTree(Tree=move_9.Geometry, IncludeEmptyLists=True, IncludeNullItems=True)
graft_14 = GraftTree(Tree=move_11.Geometry, IncludeEmptyLists=True, IncludeNullItems=True)
graft_15 = GraftTree(Tree=move_12.Geometry, IncludeEmptyLists=True, IncludeNullItems=True)
graft_16 = GraftTree(Tree=move_10.Geometry, IncludeEmptyLists=True, IncludeNullItems=True)
merge_5 = Merge(Data1=graft_13, Data2=graft_16, Data3=graft_14, Data4=graft_15)
ln_2 = Line(StartPoint=move_7.Geometry, EndPoint=move_8.Geometry)
conmesh_3 = ConstructMesh(Vertices=merge_5, Faces={A=0, B=1, C=2, D=3})
geo_3 = Geometry(conmesh_3)
geo_4 = Geometry(ln_2)
merge_6 = Merge(Data1=geo_4, Data2=geo_3)
geo_5 = Geometry(merge_6)

# ----
# Get quantities
resultstype_3 = ResultsType({"NodalDisplacement", "NodalDisplacement", "PointSupportReaction", "PointSupportReactionMinMax", "PointConnectionForce", "BarDisplacement", "BarInternalForce", "BarStress", "LineSupportReaction", "LineConnectionResultant"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}, selected="QuantityEstimationConcrete")
resultstype_4 = ResultsType({"NodalDisplacement", "NodalDisplacement", "PointSupportReaction", "PointSupportReactionMinMax", "PointConnectionForce", "BarDisplacement", "BarInternalForce", "BarStress", "LineSupportReaction", "LineConnectionResultant"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}, selected="QuantityEstimationSteel")
getquantities = FEMDesignGetQuantities(Connection=openmodel.Connection, QuantityType=resultstype_4, RunNode=True)  # -> Connection, Quantities, Success
getquantities_2 = FEMDesignGetQuantities(Connection=openmodel.Connection, QuantityType=resultstype_3, RunNode=True)  # -> Connection, Quantities, Success
concretequantityestimation = ConcreteQuantityEstimation(Result=getquantities_2.Quantities)  # -> Storey, Structure, Id, Quality, Section, Subtotal, Volume, TotalWeight, Formwork, Reinforcement
steelquantityestimation = SteelQuantityEstimation(Result=getquantities.Quantities)  # -> Storey, Structure, Id, Quality, Section, UnitWeight, Subtotal, TotalWeight, PaintedArea

# ----
# Load Case/Comb Deformation
amplification_factor_3 = Slider(6.31, range=0..200)
resultstype_5 = ResultsType({"NodalDisplacement", "NodalDisplacement", "PointSupportReaction", "PointSupportReactionMinMax", "PointConnectionForce", "BarDisplacement", "BarInternalForce", "BarStress", "LineSupportReaction", "LineConnectionResultant"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}, selected="NodalDisplacement")
getcasecombresults_3 = FEMDesignGetCaseCombResults(Connection=openmodel.Connection, ResultType=resultstype_5, RunNode=True)  # -> Connection, Results, Success
getfemodel_4 = FEMDesignGetFeModel(Connection=getcasecombresults_3.Connection, RunNode=True)  # -> Connection, FiniteElement, Success
femshell_4 = FiniteElementFemShell(FiniteElement=getfemodel_4.FiniteElement)  # -> Identifier, ElementId, FaceIndex, MeshGeometry
fembar_3 = FiniteElementFemBar(FiniteElement=getfemodel_4.FiniteElement)  # -> Identifier, ElementId, NodeI, NodeJ, LineGeometry
femnode_4 = FiniteElementFemNode(FiniteElement=getfemodel_4.FiniteElement)  # -> NodeId, Point
deface_4 = DeconstructFace(Face=femshell_4.FaceIndex)  # -> CornerA, CornerB, CornerC, CornerD
python_33 = GhPythonScript(keys=femnode_4.NodeId, values=femnode_4.Point, search=fembar_3.NodeI)  # -> out, result; inputs keys: list, values: list, search: list; same code as python
python_34 = GhPythonScript(keys=femnode_4.NodeId, values=femnode_4.Point, search=fembar_3.NodeJ)  # -> out, result; inputs keys: list, values: list, search: list; same code as python
python_35 = GhPythonScript(keys=femnode_4.NodeId, values=femnode_4.Point, search=deface_4.CornerB)  # -> out, result; inputs keys: list, values: list, search: list; same code as python
python_36 = GhPythonScript(keys=femnode_4.NodeId, values=femnode_4.Point, search=deface_4.CornerA)  # -> out, result; inputs keys: list, values: list, search: list; same code as python
python_37 = GhPythonScript(keys=femnode_4.NodeId, values=femnode_4.Point, search=deface_4.CornerC)  # -> out, result; inputs keys: list, values: list, search: list; same code as python
python_38 = GhPythonScript(keys=femnode_4.NodeId, values=femnode_4.Point, search=deface_4.CornerD)  # -> out, result; inputs keys: list, values: list, search: list; same code as python

nodaldisplacement = NodalDisplacement(Result=getcasecombresults_3.Results, CaseCombinationName="ULS")  # -> CaseIdentifier, NodeId, Translation, Rotation

python_39 = GhPythonScript(keys=nodaldisplacement.NodeId, values=nodaldisplacement.Translation, search=fembar_3.NodeI)  # -> out, result; inputs keys: list, values: list, search: list; same code as python
python_40 = GhPythonScript(keys=nodaldisplacement.NodeId, values=nodaldisplacement.Translation, search=fembar_3.NodeJ)  # -> out, result; inputs keys: list, values: list, search: list; same code as python
python_41 = GhPythonScript(keys=nodaldisplacement.NodeId, values=nodaldisplacement.Translation, search=deface_4.CornerA)  # -> out, result; inputs keys: list, values: list, search: list; same code as python
python_42 = GhPythonScript(keys=nodaldisplacement.NodeId, values=nodaldisplacement.Translation, search=deface_4.CornerB)  # -> out, result; inputs keys: list, values: list, search: list; same code as python
python_43 = GhPythonScript(keys=nodaldisplacement.NodeId, values=nodaldisplacement.Translation, search=deface_4.CornerC)  # -> out, result; inputs keys: list, values: list, search: list; same code as python
python_44 = GhPythonScript(keys=nodaldisplacement.NodeId, values=nodaldisplacement.Translation, search=deface_4.CornerD)  # -> out, result; inputs keys: list, values: list, search: list; same code as python
multiplication_13 = Multiplication(A=python_40.result, B=amplification_factor_3)
multiplication_14 = Multiplication(A=python_39.result, B=amplification_factor_3)
multiplication_15 = Multiplication(A=python_41.result, B=amplification_factor_3)
multiplication_16 = Multiplication(A=python_42.result, B=amplification_factor_3)
multiplication_17 = Multiplication(A=python_43.result, B=amplification_factor_3)
multiplication_18 = Multiplication(A=python_44.result, B=amplification_factor_3)
move_13 = Move(Geometry=python_33.result, Motion=multiplication_14)  # -> Geometry, Transform
move_14 = Move(Geometry=python_34.result, Motion=multiplication_13)  # -> Geometry, Transform
move_15 = Move(Geometry=python_36.result, Motion=multiplication_15)  # -> Geometry, Transform
move_16 = Move(Geometry=python_35.result, Motion=multiplication_16)  # -> Geometry, Transform
move_17 = Move(Geometry=python_37.result, Motion=multiplication_17)  # -> Geometry, Transform
move_18 = Move(Geometry=python_38.result, Motion=multiplication_18)  # -> Geometry, Transform
graft_17 = GraftTree(Tree=move_15.Geometry, IncludeEmptyLists=True, IncludeNullItems=True)
graft_18 = GraftTree(Tree=move_17.Geometry, IncludeEmptyLists=True, IncludeNullItems=True)
graft_19 = GraftTree(Tree=move_18.Geometry, IncludeEmptyLists=True, IncludeNullItems=True)
graft_20 = GraftTree(Tree=move_16.Geometry, IncludeEmptyLists=True, IncludeNullItems=True)
merge_7 = Merge(Data1=graft_17, Data2=graft_20, Data3=graft_18, Data4=graft_19)
ln_3 = Line(StartPoint=move_13.Geometry, EndPoint=move_14.Geometry)
conmesh_4 = ConstructMesh(Vertices=merge_7, Faces={A=0, B=1, C=2, D=3})
merge_8 = Merge(Data1=ln_3, Data2=conmesh_4)
geo_6 = Geometry(merge_8)
