# Grasshopper definition Practical example - Quantity estimation.gh (Grasshopper 1.0.7)
# plug-ins: FEM-Design

info = Info(versionWhenCreated="21.5.0")

# ----
# Choose results
resultstype = ResultsType({"NodalDisplacement", "PointSupportReaction", "PointSupportReactionMinMax", "BarDisplacement", "BarInternalForce", "BarStress", "LineSupportReaction", "ShellDisplacement", "ShellInternalForce", "ShellStress", "LabelledSectionInternalForce", "LabelledSectionResultant", "NodalVibrationShape", "EigenFrequencies", "QuantityEstimationConcrete", "QuantityEstimationSteel", "QuantityEstimationTimber", "QuantityEstimationTimberPanel", "QuantityEstimationGeneral", "QuantityEstimationReinforcement"}, selected=["QuantityEstimationConcrete", "QuantityEstimationSteel", "QuantityEstimationTimber", "QuantityEstimationTimberPanel", "QuantityEstimationGeneral", "QuantityEstimationReinforcement"])

# ----
# Choose units
list = ValueList({"kg", "t", "lb", "tonUK", "tonUS"}, selected="t")
units = Units(Length="m", Angle="rad", SectionalData="m", Force="kN", Mass=list, Displacement="m", Stress="Pa")

# ---- group: This may be a FEM-Design .str or .struxml file
# Practical example - Quantity estimation
# Choose file
filepath = FilePath("C:\Temp\2007_carbon_data\Samples\Klimatdata presentation\Example CLT slabs.struxml")

# ----
readstr = ModelReadStr(StrPath=filepath, ResultTypes=resultstype, Units=units, RunNode=Toggle(True))  # -> FdModel, FdFeaModel, Results
bang = ExplodeTree(Data=readstr.Results)  # -> Branch0, Branch1

# ----
# Add the result deconstructors you need
timberquantityestimation = TimberQuantityEstimation()  # -> Storey, Structure, Id, Quality, Section, UnitWeight, Subtotal, TotalWeight, PaintedArea
steelquantityestimation = SteelQuantityEstimation()  # -> Storey, Structure, Id, Quality, Section, UnitWeight, Subtotal, TotalWeight, PaintedArea
reinforcementquantityestimation = ReinforcementQuantityEstimation()  # -> Storey, Structure, Id, Quality, Diameter, TotalWeight

# ----
# Summarize quantities
concretequantityestimation = ConcreteQuantityEstimation(Result=bang.Branch0)  # -> Storey, Structure, Id, Quality, Section, Subtotal, Volume, TotalWeight, Formwork, Reinforcement
timberpanelquantityestimation = TimberPanelQuantityEstimation(Result=bang.Branch1)  # -> Storey, Structure, Quality, Id, PanelType, Thickness, Length, Width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
ma = MassAddition(Input=concretequantityestimation.TotalWeight)  # -> Result, PartialResults
ma_2 = MassAddition(Input=timberpanelquantityestimation.TotalWeight)  # -> Result, PartialResults
format = Format(Format="Concrete: {0:0.0}{1}", Culture=127, Data0=ma.Result, Data1=list)
format_2 = Format(Format="Timber panels: {0:0.0}{1}", Culture=127, Data0=ma_2.Result, Data1=list)
panel = Panel(format)
panel_2 = Panel(format_2)
