# Grasshopper definition Practical example - Voronoi Structure.gh (Grasshopper 1.0.7)
# plug-ins: FEM-Design, Kangaroo2 Components

rectangle = Rectangle(Plane=PlaneXY(0, 0, 0), XSize="5", YSize="12", Radius=0)  # -> Rectangle, Length
pop3d = Populate3D(Region=rectangle.Rectangle, Count=100, Seed=1)
voronoi = Voronoi(Points=pop3d, Boundary=rectangle.Rectangle, BruteForceOverride=False)
explode = Explode(Curve=voronoi, Recursive=True)  # -> Segments, Vertices
dupln = RemoveDuplicateLines(Lines=flatten(explode.Segments), Tolerance=0.01)
boundary = BoundarySurfaces(Edges=voronoi)
midpt = CurveMiddle(Curve=dupln)
materialdatabase = MaterialDatabase(CountryCode="S")  # -> SteelMaterial, ConcreteMaterial, TimberMaterial, ReinforcementMaterial, StratumMaterial, CustomMaterial
materialdatabase_2 = MaterialDatabase(CountryCode="S")  # -> SteelMaterial, ConcreteMaterial, TimberMaterial, ReinforcementMaterial, StratumMaterial, CustomMaterial
crv_cp = CurveClosestPoint(Point=midpt, Curve=rectangle.Rectangle)  # -> Point, Parameter, Distance
sectiondatabase = SectionDatabase()  # -> SteelSection, ConcreteSection, TimberSection, HollowCoreSection, CustomSection
smaller = SmallerThan(FirstNumber=crv_cp.Distance, SecondNumber="0.01")  # -> SmallerThan, OrEqualTo
list = ValueList({"ordinary", "dead_load", "soil_dead_load", "shrinkage", "prestressing", "fire", "seis_sxp", "seis_sxm", "seis_syp", "seis_sym"}, selected="dead_load")
list_2 = ValueList({"ordinary", "dead_load", "soil_dead_load", "shrinkage", "prestressing", "fire", "seis_sxp", "seis_sxm", "seis_syp", "seis_sym"}, selected="ordinary")
list_3 = ValueList({"permanent", "long-term", "medium-term", "short-term", "instantaneous"}, selected="permanent")
list_4 = ValueList({"permanent", "long-term", "medium-term", "short-term", "instantaneous"}, selected="permanent")
dispatch = Dispatch(List=dupln, DispatchPattern=invert(smaller.SmallerThan))  # -> ListA, ListB
item = ListItem(List=materialdatabase.SteelMaterial, Index=0, Wrap=True)
item_2 = ListItem(List=materialdatabase_2.ConcreteMaterial, Index=0, Wrap=True)
item_3 = ListItem(List=sectiondatabase.SteelSection, Index=0, Wrap=True)
construct = LoadCaseConstruct(Name="LiveLoad", Type=list_2, DurationClass=list_4)
construct_2 = LoadCaseConstruct(Name="DeadLoad", Type=list, DurationClass=list_3)
crv = Curve(dispatch.ListB)
material = Data(item)
crv_2 = Curve(dupln)
srf = Surface(boundary)
section = Data(item_3)
construct_3 = RotationsConstruct(X_neg=0, X_pos=0, Y_neg=0, Y_pos=0, Z_neg=0, Z_pos=0)
construct_4 = MotionsConstruct(X_neg=0, X_pos=0, Y_neg=0, Y_pos=0, Z_neg="1.0e7", Z_pos="1.0e7")
item_4 = ListItem(List=crv, Index=0, Wrap=True)
merge = Merge(Data1=construct_2, Data2=construct)
end = EndPoints(Curve=item_4)  # -> Start, End
rigid = PointSupportRigid(PointPlane=end.Start, Identifier="S")
construct_5 = LineSupportConstruct(Curve=crv, Motions=construct_4, Rotations=construct_3, MovingLocal=False, OrientLCS=True, Identifier="S")
construct_6 = Plate(Surface=srf, Thickness="0.15", Material=item_2, Identifier="P")
beam = BarsBeam(Curve=crv_2, Material=material, Section=section, OrientLCS=True, Identifier="B")
list_5 = ValueList({"ultimate_ordinary", "ultimate_accidental", "ultimate_seismic", "serviceability_quasi_permanent", "serviceability_frequent", "serviceability_characteristic"}, selected="ultimate_ordinary")
panel = Panel("""1.35
1.5""")
load_case = Data(merge)
Z = UnitZ(Factor="-1.00")
Z_2 = UnitZ(Factor="-2.00")
surfaceload_uniform = SurfaceLoadUniform(Surface=srf, Force=Z_2, LoadCase=construct)
lineload_define = LineLoadDefine(Curve=crv_2, StartForce=Z, LoadCase=construct, ConstLoadDir=True, LoadProjection=False, Type="Force")
construct_7 = LoadCombinationConstruct(Name="ULS", Type=list_5, LoadCase=load_case, Gamma=panel)
loadcombinations = Data(flatten(construct_7))
loadcases = Data(flatten(merge))
elements = Data(flatten([beam, construct_5, construct_6, rigid]))
loads = Data(flatten([surfaceload_uniform, lineload_define]))
model_construct = ModelConstruct(CountryCode="S", StructureElements=elements, Loads=loads, LoadCases=loadcases, LoadCombinations=loadcombinations)
fem_design_connection = FEMDesignConnection(Verbosity="ScriptLogLinesOnly", DeleteOutputFolder=False)
toggle = BooleanToggle(True)
analysis_define = AnalysisDefine(
    CalcCase=toggle,
    CalcComb=toggle,
    CalcCstage=False,
    CalcImpf=False,
    CalcGmax=False,
    CalcStab=False,
    CalcFreq=False,
    CalcSeis=False,
    CalcDesign=False,
    CalcFootfall=False,
    Elemfine=True,
    Diaphragm=0,
    PeakSmoothing=False)
openmodel = FEMDesignOpenModel(Connection=fem_design_connection, Model=model_construct, RunNode=True)  # -> Connection, Model, Success
runanalysis = FEMDesignRunAnalysis(Connection=openmodel.Connection, Analysis=analysis_define, RunNode=True)  # -> Connection, Log, Success
design = DesignDefine(Mode="steel", AutoDesign=Toggle(True), Check=True, BasedOn=True, ApplyChanges=Toggle(True))
fem_design_rundesign = FEMDesignRunDesign(Connection=runanalysis.Connection, Design=design, RunNode=True)  # -> Connection, Log, Success
design_2 = DesignDefine(Mode="steel", AutoDesign=False, Check=Toggle(True), BasedOn=True, ApplyChanges=False)
fem_design_rundesign_2 = FEMDesignRunDesign(Connection=fem_design_rundesign.Connection, Design=design_2, RunNode=True)  # -> Connection, Log, Success
resultstype = ResultsType({"NodalDisplacement", "PointSupportReaction", "PointSupportReactionMinMax", "BarDisplacement", "BarInternalForce", "BarStress", "LineSupportReaction", "LineConnectionResultant", "LineConnectionForce", "SurfaceSupportReaction", "ShellDisplacement", "ShellInternalForce", "ShellStress", "LabelledSectionInternalForce", "LabelledSectionResultant", "NodalVibrationShape", "EigenFrequencies", "QuantityEstimationConcrete", "QuantityEstimationSteel", "QuantityEstimationTimber", "QuantityEstimationTimberPanel", "QuantityEstimationGeneral", "QuantityEstimationReinforcement"}, selected="NodalDisplacement")
resultstype_2 = ResultsType({"NodalDisplacement", "NodalDisplacement", "PointSupportReaction", "PointSupportReactionMinMax", "PointConnectionForce", "BarDisplacement", "BarInternalForce", "BarStress", "LineSupportReaction", "LineConnectionResultant"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}, selected="QuantityEstimationSteel")
resultstype_3 = ResultsType({"NodalDisplacement", "NodalDisplacement", "PointSupportReaction", "PointSupportReactionMinMax", "PointConnectionForce", "BarDisplacement", "BarInternalForce", "BarStress", "LineSupportReaction", "LineConnectionResultant"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}, selected="QuantityEstimationConcrete")
panel_2 = Panel("ULS")
getfemodel = FEMDesignGetFeModel(Connection=fem_design_rundesign_2.Connection, RunNode=True)  # -> Connection, FiniteElement, Success
fem_design_getcasecombresults = FEMDesignGetCaseCombResults(Connection=fem_design_rundesign_2.Connection, ResultType=resultstype, CombinationName=panel_2, RunNode=True)  # -> Connection, Results, Success
getquantities = FEMDesignGetQuantities(Connection=fem_design_rundesign_2.Connection, QuantityType=resultstype_2, RunNode=True)  # -> Connection, Quantities, Success
getquantities_2 = FEMDesignGetQuantities(Connection=fem_design_rundesign_2.Connection, QuantityType=resultstype_3, RunNode=True)  # -> Connection, Quantities, Success
panel_3 = Panel(getquantities_2.Connection)
panel_4 = Panel(getquantities_2.Quantities)
panel_5 = Panel(getquantities.Connection)
panel_6 = Panel(getquantities.Quantities)
panel_7 = Panel(panel_2)
nodaldisplacement = NodalDisplacement(Result=fem_design_getcasecombresults.Results, CaseCombinationName=panel_7)  # -> CaseIdentifier, ElementId, NodeId, Translation, Rotation
femshell = FiniteElementFemShell(FiniteElement=getfemodel.FiniteElement)  # -> Identifier, ElementId, FaceIndex, MeshGeometry
fembar = FiniteElementFemBar(FiniteElement=getfemodel.FiniteElement)  # -> Identifier, ElementId, NodeI, NodeJ, LineGeometry
femnode = FiniteElementFemNode(FiniteElement=getfemodel.FiniteElement)  # -> NodeId, Point
panel_8 = Panel(fem_design_getcasecombresults.Connection)
panel_9 = Panel(fem_design_getcasecombresults.Results)
panel_10 = Panel(nodaldisplacement.ElementId)
panel_11 = Panel(fembar.ElementId)
panel_12 = Panel(femshell.ElementId)
panel_13 = Panel(getfemodel.Connection)
panel_14 = Panel(getfemodel.FiniteElement)
