# Grasshopper definition LoadCaseConstruct.gh (Grasshopper 1.0.7)
# plug-ins: FEM-Design, Tenrec

# ---- group: LoadCaseConstruct
list = ValueList({"ordinary", "dead_load", "soil_dead_load", "shrinkage", "prestressing", "fire", "seis_sxp", "seis_sxm", "seis_syp", "seis_sym"}, selected="ordinary")
list_2 = ValueList({"permanent", "long-term", "medium-term", "short-term", "instantaneous"}, selected="permanent")
construct = LoadCaseConstruct(Name="DL", Type=list, DurationClass=list_2)
deconstruct = LoadCaseDeconstruct(LoadCase=construct)  # -> Guid, Name, Type, DurationClass
python = GhPythonScript(x="DL", y=deconstruct.Name)  # -> out, a
# ---------- python: Python ----------
__author__ = "Marco"
__version__ = "2023.07.18"

import rhinoscriptsyntax as rs

if x == y:
    a = True
else:
    a = False
# ---------- end python ----------
assert = Assert(Assert=python.a, Message="Load case error!")

# ----
lng = ListLength(List=deconstruct.Type)
equals = Equality(FirstNumber=lng, SecondNumber="1")  # -> Equality, Inequality

# ---- group: LoadCaseConstruct (continued)
assert_2 = Assert(Assert=equals.Equality, Message="Load case error!")
