# Grasshopper definition TenrecTest.gh (Grasshopper 1.0.7)
# plug-ins: Tenrec, FEM-Design

# ---- group: RunLoadCaseAnalysis
pt = Point(Point(0, 0, 0))
default = MaterialDatabaseDefault(CountryCode="S")  # -> SteelMaterial, ConcreteMaterial, TimberMaterial, ReinforcementMaterial, StratumMaterial, CustomMaterial
default_2 = SectionDatabaseDefault()  # -> SteelSection, ConcreteSection, TimberSection, HollowCoreSection, CustomSection
X = UnitX(Factor=1)
item = ListItem(List=default.SteelMaterial, Index=0, Wrap=True)
item_2 = ListItem(List=default_2.SteelSection, Index=0, Wrap=True)
line = LineSDL(Start=pt, Direction=X, Length="6.0")
list = ValueList({"ordinary", "dead_load", "soil_dead_load", "shrinkage", "prestressing", "fire", "seis_sxp", "seis_sxm", "seis_syp", "seis_sym"}, selected="dead_load")
rigid = PointSupportRigid(PointPlane=pt, Identifier="S")
construct = LoadCaseConstruct(Name="DL", Type=list, DurationClass="permanent")
beam = BarsBeam(Curve=line, Material=item, Section=item_2, OrientLCS=True, Identifier="B")
construct_2 = ModelConstruct(CountryCode="S", StructureElements=flatten([rigid, beam]), LoadCases=construct)
resultstype = ResultsType({"NodalDisplacement", "NodalDisplacement", "PointSupportReaction", "PointSupportReactionMinMax", "PointConnectionForce", "BarDisplacement", "BarInternalForce", "BarStress", "LineSupportReaction", "LineConnectionResultant"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}, selected="PointSupportReaction")
analysis = AnalysisDefine(
    CalcCase=Toggle(True),
    CalcCstage=False,
    CalcImpf=False,
    CalcComb=Toggle(False),
    CalcGmax=False,
    CalcStab=False,
    CalcFreq=False,
    CalcSeis=False,
    CalcDesign=False,
    CalcFootfall=False,
    Elemfine=True,
    Diaphragm=False,
    PeakSmoothing=False)
runcalculation = ApplicationRunCalculation(Model=construct_2, Analysis=analysis, ResultTypes=resultstype, RunNode=Toggle(True))  # -> Model, FiniteElement, Results
item_3 = ListItem(List=runcalculation.Results, Index=0, Wrap=True)
null = NullItem(Item=item_3)  # -> NullFlags, InvalidFlags, Description
bool = Boolean(invert(null.NullFlags))
assert = Assert(Assert=bool, Message="Calculation Error!")

# ---- group: asserting_false
dist = Distance(PointA="0,0,0", PointB="3,0,0")
larger = LargerThan(FirstNumber=dist, SecondNumber="5")  # -> LargerThan, OrEqualTo
assert_2 = Assert(Assert=larger.LargerThan, Message="It doesn't look good")

# ---- group: Test_False
dist_2 = Distance(PointA="0,0,0", PointB="3,0,0")
larger_2 = LargerThan(FirstNumber=dist_2, SecondNumber="5")  # -> LargerThan, OrEqualTo
equals = Equality(FirstNumber=larger_2.LargerThan, SecondNumber="false")  # -> Equality, Inequality
assert_3 = Assert(Assert=equals.Equality, Message="It doesn't look good")

# ---- group: PointDistance
pt_2 = Point(Point(0, 0, 0))
pt_3 = Point(Point(0, 0, 0))
simple = PointSupportSimple(PointPlane=pt_3, Tx=True, Ty=True, Tz=True, Rx=True, Ry=True, Rz=True, Identifier="S")
deconstruct = SupportGroupDeconstruct(SupportGroup=simple)  # -> Guid, AnalyticalID, Geometry, MovingLocal, GroupLocalX, GroupLocalY, Motions, Rotations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
dist_3 = Distance(PointA=pt_2, PointB=deconstruct.Geometry)
smaller = SmallerThan(FirstNumber=dist_3, SecondNumber=0.001)  # -> SmallerThan, OrEqualTo
assert_4 = Assert(Assert=smaller.SmallerThan, Message="It looks good")

# ---- group: Test_true
dist_4 = Distance(PointA="0,0,0", PointB="3,0,0")
larger_3 = LargerThan(FirstNumber=dist_4, SecondNumber="1")  # -> LargerThan, OrEqualTo
assert_5 = Assert(Assert=larger_3.LargerThan, Message="It doesn't look good")
