# Grasshopper definition Create simple model.gh (Grasshopper 1.0.7)
# plug-ins: FemDesign.Grasshopper

# ----
# Use default sections/materials or your own database
panel = Panel("/StruSoft/FEM-Design Api/sectionLibrary/sections.struxml")
panel_2 = Panel("/StruSoft/FEM-Design Api/materialLibrary/materials_S.struxml")
appdata = AppData()  # -> Path
# ---------- appdata: C# ----------
    Path = Environment.GetFolderPath(Environment.SpecialFolder.ApplicationData);
# ---------- end appdata ----------
appdata_2 = AppData()  # -> Path; same code as appdata
concat = Concatenate(FragmentA=appdata, FragmentB=panel)
concat_2 = Concatenate(FragmentA=appdata_2, FragmentB=panel_2)
fromstruxml = SectionDatabaseFromStruxml(FilePath=concat)
default = MaterialDatabaseDefault(CountryCode="S")
fromstruxml_2 = MaterialDatabaseFromStruxml(FilePath=concat_2)
default_2 = SectionDatabaseDefault()

# ----
# Create a beam
panel_3 = Panel("Concrete sections, Rectangle, 300x900")
beam_centerline = Curve(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)
getmaterialbyname = MaterialGetMaterialByName(MaterialDatabase=fromstruxml_2, MaterialName="C35/45")
getsectionbyname = SectionGetSectionByName(SectionDatabase=fromstruxml, SectionName=panel_3)
beam = BarsBeam(Curve=beam_centerline, Material=getmaterialbyname, Section=getsectionbyname, OrientLCS=True, Identifier="B")

# ----
# Create supports
free = RotationsFree()
rigidpoint = RotationsRigidPoint()
rigidpoint_2 = MotionsRigidPoint()
rigidpoint_3 = MotionsRigidPoint()
end = EndPoints(Curve=beam_centerline)  # -> Start, End
define = PointSupportDefine(Point=end.Start, Motions=rigidpoint_2, Rotations=rigidpoint, Identifier="S")
define_2 = PointSupportDefine(Point=end.End, Motions=rigidpoint_3, Rotations=free, Identifier="S")

# ----
# Load Cases
panel_4 = Panel("static")
create = LoadCaseCreate(Name="Deadload", Type="dead_load", DurationClass="permanent")
create_2 = LoadCaseCreate(Name="Liveload", Type=panel_4, DurationClass="permanent")
merge = Merge(Data1=create, Data2=create_2)

merge_2 = Merge(Data1=beam, Data2=define, Data3=define_2)

# ----
# Load Combinations
panel_5 = Panel("serviceability_characteristic")
panel_6 = Panel("""1.0
1.0""")
panel_7 = Panel("""1.35
1.5""")
create_3 = LoadCombinationCreate(Name="SLS", Type=panel_5, LoadCase=merge, Gamma=panel_6)
create_4 = LoadCombinationCreate(Name="ULS", Type="ultimate_ordinary", LoadCase=merge, Gamma=panel_7)
merge_3 = Merge(Data1=create_3, Data2=create_4)

mydocuments = AppData()  # -> Path
# ---------- mydocuments: C# ----------
    Path = Environment.GetFolderPath(Environment.SpecialFolder.MyDocuments);
# ---------- end mydocuments ----------
concat_3 = Concatenate(FragmentA=mydocuments, FragmentB="\simple_model.struxml")
save_path = Panel(concat_3)

# ----
# Point loads
number_slider = Slider(5, range=0..20)
Z = UnitZ(Factor=1)
curvepoint = PointOnCurve(beam_centerline, parameter=1)
curvepoint_2 = PointOnCurve(beam_centerline, parameter=0.5)
xprod = CrossProduct(VectorA=Z, VectorB=beam_centerline, Unitize=False)  # -> Vector, Length
Z_2 = UnitZ(Factor=expr("-x", number_slider))
force = PointLoadForce(Point=curvepoint_2, Force=Z_2, LoadCase=create_2)

amp = Amplitude(Vector=xprod.Vector, Amplitude=Slider(10, range=0..20))

moment = PointLoadMoment(Point=curvepoint, Moment=amp, LoadCase=create_2)
merge_4 = Merge(Data1=force, Data2=moment)

create_5 = ModelCreateSimple(CountryCode="S", StructureElements=merge_2, Loads=merge_4, LoadCases=merge, LoadCombinations=merge_3)
save = ModelSave(FdModel=create_5, FilePathStruxml=concat_3)
open = ModelOpen(FdModel=create_5, FilePathStruxml=concat_3, CloseOpenWindows=Toggle(True), RunNode=Toggle(True))
