# Grasshopper definition Example - bridge.gh (Grasshopper 1.0.7)
# plug-ins: FemDesign.Grasshopper

# ----
# Variables
width_extra_edge = Slider(6, range=1..50)
width_driving_lane = Slider(10, range=1..50)
axis_crossection_base_point = Point(Point(0, 0, 0))
height = Slider(4, range=1..50)
width_base = Slider(7, range=1..50)
width_support_points = Slider(5, range=1..50)
height_y_support = Slider(5, range=1..50)

# ----
# Method 3: Doubly curved axis (Start/end points, start/end tangents,
# and straight distance between ends)
start_tangent_x = Slider(-4, range=-20..20)
start_tangent_y = Slider(15, range=-20..20)
bridge_length = Slider(100, range=1..500)
start_tangent_z = Slider(4, range=-20..20)
end_tangent_x = Slider(-4, range=-20..20)
end_tangent_y = Slider(15, range=-20..20)
end_tangent_z = Slider(-3, range=-20..20)
vector_xyz = VectorXYZ(XComponent=start_tangent_x, YComponent=start_tangent_y, ZComponent=start_tangent_z)  # -> Vector, Length
vector_xyz_2 = VectorXYZ(XComponent=end_tangent_x, YComponent=end_tangent_y, ZComponent=end_tangent_z)  # -> Vector, Length
axis_crossection_base_point_2 = Point(axis_crossection_base_point)
unit_y = UnitY(Factor=bridge_length)
move = Move(Geometry=axis_crossection_base_point_2, Motion=unit_y)  # -> Geometry, Transform
biarc = BiArc(
    StartPoint=axis_crossection_base_point_2,
    StartTangent=vector_xyz.Vector,
    EndPoint=move.Geometry,
    EndTangent=vector_xyz_2.Vector,
    Ratio=0.5)  # -> FirstArc, SecondArc, BiArc
curve_middle = CurveMiddle(Curve=biarc.FirstArc)
deconstruct = Deconstruct(Point=curve_middle)  # -> XComponent, YComponent, ZComponent
get_data_from_me = Curve(biarc.BiArc)
rise_m = Panel(deconstruct.ZComponent)

# ----
# Method 1: straight line axis (start and end)
bridge_length_2 = Slider(100, range=1..500)
axis_crossection_base_point_3 = Point(axis_crossection_base_point)
unit_y_2 = UnitY(Factor=bridge_length_2)
# Creating the axis of the bridge
move_2 = Move(Geometry=axis_crossection_base_point_3, Motion=unit_y_2)  # -> Geometry, Transform
line = Line(StartPoint=axis_crossection_base_point_3, EndPoint=move_2.Geometry)

# ----
# Method 2: arch axis (start, end and midpoint height)
number_slider = Slider(10, range=0..20)
bridge_length_3 = Slider(100, range=1..500)
axis_crossection_base_point_4 = Point(axis_crossection_base_point)
unit_y_3 = UnitY(Factor=bridge_length_3)
vector_xyz_3 = VectorXYZ(XComponent=0, YComponent=expr("x/2", bridge_length_3), ZComponent=number_slider)  # -> Vector, Length
move_3 = Move(Geometry=axis_crossection_base_point_4, Motion=vector_xyz_3.Vector)  # -> Geometry, Transform
move_4 = Move(Geometry=axis_crossection_base_point_4, Motion=unit_y_3)  # -> Geometry, Transform
merge = Merge(Data1=axis_crossection_base_point_4, Data2=move_3.Geometry, Data3=move_4.Geometry)
nurbs_curve = NurbsCurve(Vertices=merge, Degree="2", Periodic=False)  # -> Curve, Length, Domain

# ----
# Ground surface
ground_surface = Surface(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)
preview = CustomPreview(Geometry=ground_surface, Material=ColourSwatch(SwatchColor=RGBA(0, 212, 255, 70)))

# ----
# Creating the crossection
unit_z = UnitZ(Factor=expr("-x", height))
unit_x = UnitX(Factor=width_driving_lane)
move_5 = Move(Geometry=axis_crossection_base_point, Motion=unit_x)  # -> Geometry, Transform
unit_x_2 = UnitX(Factor=width_extra_edge)
move_6 = Move(Geometry=axis_crossection_base_point, Motion=unit_z)  # -> Geometry, Transform
unit_x_3 = UnitX(Factor=width_base)
move_7 = Move(Geometry=move_5.Geometry, Motion=unit_x_2)  # -> Geometry, Transform
move_8 = Move(Geometry=move_6.Geometry, Motion=unit_x_3)  # -> Geometry, Transform
line_2 = Line(StartPoint=move_7.Geometry, EndPoint=move_5.Geometry)
line_3 = Line(StartPoint=move_5.Geometry, EndPoint=axis_crossection_base_point)
line_4 = Line(StartPoint=move_5.Geometry, EndPoint=move_8.Geometry)
line_5 = Line(StartPoint=move_8.Geometry, EndPoint=move_6.Geometry)

# ----
# Geometry
unit_x_4 = UnitX(Factor=width_support_points)
neg = Negative(Value=height_y_support)
Z = UnitZ(Factor=neg)
move_9 = Move(Geometry=move_6.Geometry, Motion=unit_x_4)  # -> Geometry, Transform
mirror = Mirror(Geometry=move_9.Geometry, Plane=PlaneYZ(0, 0, 0))  # -> Geometry, Transform
merge_2 = Merge(Data1=line_2, Data2=line_3, Data3=line_4, Data4=line_5)
merge_3 = Merge(Data1=move_9.Geometry, Data2=mirror.Geometry)
mirror_2 = Mirror(Geometry=line_4, Plane=PlaneYZ(0, 0, 0))  # -> Geometry, Transform
mirror_3 = Mirror(Geometry=merge_2, Plane=PlaneYZ(0, 0, 0))  # -> Geometry, Transform
mirror_4 = Mirror(Geometry=line_5, Plane=PlaneYZ(0, 0, 0))  # -> Geometry, Transform
mirror_5 = Mirror(Geometry=line_3, Plane=PlaneYZ(0, 0, 0))  # -> Geometry, Transform
mirror_6 = Mirror(Geometry=line_2, Plane=PlaneYZ(0, 0, 0))  # -> Geometry, Transform
merge_4 = Merge(Data1=merge_2, Data2=mirror_3.Geometry)
merge_5 = Merge(Data1=line_2, Data2=mirror_6.Geometry)
merge_6 = Merge(Data1=line_4, Data2=mirror_2.Geometry)
merge_7 = Merge(Data1=line_5, Data2=mirror_4.Geometry)
merge_8 = Merge(Data1=line_3, Data2=mirror_5.Geometry)
crosssection_side_lines = Line(merge_6)
crosssection_base_lines = Line(merge_7)
outer_road_lines = Line(merge_5)
inner_road_lines = Line(merge_8)

# ----
# Select your method by
# connecting to this container
bridge_axis_select_your_axis_method = Curve(get_data_from_me)

# ---- group: Warning: lower values means heavier calculations!
triangulation_length_avg = Slider(3.24, range=0.5..10)

# ----
# NEW: Creating the bridge volume and triangulating it
merge_9 = Merge(Data1=crosssection_side_lines, Data2=crosssection_base_lines)
axis_crossection_base_point_5 = Point(axis_crossection_base_point)
crossection = Curve(merge_9)
bridge_axis = Curve(bridge_axis_select_your_axis_method)
length = Length(Curve=bridge_axis)
division = Division(A=length, B=triangulation_length_avg)
round = Round(Number=division)  # -> Nearest, Floor, Ceiling
length_2 = Length(Curve=crossection)
divide_curve = DivideCurve(Curve=bridge_axis, Count=round.Floor, Kinks=False)  # -> graft(Points), graft(Tangents), Parameters
number_of_segments_lenghwise = Panel(round.Floor)
division_2 = Division(A=length_2, B=triangulation_length_avg)
Z_2 = UnitZ(Factor=1)
round_2 = Round(Number=division_2)  # -> Nearest, Floor, Ceiling
vector_display = VectorDisplay(Anchor=divide_curve.Points, Vector=divide_curve.Tangents)
xprod = CrossProduct(VectorA=divide_curve.Tangents, VectorB=Z_2, Unitize=False)  # -> Vector, Length
number_of_segments_across = Panel(round_2.Floor)
pylon_support_points = Point(merge_3)
pl = ConstructPlane(Origin=divide_curve.Points, XAxis=xprod.Vector, YAxis=Z_2)
xz = XZPlane(Origin=axis_crossection_base_point_5)
orient = Orient(Geometry=crossection, Source=xz, Target=pl)  # -> Geometry, Transform
orient_2 = Orient(Geometry=pylon_support_points, Source=xz, Target=pl)  # -> Geometry, Transform
divide_curve_2 = DivideCurve(Curve=orient.Geometry, Count=round_2.Floor, Kinks=False)  # -> Points, Tangents, Parameters
toggle = BooleanToggle(False)
shift_list = ShiftList(List=divide_curve_2.Points, Shift="1", Wrap=toggle)
shift_list_2 = ShiftList(List=divide_curve_2.Points, Shift="-1", Wrap=toggle)
pshift = ShiftPaths(Data=shift_list, Offset=-1)
pshift_2 = ShiftPaths(Data=shift_list_2, Offset=-1)
toggle_2 = BooleanToggle(False)
relative_item = RelativeItem(Tree=pshift, Offset="{0;0;-1;0}", WrapPaths=toggle_2, WrapItems=toggle)  # -> ItemA, ItemB
relative_item_2 = RelativeItem(Tree=pshift_2, Offset="{0;0;+1;0}", WrapPaths=toggle_2, WrapItems=toggle)  # -> ItemA, ItemB
_4point_surface = _4PointSurface(CornerA=relative_item.ItemB, CornerB=relative_item_2.ItemA, CornerC=relative_item_2.ItemB)
_4point_surface_2 = _4PointSurface(CornerA=relative_item.ItemA, CornerB=relative_item.ItemB, CornerC=relative_item_2.ItemB)
pshift_3 = ShiftPaths(Data=_4point_surface, Offset=-1)
pshift_4 = ShiftPaths(Data=_4point_surface_2, Offset=-1)
merge_10 = Merge(Data1=pshift_4, Data2=pshift_3)

# ---- group: Warning: lower values means heavier calculations!
triangulation_length_avg_2 = Slider(3.24, range=0.5..10)

# ----
# NEW: Creating the bridge volume and triangulating it
merge_11 = Merge(Data1=outer_road_lines, Data2=inner_road_lines)
axis_crossection_base_point_6 = Point(axis_crossection_base_point)
crossection_2 = Curve(merge_11)
bridge_axis_2 = Curve(bridge_axis_select_your_axis_method)
length_3 = Length(Curve=bridge_axis_2)
division_3 = Division(A=length_3, B=triangulation_length_avg_2)
round_3 = Round(Number=division_3)  # -> Nearest, Floor, Ceiling
length_4 = Length(Curve=crossection_2)
divide_curve_3 = DivideCurve(Curve=bridge_axis_2, Count=round_3.Floor, Kinks=False)  # -> graft(Points), graft(Tangents), Parameters
number_of_segments_lenghwise_2 = Panel(round_3.Floor)
division_4 = Division(A=length_4, B=triangulation_length_avg_2)
Z_3 = UnitZ(Factor=1)
round_4 = Round(Number=division_4)  # -> Nearest, Floor, Ceiling
vector_display_2 = VectorDisplay(Anchor=divide_curve_3.Points, Vector=divide_curve_3.Tangents)
xprod_2 = CrossProduct(VectorA=divide_curve_3.Tangents, VectorB=Z_3, Unitize=False)  # -> Vector, Length
number_of_segments_across_2 = Panel(round_4.Floor)
pylon_support_points_2 = Point(merge_3)
pl_2 = ConstructPlane(Origin=divide_curve_3.Points, XAxis=xprod_2.Vector, YAxis=Z_3)
xz_2 = XZPlane(Origin=axis_crossection_base_point_6)
orient_3 = Orient(Geometry=crossection_2, Source=xz_2, Target=pl_2)  # -> Geometry, Transform
orient_4 = Orient(Geometry=pylon_support_points_2, Source=xz_2, Target=pl_2)  # -> Geometry, Transform
divide_curve_4 = DivideCurve(Curve=orient_3.Geometry, Count=round_4.Floor, Kinks=False)  # -> Points, Tangents, Parameters
loft = Loft(
    Curves=orient_3.Geometry,
    Options={Adjust=False, Closed=False, LoftEnds=0, LoftSimp=0, LoftType=3, Rebuild=10, Refit=0.01})
toggle_3 = BooleanToggle(False)
shift_list_3 = ShiftList(List=divide_curve_4.Points, Shift="1", Wrap=toggle_3)
shift_list_4 = ShiftList(List=divide_curve_4.Points, Shift="-1", Wrap=toggle_3)
pshift_5 = ShiftPaths(Data=shift_list_3, Offset=-1)
pshift_6 = ShiftPaths(Data=shift_list_4, Offset=-1)
toggle_4 = BooleanToggle(False)
relative_item_3 = RelativeItem(Tree=pshift_5, Offset="{0;0;-1;0}", WrapPaths=toggle_4, WrapItems=toggle_3)  # -> ItemA, ItemB
relative_item_4 = RelativeItem(Tree=pshift_6, Offset="{0;0;+1;0}", WrapPaths=toggle_4, WrapItems=toggle_3)  # -> ItemA, ItemB
_4point_surface_3 = _4PointSurface(CornerA=relative_item_3.ItemB, CornerB=relative_item_4.ItemA, CornerC=relative_item_4.ItemB)
_4point_surface_4 = _4PointSurface(CornerA=relative_item_3.ItemA, CornerB=relative_item_3.ItemB, CornerC=relative_item_4.ItemB)
pshift_7 = ShiftPaths(Data=_4point_surface_3, Offset=-1)
pshift_8 = ShiftPaths(Data=_4point_surface_4, Offset=-1)
merge_12 = Merge(Data1=pshift_8, Data2=pshift_7)

# ----
# Method 2: Explicit length from bridge start
panel = Panel("""0
10
25""")
bridge_axis_3 = Curve(reparameterize(bridge_axis_select_your_axis_method))
length_5 = Length(Curve=bridge_axis_3)
remap_numbers = RemapNumbers(Value=panel, Source=length_5, Target=Domain(0, 1))  # -> Mapped, Clipped
evaluate_curve = EvaluateCurve(Curve=reparameterize(bridge_axis_3), Parameter=remap_numbers.Mapped)  # -> Point, Tangent, Angle

# ----
# Method 1: relative length along bridge axis
panel_2 = Panel("""0
0.2
0.8
1""")
bridge_axis_4 = Curve(bridge_axis_select_your_axis_method)
evaluate_curve_2 = EvaluateCurve(Curve=reparameterize(bridge_axis_4), Parameter=panel_2)  # -> Point, Tangent, Angle

# ----
# Select your method by
# connecting to this container
points_on_curve_pick_your_point_method = Point(evaluate_curve_2.Point)

# ----
# Defining load cases
panel_3 = Panel("Liveload")
loadcase_create = LoadCaseCreate(Name=panel_3, Type="static", DurationClass="permanent")
loadcase_create_2 = LoadCaseCreate(Name="Deadload", Type="dead_load", DurationClass="permanent")
merge_13 = Merge(Data1=loadcase_create, Data2=loadcase_create_2)

# ----
# Creating supports
# Support reference points
move_10 = Move(Geometry=points_on_curve_pick_your_point_method, Motion=unit_z)  # -> Geometry, Transform
cps = ClosestPoints(Point=graft(move_10.Geometry), Cloud=flatten(orient_2.Geometry), Count=2)  # -> ClosestPoint, CPIndex, Distance
pylon_support_points_3 = Point(cps.ClosestPoint)

# ----
# For visualisation only -
# no output from here!
loft_2 = Loft(Curves=orient.Geometry, Options={Adjust=False, Closed=False, LoftEnds=0, LoftSimp=0, LoftType=3, Rebuild=10, Refit=0.01})

item = ListItem(List=pylon_support_points_3, Index=0, Wrap=False)  # -> Item, Item1
avr = Average(Input=pylon_support_points_3)
move_11 = Move(Geometry=avr, Motion=Z)  # -> Geometry, Transform
ground_surface_2 = Surface(ground_surface)
Z_4 = UnitZ(Factor=-1)
ln = Line(StartPoint=item.Item, EndPoint=move_11.Geometry)
ln_2 = Line(StartPoint=item.Item1, EndPoint=move_11.Geometry)
project = ProjectPoint(Point=move_11.Geometry, Direction=Z_4, Geometry=ground_surface_2)  # -> Point, Index
merge_14 = Merge(Data1=ln, Data2=ln_2)
ln_3 = Line(StartPoint=move_11.Geometry, EndPoint=project.Point)
pylon_arms = Curve(merge_14)
pylon_base = Curve(ln_3)

# ----
# Defining loads
road_surfaces = Surface(simplify(merge_12))
unit_z_2 = UnitZ(Factor=expr("-x", Slider(10, range=1..100)))
unit_z_3 = UnitZ(Factor=expr("-x", Slider(20, range=0..100)))
load_case_liveload = Data(loadcase_create)
load_case_deadload = Data(loadcase_create_2)
surfaceload_uniform = SurfaceLoadUniform(Surface=road_surfaces, Force=unit_z_2, LoadCase=load_case_liveload)
surfaceload_uniform_2 = SurfaceLoadUniform(Surface=road_surfaces, Force=unit_z_3, LoadCase=load_case_deadload)
merge_15 = Merge(Data1=surfaceload_uniform, Data2=surfaceload_uniform_2)

# ----
# Defining load combinations
panel_4 = Panel("serviceability_characteristic")
panel_5 = Panel("""1.35
1.5""")
panel_6 = Panel("""1.0
1.0""")
loadcombination_create = LoadCombinationCreate(Name="SLS", Type=panel_4, LoadCase=merge_13, Gamma=panel_6)
loadcombination_create_2 = LoadCombinationCreate(Name="ULS", Type="ultimate_ordinary", LoadCase=merge_13, Gamma=panel_5)
merge_16 = Merge(Data1=loadcombination_create, Data2=loadcombination_create_2)

# ----
# Sections and Material databases
panel_7 = Panel("S")
materialdatabase_default = MaterialDatabaseDefault(CountryCode=panel_7)
default = SectionDatabaseDefault()

panel_8 = Panel("Concrete sections, Circle, D 1200")
getsectionbyname = SectionGetSectionByName(SectionDatabase=default, SectionName=panel_8)
getsectionbyname_2 = SectionGetSectionByName(SectionDatabase=default, SectionName=["Concrete sections, Circle, D 500", panel_8])
material_getmaterialbyname = MaterialGetMaterialByName(MaterialDatabase=materialdatabase_default, MaterialName="C25/30")
beam = BarsBeam(Curve=pylon_arms, Material=material_getmaterialbyname, Section=getsectionbyname_2, OrientLCS=True, Identifier="B")
beam_2 = BarsBeam(Curve=pylon_base, Material=material_getmaterialbyname, Section=getsectionbyname, OrientLCS=True, Identifier="B")
merge_17 = Merge(Data1=beam, Data2=beam_2)

# ----
# Constructing element
merge_18 = Merge(Data1=merge_12, Data2=merge_10)
material_getmaterialbyname_2 = MaterialGetMaterialByName(MaterialDatabase=materialdatabase_default, MaterialName="C25/30")
fem_design_mesh_size = Slider(0.8, range=0..1)
slab_plate = SlabPlate(Surface=merge_18, Thickness=Slider(0.5, range=0.1..1), Material=material_getmaterialbyname_2, Identifier="P")
slab_averagesurfaceelementsize = SlabAverageSurfaceElementSize(Slab=slab_plate, AverageSurfaceElementSize=fem_design_mesh_size)

# ----
# Support conditions
panel_9 = Panel("10^7")
panel_10 = Panel("0")
rotations_define = RotationsDefine(X_neg="0", X_pos="0", Y_neg="0", Y_pos="0", Z_neg="0", Z_pos="0")
motions_define = MotionsDefine(X_neg="10^7", X_pos="10^7", Y_neg="10^7", Y_pos="10^7", Z_neg="10^7", Z_pos="10^7")
pointsupport_define = PointSupportDefine(Point=project.Point, Motions=motions_define, Rotations=rotations_define, Identifier="S")

# ----
# Create final model
bridge_surfaces = Data(flatten(slab_averagesurfaceelementsize))
supports = Data(flatten(pointsupport_define))
pylons = Data(flatten(merge_17))
loads = Data(flatten(merge_15))
load_cases = Data(merge_13)
load_combinations = Data(merge_16)
countrycode_d_dk_est_fin_gb_h_n_pl_ro_s = Panel("S")  # "Countrycode (D/DK/EST/FIN/GB/H/N/PL/RO/S/TR)"
model_createsimple = ModelCreateSimple(
    CountryCode=countrycode_d_dk_est_fin_gb_h_n_pl_ro_s,
    StructureElements=[supports, bridge_surfaces, pylons],
    Loads=loads,
    LoadCases=load_cases,
    LoadCombinations=load_combinations)

# ----
# Analysis settings
panel_11 = Panel("true")
# Open model and run analysis
analysis_define = AnalysisDefine(
    CalcCase=panel_11,
    CalcCstage=False,
    CalcImpf=False,
    CalcComb=panel_11,
    CalcGmax=False,
    CalcStab=False,
    CalcFreq=False,
    CalcSeis=False,
    CalcDesign=False,
    CalcFootfall=False,
    Elemfine=False,
    Diaphragm=False,
    PeakSmoothing=False)

file_name_end_with_struxml = Panel("bridge_analysis.struxml")
press_to_open_model_in_fem_design_and_ru = Button()  # "Press to open model in FEM-Design and run analysis:"
close_all_open_fem_design_windows_when_r = BooleanToggle(True)  # "Close all open FEM-Design windows when running?"
directory = FilePath("C:\Temp\")
close_fem_design_window_after_analysis_i = BooleanToggle(False)  # "Close FEM-Design window after analysis is done?"
concatenate = Concatenate(FragmentA=directory, FragmentB=file_name_end_with_struxml)
resulting_file_path = Panel(concatenate)
analysis_settings = Data(analysis_define)
model = Data(model_createsimple)
application_runanalysis = ApplicationRunAnalysis(
    FdModel=model,
    FilePathStruxml=concatenate,
    Analysis=analysis_settings,
    EndSession=close_fem_design_window_after_analysis_i,
    CloseOpenWindows=close_all_open_fem_design_windows_when_r,
    RunNode=press_to_open_model_in_fem_design_and_ru)

# ----
# Open model in FEM-Design
press_to_open_model_in_fem_design_and_ru_2 = Button()  # "Press to open model in FEM-Design and run analysis:"
close_all_open_fem_design_windows_when_r_2 = BooleanToggle(True)  # "Close all open FEM-Design windows when running?"
model_open = ModelOpen(
    FdModel=model_createsimple,
    FilePathStruxml=concatenate,
    CloseOpenWindows=close_all_open_fem_design_windows_when_r_2,
    RunNode=press_to_open_model_in_fem_design_and_ru_2)
