# Grasshopper definition Example 1 - Creating a simple beam.gh (Grasshopper 1.0.7)
# plug-ins: FemDesign.Grasshopper

# ---- group: Database: Materials
# 0. Open databases for materials and sections
# FEM-Design uses the standardized database for materials and sections.
# Using the associated components will allow you to call predefined materials
# and sections for your model.
# 
# If you want to get an overview of all available items in the database,
# the ListMaterialNames / ListSectionNames components lets you display
# the entire list in a separate panel.
countrycode_d_dk_est_fin_gb_h_n_pl_ro_s = Panel("S")  # "Countrycode (D/DK/EST/FIN/GB/H/N/PL/RO/S/TR)"
# NEW TO GRASSHOPPER?
# 
# If this is your first time using Grasshopper, we recommend that you check out the tutorial
# files supplied by Grasshopper. These are found in the menu bar under Help -> Tutorial files.
# USER ADVICE:
# 
# •  If you hover over any input or output node with your cursor, you can see what sort of data
#    is expected to go in or out of said node, as well as what the node currently contains. Some
#    nodes are never really empty, but contain a default value instead.
# 
# •  You can also hover over the middle of the component to see what it is called and read a
#    short description of its function.
# 
# • By pressing CTRL+ALT+Left mouse buttons on a component, Grasshopper will show you
#    where the component is located in the menus.
# 
# Use these tips to familiarize yourself with the components in these examples!
materialdatabase_default = MaterialDatabaseDefault(CountryCode=countrycode_d_dk_est_fin_gb_h_n_pl_ro_s)
materialdatabase_listmaterialnames = MaterialDatabaseListMaterialNames(MaterialDatabase=materialdatabase_default)
material_names = Panel(materialdatabase_listmaterialnames)

# ---- group: Database: sections
sectiondatabase_default = SectionDatabaseDefault()
sectiondatabase_listsectionnames = SectionDatabaseListSectionNames(SectionDatabase=sectiondatabase_default)
section_names = Panel(sectiondatabase_listsectionnames)

# ----
# 1. Constructing the beam
# The minimum requirements for the beam component is a curve
# for the beam to follow, a crossection to complete the geometry,
# and a constituting material.
panel = Panel("Concrete sections, Rectangle, 400x500")
material_getmaterialbyname = MaterialGetMaterialByName(MaterialDatabase=materialdatabase_default, MaterialName="C20/25")
section_getsectionbyname = SectionGetSectionByName(SectionDatabase=sectiondatabase_default, SectionName=panel)
identifier = Panel("Example_Beam")
beam_center_line = Curve(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)
bars_beam = BarsBeam(
    Curve=beam_center_line,
    Material=material_getmaterialbyname,
    Section=section_getsectionbyname,
    OrientLCS=True,
    Identifier=identifier)

# ----
# 3. Defining load cases
# The load cases are used both in the final model,
# but also as variables when creating the loads
# and the load combinations.
panel_2 = Panel("dead_load")
loadcase_create = LoadCaseCreate(Name="Deadload", Type=panel_2, DurationClass="permanent")
loadcase_create_2 = LoadCaseCreate(Name="Liveload", Type="static", DurationClass="permanent")
merge = Merge(Data1=loadcase_create, Data2=loadcase_create_2)

# ----
# Example 1: Modelling a simple beam
# This example will show you how to model a simple supported beam,
# and how to save it for export to FEM-Design. Before running,
# make sure you have a window with FEM-Design open.
info = Info()

# ----
# 2. Defining the supports
# The PointSupport component allows you to specify the support conditions yourself,
# using a define component for motion and/or rotation.
# 
# For completely free or rigid settings, there are pre-set components you can use.
# Please note that the rigidpoint and rigidline components differ in default stiffness;
# this is consistent with the FEM-Design implementation.
beam_center_line_2 = Curve(beam_center_line)
end_points = EndPoints(Curve=beam_center_line_2)  # -> Start, End
default_value_for_a_rigid_point = Panel("10^7")
motions_define = MotionsDefine(
    X_neg=default_value_for_a_rigid_point,
    X_pos=default_value_for_a_rigid_point,
    Y_neg=default_value_for_a_rigid_point,
    Y_pos=default_value_for_a_rigid_point,
    Z_neg=default_value_for_a_rigid_point,
    Z_pos=default_value_for_a_rigid_point)
rotations_rigidpoint = RotationsRigidPoint()
motions_rigidpoint = MotionsRigidPoint()
rotations_free = RotationsFree()
pointsupport_define = PointSupportDefine(Point=end_points.End, Motions=motions_define, Rotations=rotations_free, Identifier="S")
pointsupport_define_2 = PointSupportDefine(Point=end_points.Start, Motions=motions_rigidpoint, Rotations=rotations_rigidpoint, Identifier="S")
merge_2 = Merge(Data1=pointsupport_define_2, Data2=pointsupport_define)

# ----
# 4. Applying loads
# In this example, two forces are applied: one vertically at the middle of the beam,
# and one horizontally at the end of the beam. You can find components for moment,
# line loads, and more in the Loads tab.
load_case_liveload = Data(loadcase_create_2)
beam_center_line_3 = Curve(beam_center_line)
unit_z = UnitZ(Factor=1)
# Tip! By doubleclicking a Grasshopper information wire,
# you add a relay to it. The wire will pass through this relay
# on its way from one component to the next, no matter where
# you put it. It's a convenient way to avoid tangling your wires
# unnecessarily, making your script easier to follow.
number_slider = Slider(10, range=0..20)
cross_product = CrossProduct(VectorA=beam_center_line_3, VectorB=unit_z, Unitize=False)  # -> Vector, Length
unit_z_2 = UnitZ(Factor=expr("-x", Slider(5, range=0..20)))
amplitude = Amplitude(Vector=cross_product.Vector, Amplitude=number_slider)
point_on_curve = PointOnCurve(beam_center_line_3, parameter=0.5)
point_on_curve_2 = PointOnCurve(beam_center_line_3, parameter=0.75)
pointload_force = PointLoadForce(Point=point_on_curve, Force=unit_z_2, LoadCase=load_case_liveload)
pointload_force_2 = PointLoadForce(Point=point_on_curve_2, Force=amplitude, LoadCase=load_case_liveload)
merge_3 = Merge(Data1=pointload_force, Data2=pointload_force_2)

# ----
# 5. Creating load combinations
# The load combinations have to be created from tabular values.
panel_3 = Panel("serviceability_characteristic")
panel_4 = Panel("""1.35
1.5""")
panel_5 = Panel("""1.0
1.0""")
loadcombination_create = LoadCombinationCreate(Name="ULS", Type="ultimate_ordinary", LoadCase=merge, Gamma=panel_4)
loadcombination_create_2 = LoadCombinationCreate(Name="SLS", Type=panel_3, LoadCase=merge, Gamma=panel_5)
merge_4 = Merge(Data1=loadcombination_create_2, Data2=loadcombination_create)

# ----
# 6. Creating the model
# Loads, Load cases and Load combinations all have their own
# input, while the Beam and the Supports both count as elements.
# Remember to use the same country code as before!
supports = Data(merge_2)
beam_element = Data(bars_beam)
load_cases = Data(merge)
countrycode_d_dk_est_fin_gb_h_n_pl_ro_s_2 = Panel("S")  # "Countrycode (D/DK/EST/FIN/GB/H/N/PL/RO/S/TR)"
loads = Data(merge_3)
load_combinations = Data(merge_4)
model_createsimple = ModelCreateSimple(
    CountryCode=countrycode_d_dk_est_fin_gb_h_n_pl_ro_s_2,
    StructureElements=[beam_element, supports],
    Loads=loads,
    LoadCases=load_cases,
    LoadCombinations=load_combinations)

# ----
# 7. Create a directory for your file
# You can either choose to save your file in your current directory,
# or select your own separate folder. If you'd choose the latter,
# simply rightclick the directory component and choose "select a
# directory". Finally, edit the file name panel to give your file a name.
# Remember to end it with .struxml .
use_file_path_from = ValueList({"current directory": 0, "user defined folder": 1}, selected="user defined folder")
current_directory = GhPythonScript()  # -> Current_directory
# ---------- current_directory: Python ----------
import rhinoscriptsyntax as rs

folder = rs.DocumentPath()
# ---------- end current_directory ----------
user_defined_folder = FilePath("C:\Users\SamuelNyberg\OneDrive - StruSoft AB\Samuels arbetshörna\2. API-exempel\")
file_name_end_with_struxml = Panel("Example_bridge.struxml")
stream_filter = StreamFilter(Gate=use_file_path_from, Stream0=current_directory, Stream1=user_defined_folder)
concatenate = Concatenate(FragmentA=stream_filter, FragmentB=file_name_end_with_struxml)

resulting_file_path = Panel(concatenate)

# ----
# 8b. ...or open it in FEM-Design
# If you want, you can call FEM-Design from the script,
# to immediately open your new model.
press_to_run_open_model_in_fem_design = Button()
close_all_open_fem_design_windows = BooleanToggle(True)
file_path = Data(concatenate)
model_open = ModelOpen(
    FdModel=model_createsimple,
    FilePathStruxml=file_path,
    CloseOpenWindows=close_all_open_fem_design_windows,
    RunNode=press_to_run_open_model_in_fem_design)

# ----
# 8a. Save the model...
# Once you have set a proper file path,
# this script is set up to save your model
# as soon as it finished running.
file_path_2 = Data(concatenate)
model_save = ModelSave(FdModel=model_createsimple, FilePathStruxml=file_path_2)
