# Grasshopper definition Example 4 - Deconstructing, editing, and reconstructing a model.gh (Grasshopper 1.0.7)
# plug-ins: FemDesign.Grasshopper

# ----
# USER ADVICE:
# 
# •  If you hover over any input or output node with your cursor, you can see what sort of data
#    is expected to go in or out of said node, as well as what the node currently contains. Some
#    nodes are never really empty, but contain a default value instead.
# 
# •  You can also hover over the middle of the component to see what it is called and read a
#    short description of its function.
# 
# • By pressing CTRL+ALT+Left mouse buttons on a component, Grasshopper will show you
#    where the component is located in the menus.
# 
# Use these tips to familiarize yourself with the components in these examples!
# Part 1: Basic deconstruction functionalities
# In this first part, you can familiarize yourself with the .Deconstruct components,
# and the different tools you have at your disposal when looking at a model in Grasshopper.
# 1. Reading a model
# Using a Read File component, you can select a .str or .struxml file to
# read. Run the file into either the Model.Readstruxml or Model.Readstr
# components, and your model is ready to be utilized in Grasshopper.
# 
# For this example, we have provided a model for you to use called
# "Example 4 - model". But we encourage you to load any
# similar model of yours into the script and test it!
# File goes here!
right_click_and_choose_your_file = FilePath()

# ----
# Part 2: Editing and rebuilding a model
# In this second part, we'll showcase a typical work flow utilizing the .Deconstruct components.
# This script lets you isolate one floor of a building, reducing all pillars and walls to point- and
# line supports and removing all unrelated loads, to be ready for separate analysis.
resulting_filepath = Panel(right_click_and_choose_your_file)
model_readstruxml = ModelReadStruxml(FilePathStruxml=right_click_and_choose_your_file)
model_readstr = ModelReadStr(FilePathStr=right_click_and_choose_your_file)  # -> FdModel, HasExited
# 2. Deconstructing the model
# The Model.Deconstruct component breaks up the model
# into its elements, for separate use. You can hover over each
# output node to see what this model contains.
model_deconstruct = ModelDeconstruct(FdModel=model_readstr.FdModel)  # -> CountryCode, Bars, FictitiousBars, Shells, FictitiousShells, Diaphragms, Panels, Covers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

# ----
# Example 4: Deconstructing and editing a model
# This example will showcase how you can load an existing FEM-Design model, and
# deconstruct it to analyse every element and their properties within the Grasshopper
# environment. It will also showcase how you can deconstruct, edit and reassemble
# a model, and send it back to FEM-Design.
info = Info()

# ----
# 3b. Sorting similar elements
# Some outputs, like Loads and Supports, delivers every element
# in one long list. There are associated sorting components for these,
# so you can single out a certain typ of support for further use.
loads_sortloads = LoadsSortLoads(Loads=model_deconstruct.Loads)  # -> PointLoad, LineLoad, LineStressLoad, LineTemperatureLoad, SurfaceLoad, SurfaceTemperatureLoad, PressureLoad, FootfallLoads
supports_sortsupports = SupportsSortSupports(Supports=model_deconstruct.Supports)  # -> PointSupport, LineSupport, SurfaceSupport

# ----
# Select storey here
selected_storey = Slider(1, range=1..7)
tolerance_m = Slider(0.3, range=0..1)

# ----
# 3. Deconstructing the elements
# Most elements from the model has the FemDesign. prefix,
# and cannot be immediately altered in Grasshopper. Instead,
# they must first be further taken apart with their own associated
# .Deconstruct component, breaking them up into their properties.
bars_deconstruct = BarsDeconstruct(Bar=model_deconstruct.Bars)  # -> Guid, Curve, Type, Material, Section, Connectivity, Eccentricity, LocalY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
support_deconstruct = SupportDeconstruct(Support=supports_sortsupports.PointSupport)  # -> Guid, AnalyticalID, Geometry, MovingLocal, LocalX, LocalY, Motions, Rotations, PlasticLimitsForcesMotions, PlasticLimitsForcesRotations
# 3. Deconstructing properties
# Some properties of the elements needs another deconstruction
# to be fully usable. Just like with elements, there are associated
# .Deconstruct components for each of these.
# To summarize: we have opened a file, found all pillars in it,
# and ended up with a full list of the materials of every pilllar,
# which can be seen above.
# 
# If we wanted to, we could edit this list, rebuild the model,
# and load it into FEM-Design, and all pillars would then
# have the edited material properties.
material_deconstruct = MaterialDeconstruct(Material=bars_deconstruct.Material)  # -> Guid, Standard, Country, Name
support_column_materials = Panel(material_deconstruct.Name)

# ----
# If you only want to add an element to a model...
# ...there is the Model.AddElements component, which works the same as the Model.Create,
# except it reads an existing model and adds elements on top of it, instead of creating it from
# the ground up. Notice the Overwrite input, which allows you to replace elements in the model
# by adding a new one with the same GUID.
model_addelements = ModelAddElements(Overwrite=False)

# ----
# 9. Create a directory for your file
# You can either choose to save your file in your current directory,
# or select your own separate folder. If you'd choose the latter,
# simply rightclick the directory component and choose "select a
# directory". Finally, edit the file name panel to give your file a name.
# Remember to end it with .struxml .
use_file_path_from = ValueList({"current directory": 0, "user defined folder": 1}, selected="current directory")
current_directory = GhPythonScript()  # -> folder
# ---------- current_directory: Python ----------
import rhinoscriptsyntax as rs

folder = rs.DocumentPath()
# ---------- end current_directory ----------
user_defined_folder = FilePath("C:\Users\SamuelNyberg\OneDrive - StruSoft AB\Samuels arbetshörna\2. API-exempel\")
file_name_end_with_struxml = Panel("Example 4 - edited model.struxml")
stream_filter = StreamFilter(Gate=use_file_path_from, Stream0=current_directory, Stream1=user_defined_folder)
concatenate = Concatenate(FragmentA=stream_filter, FragmentB=file_name_end_with_struxml)

resulting_file_path = Panel(concatenate)
file_path = Data(concatenate)

# ----
# 1. Reading and deconstructing a model
# For this example, we'll need:
# - The storeys, to select ours from
# - The pillars, found in Bars
# - The walls, found in Shells and Panels
# - The floor, also found in Shells and Panels
# - The load cases and load combinations
# - The loads on the building
# - The country code, to make sure the two models read the same.
right_click_and_choose_your_file_2 = FilePath()
resulting_filepath_2 = Panel(right_click_and_choose_your_file_2)

model_readstr_2 = ModelReadStr(FilePathStr=right_click_and_choose_your_file_2)  # -> FdModel, HasExited

model_deconstruct_2 = ModelDeconstruct(FdModel=model_readstr_2.FdModel)  # -> CountryCode, Bars, FictitiousBars, Shells, FictitiousShells, Diaphragms, Panels, Covers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

panels_from_original_model = Data(model_deconstruct_2.Panels)
panel_deconstruct = PanelDeconstruct(Panel=panels_from_original_model)  # -> Guid, ExtSurface, Material, Section, ExtEdgeCurves, ExtEdgeConnections, LocalX, LocalY, Identifier
area = Area(Geometry=panel_deconstruct.ExtSurface)  # -> Area, Centroid
evaluate_surface = EvaluateSurface(Surface=panel_deconstruct.ExtSurface, Point=area.Centroid)  # -> Point, Normal, UDirection, VDirection, Frame
unit_z = UnitZ(Factor=1)
dot_product = DotProduct(VectorA=evaluate_surface.Normal, VectorB=unit_z, Unitize=False)
dispatch = Dispatch(List=panels_from_original_model, DispatchPattern=invert(dot_product))  # -> ListA, ListB
floors_horizontal_panels = Data(dispatch.ListB)
walls_vertical_panels = Data(dispatch.ListA)

slabs_from_original_model = Data(model_deconstruct_2.Shells)
slab_deconstruct = SlabDeconstruct(Slab=slabs_from_original_model)  # -> Guid, Surface, ThicknessItems, Material, ShellEccentricity, ShellOrthotropy, EdgeCurves, ShellEdgeConnections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
area_2 = Area(Geometry=slab_deconstruct.Surface)  # -> Area, Centroid
evaluate_surface_2 = EvaluateSurface(Surface=slab_deconstruct.Surface, Point=area_2.Centroid)  # -> Point, Normal, UDirection, VDirection, Frame
unit_z_2 = UnitZ(Factor=1)
dot_product_2 = DotProduct(VectorA=evaluate_surface_2.Normal, VectorB=unit_z_2, Unitize=False)
dispatch_2 = Dispatch(List=slabs_from_original_model, DispatchPattern=invert(dot_product_2))  # -> ListA, ListB
floors_horizontal_slabs = Data(dispatch_2.ListB)

# ----
# 7. Selecting the relevant loads
# Since only certain loads affect our storey, we must pick those out as well. The loads come in one big list,
# but by using the Loads.SortLoads component we can differentiate them by type. After that, the process
# is the same as before, using the forces z coordinate as the sorting criteria.
loads_sortloads_2 = LoadsSortLoads(Loads=model_deconstruct_2.Loads)  # -> PointLoad, LineLoad, LineStressLoad, LineTemperatureLoad, SurfaceLoad, SurfaceTemperatureLoad, PressureLoad, FootfallLoads

# ----
# Country code, load cases and load combinations
# can be used as they are, and are taken directly
# from the old model to the new.
load_combinations = Data(model_deconstruct_2.LoadCombinations)
country_code = Text(model_deconstruct_2.CountryCode)
loadcases = Data(model_deconstruct_2.LoadCases)

# ----
# 2. Selecting our storey
# To sort out the elements we need, we'll find the height of the floor we want and compare it to the height of
# the floors, walls and so on. We deconstruct the storeys to get their origo, single out the Z component, and
# add a error margin. We also single out our particular storey data, to keep in the final model.
# 
# You can use the sliders to select the storey and tolerance yourself. Our example model have seven storeys
# above ground level, so we limited the slider to seven; if your model has a greater number of storeys, remember
# to change the upper limit of this slider to access them all.
storeys = Data(model_deconstruct_2.Storeys)
storey_deconstruct = StoreyDeconstruct(Storey=storeys)  # -> Guid, Origo, Direction, DimensionX, DimensionY, Name
list_item = ListItem(List=storeys, Index=selected_storey, Wrap=True)
list_item_2 = ListItem(List=storey_deconstruct.Origo, Index=selected_storey, Wrap=True)
deconstruct = Deconstruct(Point=list_item_2)  # -> XComponent, YComponent, ZComponent
addition = Addition(A=deconstruct.ZComponent, B=tolerance_m)
subtraction = Subtraction(A=deconstruct.ZComponent, B=tolerance_m)
construct_domain = ConstructDomain(DomainStart=subtraction, DomainEnd=addition)
height_error_margin = Domain(construct_domain)
height_of_storey = Number(deconstruct.ZComponent)
storey = Data(list_item)

# ----
# 3. Finding pillars for point supports
# We can now find and isolate the elements we need for our particular floor, starting with the point supports. We deconstruct the
# pillars to get their curves, find their end points (where they connect to the roof), and check whether or not these points are within
# our height margin using the Includes component. This gives us a list of true/false values, which we can use in the Dispatch
# component as a template to single out the corresponding points.
# 
# This method is very handy when using only selected elements from a model, and will be used for all elements in this example.
bars_deconstruct_2 = BarsDeconstruct(Bar=model_deconstruct_2.Bars)  # -> Guid, Curve, Type, Material, Section, Connectivity, Eccentricity, LocalY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
end_points = EndPoints(Curve=bars_deconstruct_2.Curve)  # -> Start, End
deconstruct_2 = Deconstruct(Point=end_points.End)  # -> XComponent, YComponent, ZComponent
height_error_margin_2 = Domain(height_error_margin)
includes = Includes(Value=deconstruct_2.ZComponent, Domain=height_error_margin_2)  # -> Includes, Deviation
dispatch_3 = Dispatch(List=end_points.End, DispatchPattern=includes.Includes)  # -> ListA, ListB

surface_loads = Data(loads_sortloads_2.SurfaceLoad)
surfaceload_deconstruct = SurfaceLoadDeconstruct(SurfaceLoad=surface_loads)  # -> Guid, Type, Surface, Direction, Q1, Q2, Q3, LoadCaseGuid, Comment
area_3 = Area(Geometry=surfaceload_deconstruct.Surface)  # -> Area, Centroid
deconstruct_3 = Deconstruct(Point=area_3.Centroid)  # -> XComponent, YComponent, ZComponent
height_error_margin_3 = Domain(height_error_margin)
includes_2 = Includes(Value=deconstruct_3.ZComponent, Domain=height_error_margin_3)  # -> Includes, Deviation
dispatch_4 = Dispatch(List=surface_loads, DispatchPattern=includes_2.Includes)  # -> ListA, ListB

line_loads = Data(loads_sortloads_2.LineLoad)
lineload_deconstruct = LineLoadDeconstruct(LineLoad=line_loads)  # -> Guid, Type, Curve, Direction, Q1, Q2, LoadCaseGuid, Comment
curve_middle = CurveMiddle(Curve=lineload_deconstruct.Curve)
deconstruct_4 = Deconstruct(Point=curve_middle)  # -> XComponent, YComponent, ZComponent
height_error_margin_4 = Domain(height_error_margin)
includes_3 = Includes(Value=deconstruct_4.ZComponent, Domain=height_error_margin_4)  # -> Includes, Deviation
dispatch_5 = Dispatch(List=line_loads, DispatchPattern=includes_3.Includes)  # -> ListA, ListB

# ----
# 4. Sorting walls from floors
# Within the lists of slabs and panels there could be horizontal as well as vertical elements. Since the walls
# are to be utilized for supports but the floors kept as-is, they need to be separated. Instead of getting our
# dispatch pattern from the height, we can instead deconstruct the elements and find their normals, and
# use that to distinguish between floors and walls.
walls_vertical_slabs = Data(dispatch_2.ListA)

# ----
# 5.1. Limiting the selection of walls
# In this example, we will be using the edge curves of the walls as basis for the supports,
# more on that later. However, the walls below and above a floor both have edge curves
# intersecting with the floor, meaning we'd get double support lines. To prevent this, we
# remove all walls above the chosen storey from consideration.
slab_deconstruct_2 = SlabDeconstruct(Slab=walls_vertical_slabs)  # -> Guid, Surface, ThicknessItems, Material, ShellEccentricity, ShellOrthotropy, EdgeCurves, ShellEdgeConnections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
area_4 = Area(Geometry=slab_deconstruct_2.Surface)  # -> Area, Centroid
deconstruct_5 = Deconstruct(Point=area_4.Centroid)  # -> XComponent, YComponent, ZComponent
height_of_storey_2 = Number(height_of_storey)
larger_than = LargerThan(FirstNumber=height_of_storey_2, SecondNumber=deconstruct_5.ZComponent)  # -> LargerThan, OrEqualTo

panel_deconstruct_2 = PanelDeconstruct(Panel=walls_vertical_panels)  # -> Guid, ExtSurface, Material, Section, ExtEdgeCurves, ExtEdgeConnections, LocalX, LocalY, Identifier
area_5 = Area(Geometry=panel_deconstruct_2.ExtSurface)  # -> Area, Centroid
deconstruct_6 = Deconstruct(Point=area_5.Centroid)  # -> XComponent, YComponent, ZComponent
height_of_storey_3 = Number(height_of_storey)
larger_than_2 = LargerThan(FirstNumber=height_of_storey_3, SecondNumber=deconstruct_6.ZComponent)  # -> LargerThan, OrEqualTo

# ----
# 6. Selecting the floor
# The process for selecting the floor is familiar by now: find the centroid of the surface, check if it is within
# the height margin of our storey, and use the dispatch pattern to pick out the floor from the list.
floors_horizontal_slabs_2 = Data(floors_horizontal_slabs)
slab_deconstruct_3 = SlabDeconstruct(Slab=floors_horizontal_slabs_2)  # -> Guid, Surface, ThicknessItems, Material, ShellEccentricity, ShellOrthotropy, EdgeCurves, ShellEdgeConnections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
area_6 = Area(Geometry=slab_deconstruct_3.Surface)  # -> Area, Centroid
deconstruct_7 = Deconstruct(Point=area_6.Centroid)  # -> XComponent, YComponent, ZComponent
height_error_margin_5 = Domain(height_error_margin)
includes_4 = Includes(Value=deconstruct_7.ZComponent, Domain=height_error_margin_5)  # -> Includes, Deviation
dispatch_6 = Dispatch(List=floors_horizontal_slabs_2, DispatchPattern=includes_4.Includes)  # -> ListA, ListB

floors_horizontal_panels_2 = Data(floors_horizontal_panels)
panel_deconstruct_3 = PanelDeconstruct(Panel=floors_horizontal_panels_2)  # -> Guid, ExtSurface, Material, Section, ExtEdgeCurves, ExtEdgeConnections, LocalX, LocalY, Identifier
area_7 = Area(Geometry=panel_deconstruct_3.ExtSurface)  # -> Area, Centroid
deconstruct_8 = Deconstruct(Point=area_7.Centroid)  # -> XComponent, YComponent, ZComponent
height_error_margin_6 = Domain(height_error_margin)
includes_5 = Includes(Value=deconstruct_8.ZComponent, Domain=height_error_margin_6)  # -> Includes, Deviation
dispatch_7 = Dispatch(List=floors_horizontal_panels_2, DispatchPattern=includes_5.Includes)  # -> ListA, ListB

dispatch_8 = Dispatch(List=walls_vertical_slabs, DispatchPattern=larger_than.LargerThan)  # -> flatten(ListA), ListB
# 5.2. Finding edge curves for line supports
# Once all walls above the storey are removed, we can sort out the curves for the line supports by checking if both the start and end
# of the curves are within the height margin. This assumes the top of the walls are flat to the roof, of course. Finding these, we can
# again use the resulting dispatch pattern to single out the curves we want.
slab_deconstruct_4 = SlabDeconstruct(Slab=dispatch_8.ListA)  # -> Guid, Surface, ThicknessItems, Material, ShellEccentricity, ShellOrthotropy, EdgeCurves, ShellEdgeConnections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
end_points_2 = EndPoints(Curve=slab_deconstruct_4.EdgeCurves)  # -> Start, End
deconstruct_9 = Deconstruct(Point=end_points_2.Start)  # -> XComponent, YComponent, ZComponent
deconstruct_10 = Deconstruct(Point=end_points_2.End)  # -> XComponent, YComponent, ZComponent
height_error_margin_7 = Domain(height_error_margin)
height_error_margin_8 = Domain(height_error_margin)
includes_6 = Includes(Value=deconstruct_10.ZComponent, Domain=height_error_margin_7)  # -> Includes, Deviation
includes_7 = Includes(Value=deconstruct_9.ZComponent, Domain=height_error_margin_8)  # -> Includes, Deviation
gate_and = GateAnd(A=includes_7.Includes, B=includes_6.Includes)
dispatch_9 = Dispatch(List=slab_deconstruct_4.EdgeCurves, DispatchPattern=gate_and)  # -> flatten(ListA), ListB

dispatch_10 = Dispatch(List=walls_vertical_panels, DispatchPattern=larger_than_2.LargerThan)  # -> flatten(ListA), ListB
panel_deconstruct_4 = PanelDeconstruct(Panel=dispatch_10.ListA)  # -> Guid, ExtSurface, Material, Section, ExtEdgeCurves, ExtEdgeConnections, LocalX, LocalY, Identifier
end_points_3 = EndPoints(Curve=panel_deconstruct_4.ExtEdgeCurves)  # -> Start, End
deconstruct_11 = Deconstruct(Point=end_points_3.Start)  # -> XComponent, YComponent, ZComponent
deconstruct_12 = Deconstruct(Point=end_points_3.End)  # -> XComponent, YComponent, ZComponent
height_error_margin_9 = Domain(height_error_margin)
height_error_margin_10 = Domain(height_error_margin)
includes_8 = Includes(Value=deconstruct_12.ZComponent, Domain=height_error_margin_10)  # -> Includes, Deviation
includes_9 = Includes(Value=deconstruct_11.ZComponent, Domain=height_error_margin_9)  # -> Includes, Deviation
gate_and_2 = GateAnd(A=includes_9.Includes, B=includes_8.Includes)
dispatch_11 = Dispatch(List=panel_deconstruct_4.ExtEdgeCurves, DispatchPattern=gate_and_2)  # -> flatten(ListA), ListB

motions_define = MotionsDefine(X_neg="0", X_pos="0", Y_neg="0", Y_pos="0", Z_neg="10^7", Z_pos="10^7")
rotations_free = RotationsFree()
support_points = Point(dispatch_3.ListA)
motions_rigidpoint = MotionsRigidPoint()
rotations_free_2 = RotationsFree()
support_lines = Curve([dispatch_9.ListA, dispatch_11.ListA])
pointsupport_define = PointSupportDefine(Point=support_points, Motions=motions_rigidpoint, Rotations=rotations_free, Identifier="S")  # -> flatten(PointSupport)
linesupport_define = LineSupportDefine(
    Curve=support_lines,
    Motions=motions_define,
    Rotations=rotations_free_2,
    MovingLocal=False,
    OrientLCS=True,
    Identifier="S")  # -> flatten(LineSupport)
load_combinations_2 = Data(load_combinations)
country_code_2 = Text(country_code)
floor_panel = Data(dispatch_7.ListA)
surface_load = Data(dispatch_4.ListA)
floor_slab = Data(dispatch_6.ListA)
loadcases_2 = Data(loadcases)
lineload = Data(dispatch_5.ListA)
storey_2 = Data(storey)

# ----
# 8. Final touches and creating the model
# The point and line supports needs to be created proper, since they didn't
# exist in the original file and are derived from geometry. However, all other
# data are sorted out from the original model and ready to be used.
country_code_3 = Text(country_code_2)
floor_slab_2 = Data(floor_slab)
floor_panel_2 = Data(floor_panel)
lineload_2 = Data(lineload)
surface_load_2 = Data(surface_load)
loadcases_3 = Data(loadcases_2)
load_combinations_3 = Data(load_combinations_2)
point_supports = Data(pointsupport_define)
line_supports = Data(linesupport_define)
storey_3 = Data(storey_2)
merge = Merge(Data1=lineload_2, Data2=surface_load_2)
merge_2 = Merge(Data1=point_supports, Data2=line_supports)
model_create = ModelCreate(
    CountryCode=country_code_3,
    Shells=floor_slab_2,
    Panels=floor_panel_2,
    Loads=merge,
    LoadCases=loadcases_3,
    LoadCombinations=load_combinations_3,
    Supports=merge_2,
    Storeys=storey_3)

# ----
# 10. Opening the new model
press_to_run_open_model_in_fem_design = Button()
close_all_open_fem_design_windows = BooleanToggle(True)
model_open = ModelOpen(
    FdModel=model_create,
    FilePathStruxml=file_path,
    CloseOpenWindows=close_all_open_fem_design_windows,
    RunNode=press_to_run_open_model_in_fem_design)
