# Grasshopper definition Example 5 - Using custom sections.gh (Grasshopper 1.0.7)
# plug-ins: FemDesign.Grasshopper

# ----
# Part 2: Using a custom section
# In this second part, we'll show how to load a custom
# section from a .struxml file and use it in your script.
# 1. Loading the section
# Select the section file you want to load, and connect it to the
# SectionDatabase.FromStruxml component. This loads the
# database you used when creating it. Then, fetch the section
# you want with the name you defined earlier.
# 
# This works just the same for sections created in the FEM-Design
# environment, as long as they are saved as .struxml files!
right_click_and_pick_your_file = FilePath()
file_path = Panel(right_click_and_pick_your_file)
sectiondatabase_fromstruxml = SectionDatabaseFromStruxml(FilePath=right_click_and_pick_your_file)
name = Panel("Custom I-section")
section_getsectionbyname = SectionGetSectionByName(SectionDatabase=sectiondatabase_fromstruxml, SectionName=name)

# ----
# Part 1: Creating a custom section
# In this first part, we'll show you how you can create a custom crossection,
# based on a simple geometry and some additional information.
# 1. Creating the geometry
# This example uses a section where the top and bottom flanges
# might differ in width and thickness. The measurements used are
# shown in the drawing below.
# 1.1 Setting the parameters
# B
# h''
# c''
# d
# H
# c'
# h'
# b
# [m]
B = Slider(0.18, range=0.01..0.5)
b = Slider(0.14, range=0.01..0.5)
H = Slider(0.3, range=0.01..1)
number_slider = Slider(0.07, range=0.001..0.1)
number_slider_2 = Slider(0.065, range=0.001..0.1)
number_slider_3 = Slider(0.02, range=0.001..0.1)
number_slider_4 = Slider(0.02, range=0.001..0.1)
d = Slider(0.03, range=0.001..0.1)
base_point = Point(Point(0, 0, 0))

# ----
# 1.2 Constructing geometry boundaries
expression = Expression(H=H, h2=number_slider, c2=number_slider_3, Expression="H/2-h2-c2")
expression_2 = Expression(H=H, h1=number_slider_2, c1=number_slider_4, Expression="h1+c1-h/2")
expression_3 = Expression(H=H, h2=number_slider, Expression="H/2-h2")
expression_4 = Expression(H=H, h1=number_slider_2, Expression="h1-H/2")
expression_5 = Expression(H=H, Expression="-H/2")
expression_6 = Expression(H=H, Expression="-H/2")
expression_7 = Expression(H=H, Expression="H/2")
expression_8 = Expression(H=H, Expression="H/2")
expression_9 = Expression(d=d, Expression="d/2")
expression_10 = Expression(d=d, Expression="d/2")
expression_11 = Expression(b=b, Expression="b/2")
expression_12 = Expression(b=b, Expression="b/2")
expression_13 = Expression(B=B, Expression="B/2")
expression_14 = Expression(B=B, Expression="B/2")
vector_xyz = VectorXYZ(XComponent=0, YComponent=expression_7, ZComponent=0)  # -> Vector, Length
vector_xyz_2 = VectorXYZ(XComponent=expression_13, YComponent=expression_8, ZComponent=0)  # -> Vector, Length
vector_xyz_3 = VectorXYZ(XComponent=expression_14, YComponent=expression_3, ZComponent=0)  # -> Vector, Length
vector_xyz_4 = VectorXYZ(XComponent=expression_9, YComponent=expression, ZComponent=0)  # -> Vector, Length
vector_xyz_5 = VectorXYZ(XComponent=expression_10, YComponent=expression_2, ZComponent=0)  # -> Vector, Length
vector_xyz_6 = VectorXYZ(XComponent=expression_11, YComponent=expression_4, ZComponent=0)  # -> Vector, Length
vector_xyz_7 = VectorXYZ(XComponent=expression_12, YComponent=expression_5, ZComponent=0)  # -> Vector, Length
vector_xyz_8 = VectorXYZ(XComponent=0, YComponent=expression_6, ZComponent=0)  # -> Vector, Length
move = Move(Geometry=base_point, Motion=vector_xyz.Vector)  # -> Geometry, Transform
move_2 = Move(Geometry=base_point, Motion=vector_xyz_2.Vector)  # -> Geometry, Transform
move_3 = Move(Geometry=base_point, Motion=vector_xyz_3.Vector)  # -> Geometry, Transform
move_4 = Move(Geometry=base_point, Motion=vector_xyz_4.Vector)  # -> Geometry, Transform
move_5 = Move(Geometry=base_point, Motion=vector_xyz_5.Vector)  # -> Geometry, Transform
move_6 = Move(Geometry=base_point, Motion=vector_xyz_6.Vector)  # -> Geometry, Transform
move_7 = Move(Geometry=base_point, Motion=vector_xyz_7.Vector)  # -> Geometry, Transform
move_8 = Move(Geometry=base_point, Motion=vector_xyz_8.Vector)  # -> Geometry, Transform

section = Data(section_getsectionbyname)

# ----
# 2.1 Model creation
countrycode_d_dk_est_fin_gb_h_n_pl_ro_s = Panel("S")  # "Countrycode (D/DK/EST/FIN/GB/H/N/PL/RO/S/TR)"
# 2. Using the section in a model
# We'll create a simple model to use as a showcase for
# the section - no supports or anything, just a beam for
# the section to apply to.
a_10m_long_line = Line(Line((0, 0, 0), (0, 10, 0)))
materialdatabase_default = MaterialDatabaseDefault(CountryCode=countrycode_d_dk_est_fin_gb_h_n_pl_ro_s)
material_getmaterialbyname = MaterialGetMaterialByName(MaterialDatabase=materialdatabase_default, MaterialName="C35/45")
countrycode_d_dk_est_fin_gb_h_n_pl_ro_s_2 = Panel("S")  # "Countrycode (D/DK/EST/FIN/GB/H/N/PL/RO/S/TR)"
bars_beamsimple = BarsBeamSimple(Curve=a_10m_long_line, Material=material_getmaterialbyname, Section=section, OrientLCS=True, Identifier="B")
model_createsimple = ModelCreateSimple(CountryCode=countrycode_d_dk_est_fin_gb_h_n_pl_ro_s_2, StructureElements=bars_beamsimple)

# ----
# 1.3 Creating a surface
merge = Merge(
    Data1=move.Geometry,
    Data2=move_2.Geometry,
    Data3=move_3.Geometry,
    Data4=move_4.Geometry,
    Data5=move_5.Geometry,
    Data6=move_6.Geometry,
    Data7=move_7.Geometry,
    Data8=move_8.Geometry)
polyline = PolyLine(Vertices=merge, Closed=False)
yz_plane = YZPlane(Origin=Point(0, 0, 0))
mirror = Mirror(Geometry=polyline, Plane=yz_plane)  # -> Geometry, Transform
boundary_surfaces = BoundarySurfaces(Edges=[polyline, mirror.Geometry])

# ----
# Example 5: Using custom sections
# This example will show you how to create your own custom
# section parametrically and save it as a .struxlm file. It will
# also show you how to load a custom section and use in your
# Grasshopper scripts.
info = Info()

# ----
# 2. Defining the section
# The Section.Define component is used to create the section. The template surface is used
# to define the geometry, and the Material type defines what materials are available to use
# with this section. The Name, Group name, Type name and Size name are all customizable
# and will determine how the section is organised in FEM-Design.
material_type_steelrolled_steelcoldworke = Panel("Concrete")  # "Material type (SteelRolled/SteelColdWorked/SteelWelded/Concrete/Timber)"
type_name = Panel("Concrete")
size_name_template = Panel("Custom {0}")
name_2 = Panel("Custom I-section")
group_name = Panel("My custom sections")
expression_15 = Expression(H=H, Expression="H*1000")
format = Format(Format=size_name_template, Culture=127, Data0=expression_15)
size_name = Panel(format)
define = SectionDefine(
    Surfaces=boundary_surfaces,
    Name=name_2,
    MaterialType=material_type_steelrolled_steelcoldworke,
    GroupName=group_name,
    TypeName=type_name,
    SizeName=format)

# ----
# 2.2 Opening the model
use_file_path_from = ValueList({"current directory": 0, "user defined folder": 1}, selected="current directory")
user_defined_folder = FilePath("C:\Users\SamuelNyberg\OneDrive - StruSoft AB\Samuels arbetshörna\2. API-exempel\")
file_name_end_with_struxml = Panel("Example 5 - model with custom section.struxml")
current_directory = GhPythonScript()  # -> folder
# ---------- current_directory: Python ----------
import rhinoscriptsyntax as rs

folder = rs.DocumentPath()
# ---------- end current_directory ----------
press_to_run_open_model_in_fem_design = Button()
stream_filter = StreamFilter(Gate=use_file_path_from, Stream0=current_directory, Stream1=user_defined_folder)
close_all_open_fem_design_windows = BooleanToggle(True)
concatenate = Concatenate(FragmentA=stream_filter, FragmentB=file_name_end_with_struxml)
resulting_file_path = Panel(concatenate)
model_open = ModelOpen(
    FdModel=model_createsimple,
    FilePathStruxml=concatenate,
    CloseOpenWindows=close_all_open_fem_design_windows,
    RunNode=press_to_run_open_model_in_fem_design)

use_file_path_from_2 = ValueList({"current directory": 0, "user defined folder": 1}, selected="current directory")
user_defined_folder_2 = FilePath("C:\Users\SamuelNyberg\OneDrive - StruSoft AB\Samuels arbetshörna\2. API-exempel\")
file_name_end_with_struxml_2 = Panel("Example 5 - my example section.struxml")
current_directory_2 = GhPythonScript()  # -> folder; same code as current_directory
# 3. Save section as file
# Finally, select a Section Database where you want
# to store your file, and then save it to a .struxml format.
sectiondatabase_default = SectionDatabaseDefault()
stream_filter_2 = StreamFilter(Gate=use_file_path_from_2, Stream0=current_directory_2, Stream1=user_defined_folder_2)
concatenate_2 = Concatenate(FragmentA=stream_filter_2, FragmentB=file_name_end_with_struxml_2)
addsection = SectionDatabaseAddSection(SectionDatabase=sectiondatabase_default, Section=define)
resulting_file_path_2 = Panel(concatenate_2)
save = SectionDatabaseSave(SectionDatabase=addsection, FilePathStruxml=concatenate_2)
