# Grasshopper definition Example 6 - Manual and automatic RC design.gh (Grasshopper 1.0.7)
# plug-ins: FemDesign.Grasshopper

# ----
# Materials and sections
countrycode_d_dk_est_fin_gb_h_n_pl_ro_s = Panel("S")  # "Countrycode (D/DK/EST/FIN/GB/H/N/PL/RO/S/TR)"
materialdatabase_default = MaterialDatabaseDefault(CountryCode=countrycode_d_dk_est_fin_gb_h_n_pl_ro_s)
sectiondatabase_default = SectionDatabaseDefault()
material_getmaterialbyname = MaterialGetMaterialByName(MaterialDatabase=materialdatabase_default, MaterialName="C35/45")
material_getmaterialbyname_2 = MaterialGetMaterialByName(MaterialDatabase=materialdatabase_default, MaterialName="K500B")
section_getsectionbyname = SectionGetSectionByName(SectionDatabase=sectiondatabase_default, SectionName="Concrete sections, Rectangle, 400x500")
concrete_material = Data(material_getmaterialbyname)
steel_material = Data(material_getmaterialbyname_2)
beam_section = Data(section_getsectionbyname)

# ----
# Sätt variabler på dessa så man slipper skriva ut de långa namnen! Och samla dem i början (input) och slutet (output)
# 
# Gör så också en sån ritning, är ett bra accompanjang
# Longitudinal bars - beam
longitudinal_bar_diameter_m = Slider(0.006, range=0..0.07)
start_anchorage = Slider(0.8, range=0..1)
end_anchorage = Slider(0.8, range=0..1)
start = Slider(1, range=0..7)
end = Slider(6, range=0..7)

# ----
# Stirrups - beam
# General - beam
# Går jag mer logiskt borde jag nog slå samman dessa... Eller?
# Skulle också kunna utöka så att man kan offseta alla fyra håll, som i FEM-Design, men det blir ju lite extra komponenter såklart
d_stirrup_bar_diameter_m = Slider(0.01, range=0..0.07)
sm_spacing_middle_m = Slider(0.2, range=0..1)
sr_spacing_right_m = Slider(0.1, range=0..2)
stirrup_cover_depth = Slider(0.03, range=0.001..0.2)
# Detta är dock inte med på tab 2, utan i manuell design.. Dock måste det vara med. Hur kommenterar jag det?
# 
# Kanske dags att släppa tabs och gå över till en inspirerad logisk ordning?
lr_length_right_m = Slider(1.2, range=0..7)
sl_spacing_left_m = Slider(0.1, range=0..1)
ll_length_left_m = Slider(1.2, range=0..7)

# ----
# Reinforcement net - plate
reinforcement_net_bar_diameter_m = Slider(0.006, range=0..0.07)
reinforcement_net_spacing = Slider(0.2, range=0..1)
reinforcement_net_cover = Slider(0.015, range=0..0.1)
slab_thickness = Slider(0.2, range=0..1)

# ----
# 1.3. Load cases
panel = Panel("Liveload")
loadcase_create = LoadCaseCreate(Name=panel, Type="static", DurationClass="permanent")
loadcase_create_2 = LoadCaseCreate(Name="Deadload", Type="dead_load", DurationClass="permanent")
merge = Merge(Data1=loadcase_create, Data2=loadcase_create_2)

beam_section_2 = Data(beam_section)
section_deconstruct = SectionDeconstruct(Section=beam_section_2)  # -> Guid, Name, Surfaces, SectionType, MaterialType, GroupName, TypeName, SizeName
longitudinal_bar_diameter_dl = Number(longitudinal_bar_diameter_m)
dimensions = Dimensions(Surface=section_deconstruct.Surfaces)  # -> UDimension, VDimension
stirrup_bar_diameter_ds = Number(d_stirrup_bar_diameter_m)
cover_depth_cvr = Number(stirrup_cover_depth)
expression = Expression(
    y=dimensions.UDimension,
    cvr=cover_depth_cvr,
    ds=stirrup_bar_diameter_ds,
    dl=longitudinal_bar_diameter_dl,
    Expression="y/2-cvr-ds-dl/2")
expression_2 = Expression(
    z=dimensions.VDimension,
    cvr=cover_depth_cvr,
    ds=stirrup_bar_diameter_ds,
    dl=longitudinal_bar_diameter_dl,
    Expression="z/2-cvr-ds-dl/2")
steel_material_2 = Data(steel_material)
wire_define = WireDefine(Diameter=longitudinal_bar_diameter_m, Material=steel_material_2, Profile="ribbed")
negative = Negative(Value=expression)
negative_2 = Negative(Value=expression_2)
start_anchorage_2 = Number(start_anchorage)
end_anchorage_2 = Number(end_anchorage)
end_2 = Number(end)
start_2 = Number(start)
barreinforcement_longitudinalbar = BarReinforcementLongitudinalBar(
    Wire=wire_define,
    YPos=graft([expression, negative]),
    ZPos=[expression_2, negative_2],
    StartAnchorage=start_anchorage_2,
    EndAnchorage=end_anchorage_2,
    Start=start_2,
    End=end_2,
    AuxiliaryBar=False)

# ----
# Geometry
# when you structure this, do it based on the FD menus and settings (parametric modelling)
# Just nu är den hårdkodad för att göra en armering i varje hörn - ska jag lägga till fler? Känns som overkill...
support_points_beam = Point([Point(1, 2, 0), Point(4, 2, 0), Point(8, 2, 0)])
support_points_slab = Point([Point(2, 9, 0), Point(4, 9, 0), Point(6, 9, 0), Point(6, 7, 0), Point(6, 5, 0), Point(4, 5, 0), Point(2, 5, 0), Point(2, 7, 0), Point(4, 7, 0)])
beam_baseline = Curve(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)
slab_surface = Surface(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)

beam_section_3 = Data(beam_section)
section_deconstruct_2 = SectionDeconstruct(Section=beam_section_3)  # -> Guid, Name, Surfaces, SectionType, MaterialType, GroupName, TypeName, SizeName
beam_baseline_2 = Curve(beam_baseline)
brep_edges = BrepEdges(Brep=section_deconstruct_2.Surfaces)  # -> Naked, Interior, NonManifold
length = Length(Curve=beam_baseline_2)
lr_length_right = Number(lr_length_right_m)
join_curves = JoinCurves(Curves=brep_edges.Naked, Preserve=False)
subtraction = Subtraction(A=length, B=lr_length_right)
ll_length_left = Number(ll_length_left_m)
construct_domain = ConstructDomain(DomainStart="0", DomainEnd=ll_length_left)
construct_domain_2 = ConstructDomain(DomainStart=ll_length_left, DomainEnd=subtraction)
construct_domain_3 = ConstructDomain(DomainStart=subtraction, DomainEnd=length)
merge_2 = Merge(Data1=sl_spacing_left_m, Data2=sm_spacing_middle_m, Data3=sr_spacing_right_m)  # -> flatten(Result)
negative_3 = Negative(Value=stirrup_cover_depth)
steel_material_3 = Data(steel_material)
offset_curve = OffsetCurve(Curve=join_curves, Distance=negative_3, Plane=PlaneXY(0, 0, 0), Corners=1)
wire_define_2 = WireDefine(Diameter=d_stirrup_bar_diameter_m, Material=steel_material_3, Profile="ribbed")
deconstruct_domain = DeconstructDomain(Domain=[construct_domain, construct_domain_2, construct_domain_3])  # -> Start, End
barreinforcement_stirrups = BarReinforcementStirrups(Wire=wire_define_2, Profile=offset_curve, Start=deconstruct_domain.Start, End=deconstruct_domain.End, Spacing=merge_2)

slab_face = Panel("""top
bottom""")
wire_direction = Panel("""x
y""")
steel_material_4 = Data(steel_material)
straight_reinforcementlayout = StraightReinforcementLayout(Direction=wire_direction, Space=reinforcement_net_spacing, Face=graft(slab_face), Cover=reinforcement_net_cover)
wire_define_3 = WireDefine(Diameter=reinforcement_net_bar_diameter_m, Material=steel_material_4, Profile="ribbed")
concrete_material_2 = Data(concrete_material)
slab_surface_2 = Surface(slab_surface)
surfacereinforcement_bysurface = SurfaceReinforcementBySurface(Surface=slab_surface_2, Straight=straight_reinforcementlayout, Wire=wire_define_3)  # -> flatten(SurfaceReinforcement)
slab_plate = SlabPlate(Surface=slab_surface_2, Thickness=slab_thickness, Material=concrete_material_2, Identifier="P")
surfacereinforcement_addtoslab = SurfaceReinforcementAddToSlab(Slab=slab_plate, SurfaceReinforcement=surfacereinforcement_bysurface)

liveload_beam = Slider(10, range=0..20)
deadload_beam = Slider(20, range=0..20)
deadload_slab = Slider(20, range=0..20)
liveload_slab = Slider(10, range=0..20)
unit_z = UnitZ(Factor=liveload_beam)  # -> expr("-x", UnitVector)
unit_z_2 = UnitZ(Factor=deadload_beam)  # -> expr("-x", UnitVector)
unit_z_3 = UnitZ(Factor=liveload_slab)  # -> expr("-x", UnitVector)
unit_z_4 = UnitZ(Factor=deadload_slab)  # -> expr("-x", UnitVector)
load_case_deadload = Data(loadcase_create_2)
load_case_deadload_2 = Data(loadcase_create_2)
load_case_liveload = Data(loadcase_create)
load_case_liveload_2 = Data(loadcase_create)
beam_baseline_3 = Curve(beam_baseline)
slab_surface_3 = Surface(slab_surface)
lineload_force = LineLoadForce(Curve=beam_baseline_3, StartForce=unit_z, EndForce=unit_z, LoadCase=load_case_liveload_2, ConstLoadDir=True)
lineload_force_2 = LineLoadForce(Curve=beam_baseline_3, StartForce=unit_z_2, EndForce=unit_z_2, LoadCase=load_case_deadload, ConstLoadDir=True)
surfaceload_uniform = SurfaceLoadUniform(Surface=slab_surface_3, Force=unit_z_3, LoadCase=load_case_liveload)
surfaceload_uniform_2 = SurfaceLoadUniform(Surface=slab_surface_3, Force=unit_z_4, LoadCase=load_case_deadload_2)

# ----
# 3.1. Load combinations
panel_2 = Panel("serviceability_characteristic")
panel_3 = Panel("""1.35
1.5""")
panel_4 = Panel("""1.0
1.0""")
loadcombination_create = LoadCombinationCreate(Name="SLS", Type=panel_2, LoadCase=merge, Gamma=panel_4)
loadcombination_create_2 = LoadCombinationCreate(Name="ULS", Type="ultimate_ordinary", LoadCase=merge, Gamma=panel_3)

support_points_slab_2 = Point(support_points_slab)
support_points_beam_2 = Point(support_points_beam)
rotations_free = RotationsFree()
motions_rigidpoint = MotionsRigidPoint()
rotations_free_2 = RotationsFree()
motions_rigidpoint_2 = MotionsRigidPoint()
pointsupport_define = PointSupportDefine(Point=support_points_beam_2, Motions=motions_rigidpoint_2, Rotations=rotations_free_2, Identifier="S")
pointsupport_define_2 = PointSupportDefine(Point=support_points_slab_2, Motions=motions_rigidpoint, Rotations=rotations_free, Identifier="S")

concrete_material_3 = Data(concrete_material)
beam_baseline_4 = Curve(beam_baseline)
beam_section_4 = Data(beam_section)
bars_beam = BarsBeam(Curve=beam_baseline_4, Material=concrete_material_3, Section=beam_section_4, OrientLCS=True, Identifier="B")

# ----
# Slå ihop dessa? Om de ändå är samma upplägg (kontrollera detta först)
merge_3 = Merge(Data1=loadcombination_create, Data2=loadcombination_create_2)
merge_4 = Merge(Data1=pointsupport_define_2, Data2=pointsupport_define)
merge_5 = Merge(Data1=lineload_force, Data2=lineload_force_2, Data3=surfaceload_uniform, Data4=surfaceload_uniform_2)
merge_6 = Merge(Data1=barreinforcement_stirrups, Data2=barreinforcement_longitudinalbar)  # -> flatten(Result)
barreinforcement_addtobar = BarReinforcementAddToBar(Bar=bars_beam, BarReinforcement=merge_6, Overwrite=True)
model_create = ModelCreate(
    CountryCode="S",
    Bars=barreinforcement_addtobar,
    Shells=surfacereinforcement_addtoslab,
    Loads=merge_5,
    LoadCases=merge,
    LoadCombinations=merge_3,
    Supports=merge_4)

file_name_end_with_struxml = Panel("automatically_designed_RC.struxml")
press_to_open_model_in_fem_design_and_ru = Button()  # "Press to open model in FEM-Design and run auto-design:"
close_all_open_fem_design_windows_when_r = BooleanToggle(True)  # "Close all open FEM-Design windows when running?"
close_fem_design_window_after_analysis_i = BooleanToggle(False)  # "Close FEM-Design window after analysis is done?"
autodesign = BooleanToggle(True)
directory = FilePath("C:\Users\SamuelNyberg\OneDrive - StruSoft AB\Samuels arbetshörna\2. API-exempel\")
analysis_define = AnalysisDefine(
    CalcCase="true",
    CalcCstage=False,
    CalcImpf=False,
    CalcComb="true",
    CalcGmax=False,
    CalcStab=False,
    CalcFreq=False,
    CalcSeis=False,
    CalcDesign="true",
    CalcFootfall=False,
    Elemfine=False,
    Diaphragm=False,
    PeakSmoothing=False)
design_define = DesignDefine(AutoDesign=autodesign, Check=True)
concatenate = Concatenate(FragmentA=directory, FragmentB=file_name_end_with_struxml)
# Ändra detta till Marcos komponent
panel_5 = Panel("rc")
application_rundesign = ApplicationRunDesign(
    Mode=panel_5,
    FdModel=model_create,
    FilePathStruxml=concatenate,
    Analysis=analysis_define,
    Design=design_define,
    EndSession=close_fem_design_window_after_analysis_i,
    CloseOpenWindows=close_all_open_fem_design_windows_when_r,
    RunNode=press_to_open_model_in_fem_design_and_ru)

file_name_end_with_struxml_2 = Panel("manually_designed_RC.struxml")
directory_2 = FilePath("C:\Users\SamuelNyberg\OneDrive - StruSoft AB\Samuels arbetshörna\2. API-exempel\")
concatenate_2 = Concatenate(FragmentA=directory_2, FragmentB=file_name_end_with_struxml_2)
model_open = ModelOpen(FdModel=model_create, FilePathStruxml=concatenate_2, CloseOpenWindows=Toggle(True), RunNode=Button())
# Jag vet inte riktigt var/hur jag ser resultatet här så jag skulle behöva hjälp att se om det blivit rätt
resulting_file_path = Panel(concatenate)
resulting_file_path_2 = Panel(concatenate_2)

subtraction_2 = Subtraction(A=ll_length_left_m, B="0")
subtraction_3 = Subtraction(A=lr_length_right_m, B=ll_length_left_m)
subtraction_4 = Subtraction(A=length, B=lr_length_right_m)
division = Division(A=subtraction_2, B=sl_spacing_left_m)
division_2 = Division(A=subtraction_3, B=sm_spacing_middle_m)
division_3 = Division(A=subtraction_4, B=sr_spacing_right_m)
repeat_data = RepeatData(Data=sm_spacing_middle_m, Length=division_2)
repeat_data_2 = RepeatData(Data=sl_spacing_left_m, Length=division)
repeat_data_3 = RepeatData(Data=sr_spacing_right_m, Length=division_3)
merge_7 = Merge(Data1=repeat_data_2, Data2=repeat_data, Data3=repeat_data_3)  # -> flatten(Result)
expression_3 = Expression(start=start, anchorage=start_anchorage, Expression="start-anchorage")
expression_4 = Expression(end=end, anchorage=end_anchorage, Expression="end+anchorage")
beam_curve = Curve(reparameterize(beam_baseline_4))
edge_point = Point(Point(1, 2, 0))
construct_point = ConstructPoint(XCoordinate=expression, YCoordinate=graft(expression_2), ZCoordinate=0)  # -> flatten(Point)
mass_addition = MassAddition(Input=merge_7)  # -> Result, PartialResults
length_2 = Length(Curve=beam_curve)
yz_plane = YZPlane(Origin=edge_point)
length_3 = Length(Curve=beam_curve)
remap_numbers = RemapNumbers(Value=[expression_3, expression_4], Source=length_2, Target=Domain(0, 1))  # -> graft(Mapped), Clipped
orient = Orient(Geometry=section_deconstruct.Surfaces, Source=PlaneXY(0, 0, 0), Target=yz_plane)  # -> Geometry, Transform
orient_2 = Orient(Geometry=construct_point, Source=PlaneXY(0, 0, 0), Target=yz_plane)  # -> Geometry, Transform
division_4 = Division(A=d_stirrup_bar_diameter_m, B="2")
remap_numbers_2 = RemapNumbers(Value=mass_addition.PartialResults, Source=length_3, Target=Domain(0, 1))  # -> graft(Mapped), Clipped
evaluate_curve = EvaluateCurve(Curve=beam_curve, Parameter=remap_numbers.Mapped)  # -> Point, Tangent, Angle
join_curves_2 = JoinCurves(Curves=orient.Geometry, Preserve=False)
addition = Addition(A=stirrup_cover_depth, B=division_4)
evaluate_curve_2 = EvaluateCurve(Curve=beam_curve, Parameter=remap_numbers_2.Mapped)  # -> Point, Tangent, Angle
extrude_linear = ExtrudeLinear(Profile=orient.Geometry, OrientationP=yz_plane, Axis=beam_curve, OrientationA=yz_plane)
bend_radius = Slider(0.015, range=0..0.1)
vector_2pt = Vector2Pt(PointA=edge_point, PointB=evaluate_curve.Point, Unitize=False)  # -> Vector, Length
offset_curve_2 = OffsetCurve(Curve=join_curves_2, Distance=addition, Plane=PlaneXY(0, 0, 0), Corners=1)
vector_2pt_2 = Vector2Pt(PointA=edge_point, PointB=evaluate_curve_2.Point, Unitize=False)  # -> Vector, Length
move = Move(Geometry=orient_2.Geometry, Motion=vector_2pt.Vector)  # -> Geometry, Transform
fillet = Fillet(Curve=offset_curve_2, Radius=bend_radius)
explode_tree = ExplodeTree(Data=move.Geometry)  # -> Branch0, Branch1
move_2 = Move(Geometry=fillet, Motion=vector_2pt_2.Vector)  # -> Geometry, Transform
division_5 = Division(A=longitudinal_bar_diameter_m, B="2")
line = Line(StartPoint=explode_tree.Branch0, EndPoint=explode_tree.Branch1)
pipe = Pipe(Curve=move_2.Geometry, Radius=division_4, Caps=0)
pipe_2 = Pipe(Curve=line, Radius=division_5, Caps="1")
longitudal_bars = Brep(pipe_2)
beam = Brep(extrude_linear)
stirrups = Brep(pipe)

# ---- group: do they intersect?
mesh_intersection = MeshIntersection(MeshesA=pipe_2, MeshesB=pipe)  # disabled
