# Grasshopper definition Post-tensioned cables.gh (Grasshopper 1.0.7)
# plug-ins: FemDesign.Grasshopper

# ----
# Bar
line = Line(Line((0, 0, 0), (10, 0, 0)))
path = FilePath("C:\Users\AlexanderRadne\AppData\Roaming\StruSoft\FEM-Design Api\materialLibrary\materials_S.struxml")
path_2 = FilePath("C:\Users\AlexanderRadne\AppData\Roaming\StruSoft\FEM-Design Api\sectionLibrary\sections.struxml")
fromstruxml = MaterialDatabaseFromStruxml(FilePath=path)
fromstruxml_2 = SectionDatabaseFromStruxml(FilePath=path_2)
getmaterialbyname = MaterialGetMaterialByName(MaterialDatabase=fromstruxml, MaterialName="C35/45")
getsectionbyname = SectionGetSectionByName(SectionDatabase=fromstruxml_2, SectionName="Concrete sections, Rectangle, 300x900")
beam = BarsBeam(Curve=line, Material=getmaterialbyname, Section=getsectionbyname, OrientLCS=True, Identifier="B")

# ----
# Save filepath
panel = Panel("\post-tensioned cables Grasshopper.struxml")
mydocuments = CSharpScript()  # -> A
# ---------- mydocuments: C# usings ----------
using System.IO;
# ---------- mydocuments: C# ----------
    A = Path.Combine(Environment.GetFolderPath(Environment.SpecialFolder.MyDocuments));
# ---------- end mydocuments ----------
concat = Concatenate(FragmentA=mydocuments, FragmentB=panel)

# ----
# Shape of PTC
panel_2 = Panel("-10.0/180.0 * pi")
ptcinner = PtcShapeInner(X="0.4", Z="-0.900", Tangent="0.0", PriorInflectionX="0.1")
ptcinner_2 = PtcShapeInner(X="0.6", Z="-0.900", Tangent="0.0", PriorInflectionX="0.5")
ptcend = PtcShapeEnd(Z="-0.450", Tangent=panel_2, PriorInflectionX="0.9")
ptcstart = PtcShapeStart(Z="-0.450", Tangent="10.0/180.0 * pi")

merge = Merge(Data1=ptcinner, Data2=ptcinner_2)

shape = PtcShape(Start=ptcstart, Intermidiate=merge, End=ptcend)

# ----
# Post-tensioned cable
panel_3 = Panel("Custom ptc material")
panel_4 = Panel("""0.2
0.4
0.5
0.6
0.8""")
strand = PtcStrand(Name=panel_3, F_pk="1860.0", A_p="150.0", E_p="195000.0", Density="7.810", RelaxationClass="2", Rho_1000="0.1")
manufacturing = PtcManufacturing(Positions=panel_4, ShiftX="0.0", ShiftZ="0.1")
losses = PtcLosses(
    CurvatureCoefficient="0.05",
    WobbleCoefficient="0.007",
    AnchorageSetSlip="0.0",
    ElasticShortening="0.0",
    CreepStress="0.0",
    ShrinkageStress="0.0",
    RelaxationStress="0.0")
list = ValueList({"Start", "End", "StartThenEnd", "EndThenStart": "StartThenEnd"}, selected="Start")
ptc = PostTensionedCable(
    Bar=beam,
    Shape=shape,
    Losses=losses,
    Manufacturing=manufacturing,
    StrandData=strand,
    JackingSide=list,
    JackingStress=Slider(1000, range=1000..1000000),
    NumberOfStrands=Slider(3, range=1..10),
    Identifier="Custom_PTC")

# ----
# Create model
merge_2 = Merge(Data1=beam, Data2=ptc)
create = ModelCreateSimple(CountryCode="S", StructureElements=merge_2)
save = ModelSave(FdModel=create, FilePathStruxml=concat)

# ----
# Open model
toggle = BooleanToggle(True)
runnode = BooleanToggle(True)
and = GateAnd(A=save, B=runnode)
open = ModelOpen(FdModel=create, FilePathStruxml=concat, CloseOpenWindows=toggle, RunNode=and)
