# Dynamo graph PointSupport.dyn (Dynamo 2.10.0.3455)
# packages: FemDesign ZeroTouch 1.0.0, FemDesign 2 1.0.0

byCoordinates = Point.ByCoordinates()
code_block = CodeBlock { "Alex"; }
hinged = FemDesign.DynamoZeroTouch.PointSupport.Hinged(point=byCoordinates, identifier=code_block)
testMethod = TestMethodNodeModel()
hinged_2 = PointSupportNodeModel(point=testMethod, identifier=byCoordinates)  # "PointSupport.Hinged"
